# Grasshopper definition geometry_bake.gh (Grasshopper 1.0.8)
# plug-ins: RhinoCodePluginGH, Swiftlet

# ----
# CREATE A SPHERE
panel = Panel("Sphere origin point X")
param = DefineToolParameter(Name="radius", Type="double", Description="Sphere radius", Required=True)
param_2 = DefineToolParameter(Name="origin_x", Type="double", Description=panel, Required=True)
param_3 = DefineToolParameter(Name="origin_y", Type="double", Description="Sphere origin point Y", Required=True)
param_4 = DefineToolParameter(Name="origin_z", Type="double", Description="Sphere origin point Z", Required=True)
merge = Merge(Data1=param_2, Data2=param_3, Data3=param_4, Data4=param)
tool = DefineTool(Name="create-sphere", Description="Bakes a NURBS sphere to the Rhino document.", Parameters=merge)
panel_2 = Panel("origin_x")
panel_3 = Panel("origin_y")
panel_4 = Panel("origin_z")
panel_5 = Panel("radius")

# ----
# SCALE OBJECT
panel_6 = Panel("Scaling factor for the selected object")
param_5 = DefineToolParameter(Name="object_name", Type="string", Description="Name of the object to scale", Required=True)
param_6 = DefineToolParameter(Name="scaling_factor", Type="double", Description=panel_6, Required=True)
merge_2 = Merge(Data1=param_5, Data2=param_6)
panel_7 = Panel("Selects an object by name from the Rhino document and scale it around its centroid")
tool_2 = DefineTool(Name="scale-object", Description=panel_7, Parameters=merge_2)
panel_8 = Panel("scaling_factor")
panel_9 = Panel("object_name")

# ----
# CREATE A BOX
panel_10 = Panel("Sphere origin point Y")
param_7 = DefineToolParameter(Name="origin_x", Type="double", Description="Sphere origin point X", Required=True)
param_8 = DefineToolParameter(Name="origin_y", Type="double", Description=panel_10, Required=True)
param_9 = DefineToolParameter(Name="origin_z", Type="double", Description="Sphere origin point Z", Required=True)
param_10 = DefineToolParameter(Name="len_x", Type="double", Description="Box length in X", Required=True)
param_11 = DefineToolParameter(Name="len_y", Type="double", Description="Box length in Y", Required=True)
param_12 = DefineToolParameter(Name="len_z", Type="double", Description="Box length in Z", Required=True)
merge_3 = Merge(Data1=param_7, Data2=param_8, Data3=param_9, Data4=param_10, Data5=param_11, Data6=param_12)
tool_3 = DefineTool(Name="create-box", Description="Bakes a NURBS box to the Rhino document.", Parameters=merge_3)
panel_11 = Panel("origin_x")
panel_12 = Panel("origin_y")
panel_13 = Panel("origin_z")
panel_14 = Panel("len_y")
panel_15 = Panel("len_z")
panel_16 = Panel("len_x")

# ----
# MESH BREP
panel_17 = Panel("Determines whether the original BREP object should be deleted")
param_13 = DefineToolParameter(Name="object_name", Type="string", Description="Name of the BREP object to mesh", Required=True)
param_14 = DefineToolParameter(Name="delete_original", Type="bool", Description=panel_17, Required=True)
merge_4 = Merge(Data1=param_13, Data2=param_14)
tool_4 = DefineTool(Name="mesh-brep", Description="Select a BREP using its Name and turn it into a mesh", Parameters=merge_4)
panel_18 = Panel("delete_original")
panel_19 = Panel("object_name")

# ----
# MOVE OBJECT
panel_20 = Panel("X component of the translation vector")
param_15 = DefineToolParameter(Name="vector_x", Type="double", Description=panel_20, Required=True)
param_16 = DefineToolParameter(Name="vector_y", Type="double", Description="Y component of the translation vector", Required=True)
param_17 = DefineToolParameter(Name="vector_z", Type="double", Description="Z component of the translation vector", Required=True)
param_18 = DefineToolParameter(Name="object_name", Type="string", Description="Name of the object to move", Required=True)
merge_5 = Merge(Data1=param_18, Data2=param_15, Data3=param_16, Data4=param_17)
panel_21 = Panel("Select an object from the Rhino document using its Name and move it along a translation vector.")
tool_5 = DefineTool(Name="move-object", Description=panel_21, Parameters=merge_5)
panel_22 = Panel("vector_y")
panel_23 = Panel("vector_z")
panel_24 = Panel("vector_x")
panel_25 = Panel("object_name")

# ----
# ROTATE OBJECT
panel_26 = Panel("Name of the object to rotate")
param_19 = DefineToolParameter(Name="rotation_x_degrees", Type="double", Description="Rotation around X axis in degrees", Required=True)
param_20 = DefineToolParameter(Name="object_name", Type="string", Description=panel_26, Required=True)
param_21 = DefineToolParameter(Name="rotation_y_degrees", Type="double", Description="Rotation around Y axis in degrees", Required=True)
param_22 = DefineToolParameter(Name="rotation_z_degrees", Type="double", Description="Rotation around Z axis in degrees", Required=True)
merge_6 = Merge(Data1=param_20, Data2=param_19, Data3=param_21, Data4=param_22)
panel_27 = Panel("Rotate an object around three individual axis with the pivot point at the object centroid (first rotates around X, then Y, then Z).")
tool_6 = DefineTool(Name="rotate-object", Description=panel_27, Parameters=merge_6)
panel_28 = Panel("rotation_y_degrees")
panel_29 = Panel("rotation_z_degrees")
panel_30 = Panel("rotation_x_degrees")
panel_31 = Panel("object_name")

# ----
# NORMAL COLOR MESH
panel_32 = Panel("Name of the object to rotate")
param_23 = DefineToolParameter(Name="object_name", Type="string", Description=panel_32, Required=True)
merge_7 = Merge(Data1=param_23)
tool_7 = DefineTool(Name="normal-color-mesh", Description="Vertex-color a mesh with a normal map", Parameters=merge_7)
panel_33 = Panel("object_name")

# ----
# LIST OBJECT NAMES
panel_34 = Panel("List all of the object names in the Rhino document")
tool_8 = DefineTool(Name="list-objects", Description=panel_34)

merge_8 = Merge(Data1=tool, Data2=tool_3, Data3=tool_2, Data4=tool_4, Data5=tool_5, Data6=tool_6, Data7=tool_7, Data8=tool_8)
mcp = MCPServer(Port=3001, Tools=merge_8, ServerName="Swiftlet")  # -> CreateSphere, CreateBox, ScaleObject, MeshBrep, MoveObject, RotateObject, NormalColorMesh, ListObjects

decall = DeconstructToolCall(Request=mcp.ListObjects)  # -> Request, Tool, Arguments
py3 = Python3Script(trigger=decall.Tool)  # -> names
# ---------- py3: Python ----------
import Rhino
import scriptcontext as sc
import json

names = []
if trigger is not None:
    sc.doc = Rhino.RhinoDoc.ActiveDoc
    for obj in sc.doc.Objects:
        name = obj.Attributes.Name
        if name:
            names.append(name)
    sc.doc = ghdoc
# ---------- end py3 ----------
cjv = CreateJSONValue(Value=py3)
cja = CreateJSONArray(JTokens=cjv)
respond = MCPToolResponse(Request=decall.Request, Content=cja, IsError=False)

decall_2 = DeconstructToolCall(Request=mcp.CreateSphere)  # -> Request, Tool, Arguments
null = NullItem(Item=decall_2.Arguments)  # -> NullFlags, InvalidFlags, Description
gjok = GetJSONObjectKey(JObject=decall_2.Arguments, Key=panel_2)
gjok_2 = GetJSONObjectKey(JObject=decall_2.Arguments, Key=panel_3)
gjok_3 = GetJSONObjectKey(JObject=decall_2.Arguments, Key=panel_4)
gjok_4 = GetJSONObjectKey(JObject=decall_2.Arguments, Key=panel_5)
rjv = ReadJSONValue(JValue=gjok)  # -> AsString, AsNumber, AsBool
rjv_2 = ReadJSONValue(JValue=gjok_2)  # -> AsString, AsNumber, AsBool
rjv_3 = ReadJSONValue(JValue=gjok_3)  # -> AsString, AsNumber, AsBool
rjv_4 = ReadJSONValue(JValue=gjok_4)  # -> AsString, AsNumber, AsBool
not = GateNot(A=null.NullFlags)
py3_2 = Python3Script(trigger=decall_2.Arguments, prefix="sphere")  # -> random_id; inputs prefix: String
# ---------- py3_2: Python ----------
import random

id = random.randint(1000000, 9999999)
random_id = f"{prefix}-{id}"
# ---------- end py3_2 ----------
sphere_name = Panel(py3_2)

# ---- group: Request Is Not Null
bool = Boolean(not)

# ---- group: X
num = Number(rjv.AsNumber)

# ---- group: Y
num_2 = Number(rjv_2.AsNumber)

# ---- group: Z
num_3 = Number(rjv_3.AsNumber)

# ---- group: Radius
num_4 = Number(rjv_4.AsNumber)

# ----
decall_3 = DeconstructToolCall(Request=mcp.CreateBox)  # -> Request, Tool, Arguments
gjok_5 = GetJSONObjectKey(JObject=decall_3.Arguments, Key=panel_14)
null_2 = NullItem(Item=decall_3.Arguments)  # -> NullFlags, InvalidFlags, Description
gjok_6 = GetJSONObjectKey(JObject=decall_3.Arguments, Key=panel_11)
gjok_7 = GetJSONObjectKey(JObject=decall_3.Arguments, Key=panel_12)
gjok_8 = GetJSONObjectKey(JObject=decall_3.Arguments, Key=panel_13)
gjok_9 = GetJSONObjectKey(JObject=decall_3.Arguments, Key=panel_16)
gjok_10 = GetJSONObjectKey(JObject=decall_3.Arguments, Key=panel_15)
rjv_5 = ReadJSONValue(JValue=gjok_5)  # -> AsString, AsNumber, AsBool
rjv_6 = ReadJSONValue(JValue=gjok_6)  # -> AsString, AsNumber, AsBool
rjv_7 = ReadJSONValue(JValue=gjok_7)  # -> AsString, AsNumber, AsBool
rjv_8 = ReadJSONValue(JValue=gjok_8)  # -> AsString, AsNumber, AsBool
rjv_9 = ReadJSONValue(JValue=gjok_9)  # -> AsString, AsNumber, AsBool
rjv_10 = ReadJSONValue(JValue=gjok_10)  # -> AsString, AsNumber, AsBool
not_2 = GateNot(A=null_2.NullFlags)
py3_3 = Python3Script(trigger=decall_3.Arguments, prefix="box")  # -> random_id; inputs prefix: String; same code as py3_2
sphere_name_2 = Panel(py3_3)

# ---- group: Request Is Not Null
bool_2 = Boolean(not_2)

# ---- group: Length Y
num_5 = Number(rjv_5.AsNumber)

# ---- group: X
num_6 = Number(rjv_6.AsNumber)

# ---- group: Length X
num_7 = Number(rjv_9.AsNumber)

# ---- group: Y
num_8 = Number(rjv_7.AsNumber)

# ---- group: Z
num_9 = Number(rjv_8.AsNumber)

# ---- group: Length Z
num_10 = Number(rjv_10.AsNumber)

# ----
decall_4 = DeconstructToolCall(Request=mcp.ScaleObject)  # -> Request, Tool, Arguments
gjok_11 = GetJSONObjectKey(JObject=decall_4.Arguments, Key=panel_9)
gjok_12 = GetJSONObjectKey(JObject=decall_4.Arguments, Key=panel_8)
null_3 = NullItem(Item=decall_4.Arguments)  # -> NullFlags, InvalidFlags, Description
not_3 = GateNot(A=null_3.NullFlags)
rjv_11 = ReadJSONValue(JValue=gjok_11)  # -> AsString, AsNumber, AsBool
rjv_12 = ReadJSONValue(JValue=gjok_12)  # -> AsString, AsNumber, AsBool

# ---- group: Request Is Not Null
bool_3 = Boolean(not_3)

# ---- group: Name
txt = Text(rjv_11.AsString)

# ---- group: Scaling Factor
num_11 = Number(rjv_12.AsNumber)

# ---- group: Find Object in the Doc by Name
py3_4 = Python3Script(name_input=txt)  # -> guid_out, centroid
# ---------- py3_4: Python ----------
"""
Grasshopper Python Script
Inputs:
  name_input : str                        - the object Name to search for
Outputs:
  guid_out   : list[System.Guid]          - GUIDs of all matching objects
  centroid   : list[Rhino.Geometry.Point3d] - volume centroid of each match
"""

import Rhino

guid_out = []
centroid = []

if name_input:
    for obj in Rhino.RhinoDoc.ActiveDoc.Objects:
        if obj and obj.Attributes.Name == name_input:
            vmp = Rhino.Geometry.VolumeMassProperties.Compute(obj.Geometry)
            if vmp:
                guid_out.append(obj.Id)
                centroid.append(vmp.Centroid)
# ---------- end py3_4 ----------

# ---- group: Object Centroid
pt = Point(py3_4.centroid)

# ---- group: Scaling Factor
num_12 = Number(num_11)

# ---- group: Selected Geometry
id = Guid(py3_4.guid_out)

# ---- group: Scale Object
py3_5 = Python3Script(guid_str=id, factor=num_12, ref_point=pt, run=bool_3)  # -> result, new_geo; inputs guid_str: String, factor: Double, ref_point: Point3d, run: Boolean
# ---------- py3_5: Python ----------
"""
Grasshopper Python Script: Scale Object by GUID
-------------------------------------------------
Inputs:
    guid_str   (str)        - The GUID of the Rhino object to scale (as a string)
    factor     (float)      - The uniform scaling factor (e.g. 2.0 = double size)
    ref_point  (Point3d)    - The reference/center point for scaling
    run        (bool)       - Set to True to execute the scaling

Outputs:
    result     (str)        - Status message
    new_geo    (geometry)   - The scaled geometry for preview
"""

import Rhino
import Rhino.Geometry as rg
import rhinoscriptsyntax as rs
import scriptcontext as sc
import System

# Default outputs
result = "Set 'run' to True to execute."
new_geo = None

if run and guid_str:
    # --- Parse the GUID ---
    try:
        obj_id = System.Guid(guid_str)
    except Exception as e:
        result = "Invalid GUID string: {}".format(e)
        obj_id = None

    if obj_id:
        # --- Switch to the Rhino document to access objects ---
        sc.doc = Rhino.RhinoDoc.ActiveDoc

        # --- Find the object in the document ---
        rhino_obj = sc.doc.Objects.Find(obj_id)

        if rhino_obj is None:
            result = "No object found with GUID: {}".format(guid_str)
        else:
            # --- Build a uniform scale transform around the reference point ---
            xform = rg.Transform.Scale(ref_point, factor)

            # --- Duplicate the geometry so we can preview it ---
            geo_copy = rhino_obj.Geometry.Duplicate()
            geo_copy.Transform(xform)

            # --- Apply the transform to the actual Rhino object ---
            success = sc.doc.Objects.Transform(obj_id, xform, True)

            if success != System.Guid.Empty:
                result = "Scaled '{}' by factor {} around ({}, {}, {})".format(
                    rhino_obj.Name if rhino_obj.Name else obj_id,
                    factor,
                    ref_point.X, ref_point.Y, ref_point.Z
                )
                new_geo = geo_copy
            else:
                result = "Transform failed for GUID: {}".format(guid_str)

        # --- Switch back to the Grasshopper document ---
        sc.doc = ghdoc
# ---------- end py3_5 ----------

# ----
cjv_2 = CreateJSONValue(Value=py3_5.result)
cjo = CreateJSONObject(Keys="result", Values=cjv_2)
sjt = StringifyJSONToken(JToken=cjo)
response = Panel(sjt)
respond_2 = MCPToolResponse(Request=decall_4.Request, Content=cjo, IsError=False)

decall_5 = DeconstructToolCall(Request=mcp.MeshBrep)  # -> Request, Tool, Arguments
gjok_13 = GetJSONObjectKey(JObject=decall_5.Arguments, Key=panel_19)
gjok_14 = GetJSONObjectKey(JObject=decall_5.Arguments, Key=panel_18)
null_4 = NullItem(Item=decall_5.Arguments)  # -> NullFlags, InvalidFlags, Description
not_4 = GateNot(A=null_4.NullFlags)
rjv_13 = ReadJSONValue(JValue=gjok_13)  # -> AsString, AsNumber, AsBool
rjv_14 = ReadJSONValue(JValue=gjok_14)  # -> AsString, AsNumber, AsBool

# ---- group: Request Is Not Null
bool_4 = Boolean(not_4)

# ---- group: Delete original
bool_5 = Boolean(rjv_14.AsBool)

# ---- group: Name
txt_2 = Text(rjv_13.AsString)

# ---- group: Find Object in the Doc by Name
py3_6 = Python3Script(name_input=txt_2)  # -> guid_out, centroid; same code as py3_4

# ---- group: Object to mesh
brep = Brep(py3_6.guid_out)

# ----
decall_6 = DeconstructToolCall(Request=mcp.MoveObject)  # -> Request, Tool, Arguments
gjok_15 = GetJSONObjectKey(JObject=decall_6.Arguments, Key=panel_25)
gjok_16 = GetJSONObjectKey(JObject=decall_6.Arguments, Key=panel_24)
gjok_17 = GetJSONObjectKey(JObject=decall_6.Arguments, Key=panel_22)
gjok_18 = GetJSONObjectKey(JObject=decall_6.Arguments, Key=panel_23)
rjv_15 = ReadJSONValue(JValue=gjok_15)  # -> AsString, AsNumber, AsBool
rjv_16 = ReadJSONValue(JValue=gjok_16)  # -> AsString, AsNumber, AsBool
rjv_17 = ReadJSONValue(JValue=gjok_17)  # -> AsString, AsNumber, AsBool
rjv_18 = ReadJSONValue(JValue=gjok_18)  # -> AsString, AsNumber, AsBool

# ---- group: Name
txt_3 = Text(rjv_15.AsString)

# ---- group: Vector Y
num_13 = Number(rjv_17.AsNumber)

# ---- group: Vector X
num_14 = Number(rjv_16.AsNumber)

# ---- group: Vector Z
num_15 = Number(rjv_18.AsNumber)

# ----
vec = VectorXYZ(XComponent=num_14, YComponent=num_13, ZComponent=num_15)  # -> Vector, Length
py3_7 = Python3Script(name=txt_3, vector=vec.Vector)  # -> status, error; inputs name: String, vector: Vector3d
# ---------- py3_7: Python ----------
import Rhino
import scriptcontext as sc

error = False

if name and vector:
    sc.doc = Rhino.RhinoDoc.ActiveDoc
    
    obj = None
    for rh_obj in sc.doc.Objects:
        if rh_obj.Attributes.Name == name:
            obj = rh_obj
            break
    
    if obj:
        xform = Rhino.Geometry.Transform.Translation(vector)
        success = sc.doc.Objects.Transform(obj.Id, xform, True)
        
        if success:
            sc.doc.Views.Redraw()
            status = "Moved '{}' by ({}, {}, {})".format(name, vector.X, vector.Y, vector.Z)
        else:
            status = "Failed to move object"
            error = True
    else:
        status = "Object not found: " + name
        error = True
    
    sc.doc = ghdoc
else:
    status = "Name or vector not provided"
    error = True
# ---------- end py3_7 ----------
cjv_3 = CreateJSONValue(Value=py3_7.status)
cjo_2 = CreateJSONObject(Keys="status", Values=cjv_3)
sjt_2 = StringifyJSONToken(JToken=cjo_2)
response_2 = Panel(sjt_2)
respond_3 = MCPToolResponse(Request=decall_6.Request, Content=cjo_2, IsError=py3_7.error)

decall_7 = DeconstructToolCall(Request=mcp.RotateObject)  # -> Request, Tool, Arguments
gjok_19 = GetJSONObjectKey(JObject=decall_7.Arguments, Key=panel_31)
gjok_20 = GetJSONObjectKey(JObject=decall_7.Arguments, Key=panel_30)
gjok_21 = GetJSONObjectKey(JObject=decall_7.Arguments, Key=panel_28)
gjok_22 = GetJSONObjectKey(JObject=decall_7.Arguments, Key=panel_29)
rjv_19 = ReadJSONValue(JValue=gjok_19)  # -> AsString, AsNumber, AsBool
rjv_20 = ReadJSONValue(JValue=gjok_20)  # -> AsString, AsNumber, AsBool
rjv_21 = ReadJSONValue(JValue=gjok_21)  # -> AsString, AsNumber, AsBool
rjv_22 = ReadJSONValue(JValue=gjok_22)  # -> AsString, AsNumber, AsBool

# ---- group: Name
txt_4 = Text(rjv_19.AsString)

# ---- group: Rotation X Axis
num_16 = Number(rjv_20.AsNumber)

# ---- group: Rotation Z Axis
num_17 = Number(rjv_22.AsNumber)

# ---- group: Rotation Y Axis
num_18 = Number(rjv_21.AsNumber)

# ----
py3_8 = Python3Script(name=txt_4, x_degrees=num_16, y_degrees=num_18, z_degrees=num_17)  # -> status, error; inputs name: String, x_degrees: Double, y_degrees: Double, z_degrees: Double
# ---------- py3_8: Python ----------
import Rhino
import scriptcontext as sc
import math

error = False

if name and x_degrees is not None and y_degrees is not None and z_degrees is not None:
    sc.doc = Rhino.RhinoDoc.ActiveDoc
    
    obj = None
    for rh_obj in sc.doc.Objects:
        if rh_obj.Attributes.Name == name:
            obj = rh_obj
            break
    
    if obj:
        # Get the volume centroid as rotation center
        geo = obj.Geometry
        
        if hasattr(geo, 'GetBoundingBox'):
            # Try volume centroid for Breps
            if isinstance(geo, Rhino.Geometry.Brep):
                mp = Rhino.Geometry.VolumeMassProperties.Compute(geo)
                if mp:
                    center = mp.Centroid
                else:
                    center = geo.GetBoundingBox(True).Center
            elif isinstance(geo, Rhino.Geometry.Mesh):
                mp = Rhino.Geometry.VolumeMassProperties.Compute(geo)
                if mp:
                    center = mp.Centroid
                else:
                    center = geo.GetBoundingBox(True).Center
            else:
                center = geo.GetBoundingBox(True).Center
        else:
            center = geo.GetBoundingBox(True).Center
        
        # Convert degrees to radians
        rx = math.radians(x_degrees)
        ry = math.radians(y_degrees)
        rz = math.radians(z_degrees)
        
        # Build rotation transforms around centroid
        rot_x = Rhino.Geometry.Transform.Rotation(rx, Rhino.Geometry.Vector3d.XAxis, center)
        rot_y = Rhino.Geometry.Transform.Rotation(ry, Rhino.Geometry.Vector3d.YAxis, center)
        rot_z = Rhino.Geometry.Transform.Rotation(rz, Rhino.Geometry.Vector3d.ZAxis, center)
        
        # Combine: first X, then Y, then Z
        combined = Rhino.Geometry.Transform.Identity
        combined = Rhino.Geometry.Transform.Multiply(combined, rot_x)
        combined = Rhino.Geometry.Transform.Multiply(combined, rot_y)
        combined = Rhino.Geometry.Transform.Multiply(combined, rot_z)
        
        success = sc.doc.Objects.Transform(obj.Id, combined, True)
        
        if success:
            sc.doc.Views.Redraw()
            status = "Rotated '{}' by X:{} Y:{} Z:{} around ({:.2f}, {:.2f}, {:.2f})".format(
                name, x_degrees, y_degrees, z_degrees, center.X, center.Y, center.Z)
        else:
            status = "Failed to rotate object"
            error = True
    else:
        status = "Object not found: " + name
        error = True
    
    sc.doc = ghdoc
else:
    status = "Missing inputs"
    error = True
# ---------- end py3_8 ----------
cjv_4 = CreateJSONValue(Value=py3_8.status)
cjo_3 = CreateJSONObject(Keys="status", Values=cjv_4)
sjt_3 = StringifyJSONToken(JToken=cjo_3)
response_3 = Panel(sjt_3)
respond_4 = MCPToolResponse(Request=decall_7.Request, Content=cjo_3, IsError=py3_8.error)

decall_8 = DeconstructToolCall(Request=mcp.NormalColorMesh)  # -> Request, Tool, Arguments
gjok_23 = GetJSONObjectKey(JObject=decall_8.Arguments, Key=panel_33)
rjv_23 = ReadJSONValue(JValue=gjok_23)  # -> AsString, AsNumber, AsBool

# ---- group: Name
txt_5 = Text(rjv_23.AsString)

# ----
py3_9 = Python3Script(name=txt_5)  # -> status, error; inputs name: String
# ---------- py3_9: Python ----------
import Rhino
import scriptcontext as sc
import System.Drawing

error = False

if name:
    sc.doc = Rhino.RhinoDoc.ActiveDoc
    
    obj = None
    for rh_obj in sc.doc.Objects:
        if rh_obj.Attributes.Name == name:
            obj = rh_obj
            break
    
    if obj:
        geo = obj.Geometry
        
        if isinstance(geo, Rhino.Geometry.Mesh):
            mesh = geo.Duplicate()
            
            # Ensure mesh has normals
            if mesh.Normals.Count == 0:
                mesh.Normals.ComputeNormals()
            
            # Apply normal map coloring
            # Normal map convention: RGB = (N.x * 0.5 + 0.5, N.y * 0.5 + 0.5, N.z * 0.5 + 0.5)
            mesh.VertexColors.Clear()
            for i in range(mesh.Vertices.Count):
                n = mesh.Normals[i]
                r = int((n.X * 0.5 + 0.5) * 255)
                g = int((n.Y * 0.5 + 0.5) * 255)
                b = int((n.Z * 0.5 + 0.5) * 255)
                # Clamp values
                r = max(0, min(255, r))
                g = max(0, min(255, g))
                b = max(0, min(255, b))
                mesh.VertexColors.Add(System.Drawing.Color.FromArgb(r, g, b))
            
            sc.doc.Objects.Replace(obj.Id, mesh)
            sc.doc.Views.Redraw()
            status = "Applied normal map colors to '{}' ({} vertices)".format(name, mesh.Vertices.Count)
        else:
            status = "Object '{}' is not a Mesh, it's a {}".format(name, geo.GetType().Name)
            error = True
    else:
        status = "Object not found: " + name
        error = True
    
    sc.doc = ghdoc
else:
    status = "No name provided"
    error = True
# ---------- end py3_9 ----------
cjv_5 = CreateJSONValue(Value=py3_9.status)
cjo_4 = CreateJSONObject(Keys="status", Values=cjv_5)
sjt_4 = StringifyJSONToken(JToken=cjo_4)
response_4 = Panel(sjt_4)
respond_5 = MCPToolResponse(Request=decall_8.Request, Content=cjo_4, IsError=py3_9.error)

division = Division(A=num_5, B="2")
pt_2 = ConstructPoint(XCoordinate=num_6, YCoordinate=num_8, ZCoordinate=num_9)
division_2 = Division(A=num_7, B="2")
neg = Negative(Value=division)
xy = XYPlane(Origin=pt_2)
neg_2 = Negative(Value=division_2)
dom = ConstructDomain(DomainStart=neg, DomainEnd=division)
dom_2 = ConstructDomain(DomainStart=neg_2, DomainEnd=division_2)
rectangle = Rectangle(Plane=xy, XSize=dom_2, YSize=dom, Radius=0)  # -> Rectangle, Length
Z = UnitZ(Factor=num_10)
extr = Extrude(Base=rectangle.Rectangle, Direction=Z)
cap = CapHoles(Brep=extr)

# ---- group: Bake
py3_10 = Python3Script(geometry=cap, name=sphere_name_2, bake=bool_2)  # -> result, error; inputs geometry: GeometryBase, name: String, bake: Boolean
# ---------- py3_10: Python ----------
import Rhino
import scriptcontext as sc
import System
import json

if bake:
    error = True
    sc.doc = Rhino.RhinoDoc.ActiveDoc
    
    obj_id = sc.doc.Objects.Add(geometry)
    
    if obj_id != System.Guid.Empty:
        obj = sc.doc.Objects.Find(obj_id)
        if obj:
            attr = obj.Attributes.Duplicate()
            attr.Name = name
            sc.doc.Objects.ModifyAttributes(obj_id, attr, True)
            
            # Debug: check bounding box and geometry type
            bbox = obj.Geometry.GetBoundingBox(True)
            geo_type = obj.Geometry.GetType().Name
            result = json.dumps({
                "name": name,
                "type": geo_type
            })
            error = False
        else:
            result = json.dumps({"err" : "Object not found after add"})
        
        sc.doc.Views.Redraw()
    else:
        result = json.dumps({"err" : "Failed to bake geometry"})
    
    sc.doc = ghdoc
else:
    result = json.dumps({"msg" : "Bake is False, skipping"})
    error = False
# ---------- end py3_10 ----------

# ----
pjs = ParseJSONString(Text=py3_10.result)
response_5 = Panel(py3_10.result)
respond_6 = MCPToolResponse(Request=decall_3.Request, Content=pjs, IsError=py3_10.error)

pt_3 = ConstructPoint(XCoordinate=num, YCoordinate=num_2, ZCoordinate=num_3)
sph = Sphere(Base=pt_3, Radius=num_4)

# ---- group: Bake
py3_11 = Python3Script(geometry=sph, name=sphere_name, bake=bool)  # -> result, error; inputs geometry: GeometryBase, name: String, bake: Boolean; same code as py3_10

# ----
pjs_2 = ParseJSONString(Text=py3_11.result)

response_6 = Panel(py3_11.result)
respond_7 = MCPToolResponse(Request=decall_2.Request, Content=pjs_2, IsError=py3_11.error)

py3_12 = Python3Script(guid=py3_6.guid_out, delete=bool_5)  # -> status; inputs guid: String, delete: Boolean
# ---------- py3_12: Python ----------
import Rhino
import scriptcontext as sc
import System

if delete and guid:
    sc.doc = Rhino.RhinoDoc.ActiveDoc
    
    if isinstance(guid, str):
        obj_guid = System.Guid(guid)
    else:
        obj_guid = guid
    
    obj = sc.doc.Objects.Find(obj_guid)
    
    if obj:
        obj_name = obj.Attributes.Name
        success = sc.doc.Objects.Delete(obj_guid, True)
        if success:
            sc.doc.Views.Redraw()
            status = "Deleted: {} ({})".format(obj_name, str(obj_guid))
        else:
            status = "Failed to delete object"
    else:
        status = "Object not found with GUID: " + str(obj_guid)
    
    sc.doc = ghdoc
else:
    status = "Delete is False or no GUID provided"
# ---------- end py3_12 ----------
py3_13 = Python3Script(trigger=bool_5, prefix="mesh")  # -> random_id; inputs prefix: String; same code as py3_2
qrmesh = QuadRemesh(Geometry=brep, Settings={aqc=True, as=50, dhe=True, gci=0, null=False, pme=2, sa=0, tqc=2000})
sphere_name_3 = Panel(py3_13)

# ---- group: Deletion Status
txt_6 = Text(py3_12)

# ---- group: Bake
py3_14 = Python3Script(geometry=qrmesh, name=sphere_name_3, bake=bool_4)  # -> result, error; inputs geometry: GeometryBase, name: String, bake: Boolean; same code as py3_10

# ----
cjv_6 = CreateJSONValue(Value=txt_6)
pjs_3 = ParseJSONString(Text=py3_14.result)
sjk = SetJSONKey(JObject=pjs_3, Key="deletion_status", JToken=cjv_6)
sjt_5 = StringifyJSONToken(JToken=sjk)
response_7 = Panel(sjt_5)
respond_8 = MCPToolResponse(Request=decall_5.Request, Content=sjk, IsError=py3_14.error)
