# Grasshopper definition team_01_working.gh (Grasshopper 1.0.8)
# plug-ins: Swiftlet

# ----
# Connect MCP Tools to Decall and Update All Clusters
button = Button()
# IF SOMETHING IS NOT
# WORKING PRESS THIS
# BUTTON FIRST
toggle = BooleanToggle(True)
connect_mcp_tools_to_decall = CSharpScript(nickname_From="Central MCP Server", nickname_To="Central DeCall", connect=button)  # -> out; inputs nickname_From: String, nickname_To: String, connect: Boolean
# ---------- connect_mcp_tools_to_decall: C# ----------
using System;
using System.Linq;
using Grasshopper;
using Grasshopper.Kernel;

public class Script_Instance : GH_ScriptInstance
{
    private void RunScript(string nickname_From, string nickname_To, bool connect)
    {
        if (!connect) return;
        Console.Write($"Attempting to connect outputs from '{nickname_From}' to '{nickname_To}'...");

        var ghDoc = Instances.ActiveCanvas?.Document;
        if (ghDoc == null) return;

        var compFrom = ghDoc.Objects
            .OfType<IGH_Component>()
            .FirstOrDefault(o => o.NickName == nickname_From);

        var compTo = ghDoc.Objects
            .OfType<IGH_Param>()
            .FirstOrDefault(o => o.NickName == nickname_To);

        if (compFrom != null && compTo != null)
        {
            ghDoc.ScheduleSolution(5, doc => Connect(doc, compFrom, compTo));
        }
    }

    // <Custom additional code> 
    private void Connect(GH_Document doc, IGH_Component compFrom, IGH_Param compTo)
    {
        if (compFrom == null || compTo == null) return;

        foreach (IGH_Param param in compFrom.Params.Output)
        {
            compTo.AddSource(param);
        }
    }
}
# ---------- end connect_mcp_tools_to_decall ----------
update_all_clusters = CSharpScript(update=button, recursive=toggle)  # -> out, A; inputs update: Boolean, recursive: Boolean, passwords: list of String, localPath: String
# ---------- update_all_clusters: C# ----------
using System;
using System.Collections;
using System.Collections.Generic;

using Rhino;
using Rhino.Geometry;

using Grasshopper;
using Grasshopper.Kernel;
using Grasshopper.Kernel.Data;
using Grasshopper.Kernel.Types;
using System.Windows.Forms;
using System.Linq;
/// <summary>
/// This class will be instantiated on demand by the Script component.
/// </summary>
public class Script_Instance : GH_ScriptInstance
{
  /// <summary>Print a String to the [Out] Parameter of the Script component.</summary>
  /// <param name="text">String to print.</param>
  private void Print(string text) { /* Implementation hidden. */ }
  /// <summary>Print a formatted String to the [Out] Parameter of the Script component.</summary>
  /// <param name="format">String format.</param>
  /// <param name="args">Formatting parameters.</param>
  private void Print(string format, params object[] args) { /* Implementation hidden. */ }
  /// <summary>Print useful information about an object instance to the [Out] Parameter of the Script component. </summary>
  /// <param name="obj">Object instance to parse.</param>
  private void Reflect(object obj) { /* Implementation hidden. */ }
  /// <summary>Print the signatures of all the overloads of a specific method to the [Out] Parameter of the Script component. </summary>
  /// <param name="obj">Object instance to parse.</param>
  private void Reflect(object obj, string method_name) { /* Implementation hidden. */ }

  /// <summary>Gets the current Rhino document.</summary>
  private readonly RhinoDoc RhinoDocument;
  /// <summary>Gets the Grasshopper document that owns this script.</summary>
  private readonly GH_Document GrasshopperDocument;
  /// <summary>Gets the Grasshopper script component that owns this script.</summary>
  private readonly IGH_Component Component;
  /// <summary>
  /// Gets the current iteration count. The first call to RunScript() is associated with Iteration==0.
  /// Any subsequent call within the same solution will increment the Iteration count.
  /// </summary>
  private readonly int Iteration;

  /// <summary>
  /// This procedure contains the user code. Input parameters are provided as regular arguments,
  /// Output parameters as ref arguments. You don't have to assign output parameters,
  /// they will have a default value.
  /// </summary>
  private void RunScript(
		bool update,
		bool recursive,
		List<string> passwords,
		string localPath,
		ref object A)
  {

    A = updateLog;
    if (update)
    {
      updateLog = new List<string>();
      _passwords = passwords;
      UpdateClusters(GrasshopperDocument, recursive, localPath);
    }

  }

  // <Custom additional code> 
  List<string> updateLog;
  List<String> _passwords;

  void UpdateClusters (GH_Document ghDoc, bool recursive, string localPath)
  {
    foreach (var obj in ghDoc.Objects)
    {
      var cluster = obj as Grasshopper.Kernel.Special.GH_Cluster;
      if (cluster != null)
      {
        var clusterPath = cluster.FilePath;
        if (!string.IsNullOrEmpty(clusterPath))
        {
          if (cluster.Synchronisation == Grasshopper.Kernel.Special.GH_Synchronisation.OutOfDate)
          {
            cluster.CreateFromFilePath(clusterPath);
            updateLog.Add("Updated: " + clusterPath);
          }
          else if (cluster.Synchronisation == Grasshopper.Kernel.Special.GH_Synchronisation.MissingReference)
          {
            string newPath = ReplacePath(localPath, clusterPath);
            if (!string.IsNullOrEmpty(newPath))
            {
              cluster.CreateFromFilePath(newPath);
              updateLog.Add("Replaced and updated: " + newPath);
            }
            else
            {
              updateLog.Add("Missing reference: " + clusterPath);
            }

          }
        }

        //Update recursively
        if (recursive)
        {
          GH_Document clusterDoc = GetClusterDoc(cluster);
          if (clusterDoc != null)
            UpdateClusters(clusterDoc, recursive, localPath);
        }
      }
    }
  }

  GH_Document GetClusterDoc(Grasshopper.Kernel.Special.GH_Cluster cluster)
  {
    //no pass needed
    var doc = cluster.Document(string.Empty);
    if (doc != null)
      return doc;

    //try passwords
    if (_passwords != null && _passwords.Any())
    {
      foreach (var pass in _passwords)
      {
        doc = cluster.Document(pass);
        if (doc != null)
          return doc;
      }
    }

    return null;
  }

  string ReplacePath(string localPath, string missingPath)
  {
    if (String.IsNullOrEmpty(missingPath) || string.IsNullOrEmpty(localPath))
      return null;
    else
    {
      string lastLocalPart = localPath.Split('\\').Last();
      string[] parts = missingPath.Split('\\');
      if (parts.Contains(lastLocalPart))
      {
        int i = Array.IndexOf(parts, lastLocalPart);
        string clusterPath = String.Join("\\", parts.Skip(i + 1));
        string result = String.Join("\\", localPath, clusterPath);
        return result;
      }
      else
        return null;
    }
  }
  // </Custom additional code> 
}
# ---------- end update_all_clusters ----------
panel = Panel(connect_mcp_tools_to_decall)

# ----
# DEFINITION CLUSTER
team_01_definition_cluster = Team01DefinitionCluster()

c_script = CSharpScript()  # -> out, availablePort
# ---------- c_script: C# ----------
// Grasshopper Script Instance
// This script finds an available port on the local machine.
#region Usings
using System;
using System.Linq;
using System.Collections;
using System.Collections.Generic;
using System.Drawing;
using System.Net;
using System.Net.Sockets;

using Rhino;
using Rhino.Geometry;

using Grasshopper;
using Grasshopper.Kernel;
using Grasshopper.Kernel.Data;
using Grasshopper.Kernel.Types;
#endregion

public class Script_Instance : GH_ScriptInstance
{
    #region Notes
    /* 
      Members:
        RhinoDoc RhinoDocument
        GH_Document GrasshopperDocument
        IGH_Component Component
        int Iteration

      Methods (Virtual & overridable):
        Print(string text)
        Print(string format, params object[] args)
        Reflect(object obj)
        Reflect(object obj, string method_name)
    */
    #endregion

    private void RunScript(object start, object end, ref object availablePort)
    {
        // Use default values if parameters are not provided
        int startPort = (start != null && int.TryParse(start.ToString(), out int s)) ? s : 3001;
        int endPort = (end != null && int.TryParse(end.ToString(), out int e)) ? e : 3100;

        // Find an available port in the specified range
        try
        {
            availablePort = FindAvailablePortInRange(startPort, endPort);
            Print($"Available port found: {availablePort}");
        }
        catch (Exception ex)
        {
            Print($"Error: {ex.Message}");
            availablePort = null;
        }
    }

    /// <summary>
    /// Checks if a local TCP port is available for binding (i.e., not in use).
    /// Returns True if available, False otherwise.
    /// </summary>
    private bool IsPortAvailableForBind(int port)
    {
        try
        {
            // Create a new TCP socket
            using (Socket socket = new Socket(AddressFamily.InterNetwork, SocketType.Stream, ProtocolType.Tcp))
            {
                // Try to bind to the port on all interfaces (0.0.0.0)
                socket.Bind(new IPEndPoint(IPAddress.Any, port));
                // If successful, the socket is closed by the using statement and return True
                return true;
            }
        }
        catch (SocketException)
        {
            // If binding fails, it means the port is already in use
            return false;
        }
    }

    /// <summary>
    /// Finds an available port by letting the OS assign one.
    /// </summary>
    private int FindAvailablePort()
    {
        Socket socket = new Socket(AddressFamily.InterNetwork, SocketType.Stream, ProtocolType.Tcp);
        socket.Bind(new IPEndPoint(IPAddress.Any, 0)); // Bind to an available port assigned by the OS
        int availablePort = ((IPEndPoint)socket.LocalEndPoint).Port; // Get the assigned port number
        socket.Close(); // Close the socket
        return availablePort;
    }

    /// <summary>
    /// Finds the first available port in a given range.
    /// </summary>
    private int FindAvailablePortInRange(int start = 3001, int end = 3100)
    {
        for (int port = start; port <= end; port++)
        {
            if (IsPortAvailableForBind(port))
                return port;
        }
        throw new Exception($"No available ports found in the range {start}-{end}.");
    }
}
# ---------- end c_script ----------
panel_2 = Panel(c_script.availablePort)
central_mcp_server = MCPServer(Port=c_script.availablePort, Tools=team_01_definition_cluster, ServerName="Swiftlet")  # -> Compute_volume_of_sphere, Compute_area_of_sphere, Delete_room_01, Add_window_01, Compute_volume_of_cone, Compute_volume_of_box, Classify_element_permanence, Tag_and_audit
# {
#   "rooms": {
#     "kitchen": {
#       "width": 5,
#       "length": 6
#     },
#     "bathroom": {
#       "width": 2,
#       "length": 4
#     }
#   },
#   "structure": [
#     {
#       "id": "A_",
#       "name": "Structural Column A_",
#       "geometry": [
#         [
#           0.0,
#           0.0
#         ]
#       ],
#       "attributes": {
#         "type": "column",
#         "permanence_tag": "permanent",
#         "permanence_score": 1,
#         "intervention_tier": "prohibitive",
#         "reason": "Structural column. Cannot be moved or removed.",
#         "reuse_warning": "All layouts must accommodate this column."
#       }
#     },
#     {
#       "id": "",
#       "name": "Structural Beam ",
#       "geometry": [],
#       "attributes": {
#         "type": "beam",
#         "dimensions": "unknown",
#         "permanence_tag": "permanent",
#         "permanence_score": 1,
#         "intervention_tier": "prohibitive",
#         "reason": "Structural beam. Cannot be moved or removed.",
#         "reuse_warning": "All layouts must accommodate this beam."
#       }
#     },
#     {
#       "id": "A_",
#       "name": "Structural Beam A_",
#       "geometry": [],
#       "attributes": {
#         "type": "beam",
#         "dimensions": "unknown",
#         "permanence_tag": "permanent",
#         "permanence_score": 1,
#         "intervention_tier": "prohibitive",
#         "reason": "Structural beam. Cannot be moved or removed.",
#         "reuse_warning": "All layouts must accommodate this beam."
#       }
#     }
#   ]
# }
get_tool_names = CSharpScript(x=team_01_definition_cluster)  # -> flatten(out)
# ---------- get_tool_names: C# ----------
// Grasshopper Script Instance
#region Usings
using System;
using System.Linq;
using System.Collections;
using System.Collections.Generic;
using System.Drawing;

using Rhino;
using Rhino.Geometry;

using Grasshopper;
using Grasshopper.Kernel;
using Grasshopper.Kernel.Data;
using Grasshopper.Kernel.Types;
#endregion

public class Script_Instance : GH_ScriptInstance
{
    #region Notes
    /* 
      Members:
        RhinoDoc RhinoDocument
        GH_Document GrasshopperDocument
        IGH_Component Component
        int Iteration

      Methods (Virtual & overridable):
        Print(string text)
        Print(string format, params object[] args)
        Reflect(object obj)
        Reflect(object obj, string method_name)
    */
    #endregion

    private void RunScript(object x)
    {
        dynamic dynamicX = x;
        Console.Write(dynamicX.Name);
    }
}
# ---------- end get_tool_names ----------
central_decall = Data([central_mcp_server.Compute_volume_of_sphere, central_mcp_server.Compute_area_of_sphere, central_mcp_server.Delete_room_01, central_mcp_server.Add_window_01, central_mcp_server.Compute_volume_of_cone, central_mcp_server.Compute_volume_of_box, central_mcp_server.Classify_element_permanence, central_mcp_server.Tag_and_audit])
clean = CleanTree(RemoveNulls=True, RemoveInvalid=True, RemoveEmpty=False, Tree=central_decall)

# ----
# RESULT CLUSTER
team_01_result_cluster = Team01ResultCluster(tool_call_request=clean)  # -> tool_names_3, tool_call_success

# ----
# Tool Names from the Results Clusters
# Tool Names from the Definition Clusters
# These Two Clusters should be EXACTLY THE SAME
panel_3 = Panel(get_tool_names)
panel_4 = Panel(team_01_result_cluster.tool_names_3)

rec = DataRecorder(team_01_result_cluster.tool_call_success, DataLimit=-10, RecordData=True)
rec_2 = DataRecorder(clean, DataLimit=-10, RecordData=True)

# ---- group: Request Parameters
decall = DeconstructToolCall(Request=clean)  # -> Request, Tool, Arguments
rjo = ReadJSONObject(JObject=decall.Arguments)  # -> Keys, JTokens
# Debug: Check request input data
panel_5 = Panel("room_name")
tmatch = MatchText(Text=rjo.Keys, Pattern=panel_5, Case=True)
tmatch_2 = MatchText(Text=rjo.Keys, Pattern="layout_json", Case=True)
dispatch = Dispatch(List=rjo.JTokens, DispatchPattern=tmatch)  # -> ListA, ListB
dispatch_2 = Dispatch(List=rjo.JTokens, DispatchPattern=tmatch_2)  # -> ListA, ListB
panel_6 = Panel(dispatch_2.ListA)
panel_7 = Panel(dispatch.ListA)

# ----
response_ok = Panel(rec)
called_tool_name = Panel(rec_2)

# ----
# Debug Tool Names
# This Panel should always be TRUE
tool_names_from_the_definition_clusters = Data(panel_3)
tool_names_from_the_results_clusters = Data(panel_4)
tstat = TreeStatistics(Tree=tool_names_from_the_definition_clusters)  # -> Paths, Length, Count
tstat_2 = TreeStatistics(Tree=tool_names_from_the_results_clusters)  # -> Paths, Length, Count
join = TextJoin(Text=flatten(tool_names_from_the_definition_clusters))
join_2 = TextJoin(Text=flatten(tool_names_from_the_results_clusters))
dpath = DeconstructPath(Branch=tstat.Paths)
dpath_2 = DeconstructPath(Branch=tstat_2.Paths)
equals = Equality(FirstNumber=tstat.Length, SecondNumber=tstat_2.Length)  # -> Equality, Inequality
equals_2 = Equality(FirstNumber=tstat.Count, SecondNumber=tstat_2.Count)  # -> Equality, Inequality
equals_3 = Equality(FirstNumber=dpath, SecondNumber=dpath_2)  # -> Equality, Inequality
ma = MassAddition(Input=flatten(equals.Equality))  # -> Result, PartialResults
lng = ListLength(List=equals.Equality)
does_quantity_of_tools_match = Panel(equals_2.Equality)
ma_2 = MassAddition(Input=flatten(equals_3.Inequality))  # -> Result, PartialResults
equals_4 = Equality(FirstNumber=ma.Result, SecondNumber=lng)  # -> Equality, Inequality
equals_5 = Equality(FirstNumber=ma_2.Result, SecondNumber="0")  # -> Equality, Inequality
are_all_teams_included = Panel(equals_5.Equality)
does_quantity_of_tools_match_per_team = Panel(equals_4.Equality)

tmatch_3 = MatchText(Text=join, Pattern=join_2, Case=True)

do_all_names_match = Panel(tmatch_3)
and = GateAnd(A=equals_5.Equality, B=equals_4.Equality, C=equals_2.Equality, D=tmatch_3)  # -> flatten(Result)
do_trees_match = Panel(and)

# ==== cluster Team01DefinitionCluster

panel = Panel("This tool computes the volume of a cone by giving it a radius and height.  The output unit is the input unit cubed.")
param = DefineToolParameter(Name="radius", Type="number", Description="The Radius of a Cone", Required=Toggle(True))
param_2 = DefineToolParameter(Name="height", Type="number", Description="The Height of a Cone", Required=Toggle(True))
merge = Merge(Data1=param, Data2=param_2)
tool = DefineTool(Name="compute_volume_of_cone", Description=panel, Parameters=merge)

# ----
# Team 01 Definition Cluster
# SPHERE TEAM
panel_2 = Panel("This tool computes the volume of a sphere by giving it a radius.  The output unit is the input unit cubed.")
panel_3 = Panel("This tool deletes a room by giving it a room name and the layout json")
panel_4 = Panel("This tool computes the area of a sphere by giving it a radius.  The output unit is the input unit squared.")

panel_5 = Panel("This tool computes the volume of a box by giving it a width, length and height. The output unit is the input unit cubed.")
param_3 = DefineToolParameter(Name="width", Type="number", Description="The Width of a Box", Required=Toggle(True))
param_4 = DefineToolParameter(Name="length", Type="number", Description="The Length of a Box", Required=Toggle(True))
param_5 = DefineToolParameter(Name="height", Type="number", Description="The Height of a Box", Required=Toggle(True))
merge_2 = Merge(Data1=param_3, Data2=param_4, Data3=param_5)
tool_2 = DefineTool(Name="compute_volume_of_box", Description=panel_5, Parameters=merge_2)

panel_6 = Panel("Type of building element to classify, such as core, shaft, column, structural_wall, bathroom, kitchen, partition, or furniture.")
panel_7 = Panel("Classify building elements by how difficult it is to change in a future reuse scenario.")
param_6 = DefineToolParameter(Name="element_type", Type="string", Description=panel_6, Required=Toggle(True))
tool_3 = DefineTool(Name="classify_element_permanence", Description=panel_7, Parameters=param_6)

panel_8 = Panel("This tool deletes a room by giving it a room name and the layout json")
param_7 = DefineToolParameter(Name="room_name", Type="string", Description="the name of the room", Required=Toggle(True))
param_8 = DefineToolParameter(Name="layout_json", Type="string", Description="the layout data structure", Required=Toggle(True))
param_9 = DefineToolParameter(Name="room_name", Type="string", Description="the name of the room", Required=Toggle(True))
param_10 = DefineToolParameter(Name="layout_json", Type="string", Description="the layout data structure", Required=Toggle(True))
param_11 = DefineToolParameter(Name="radius", Type="number", Description="The Radius of a Sphere", Required=Toggle(True))
param_12 = DefineToolParameter(Name="radius", Type="number", Description="The Radius of a Sphere", Required=Toggle(True))
param_13 = DefineToolParameter(Name="width", Type="number", Description="The width of the window", Required=Toggle(True))
merge_3 = Merge(Data1=param_7, Data2=param_8)
merge_4 = Merge(Data1=param_9, Data2=param_13, Data3=param_10)
tool_4 = DefineTool(Name="compute_volume_of_sphere", Description=panel_2, Parameters=param_11)
tool_5 = DefineTool(Name="compute_area_of_sphere", Description=panel_4, Parameters=param_12)
tool_6 = DefineTool(Name="delete_room_01", Description=panel_3, Parameters=merge_3)
tool_7 = DefineTool(Name="add_window_01", Description=panel_8, Parameters=merge_4)

panel_9 = Panel("Reads the layout JSON, identifies all structural and MEP elements, then tags each as permanent, semi-permanent, or flexible based on the declared typology rules. Always runs first. No other tool runs before this.")
panel_10 = Panel("The structural grid spacing in metres. Typical values: 3.0, 4.0, 6.0.")
panel_11 = Panel("The structural typology: perimeter_load_bearing, column_grid, or shear_wall")
param_14 = DefineToolParameter(
    Name="ask me the layout to select",
    Type="string",
    Description="The full layout data structure as a JSON string.",
    Required=Toggle(True))
param_15 = DefineToolParameter(Name="grid_spacing", Type="number", Description=panel_10, Required=Toggle(True))
param_16 = DefineToolParameter(Name="typology", Type="string", Description=panel_11, Required=Toggle(True))

merge_5 = Merge(Data1=param_14, Data2=param_15, Data3=param_16)

tool_8 = DefineTool(Name="tag_and_audit", Description=panel_9, Parameters=merge_5)

merge_6 = Merge(Data1=tool_4, Data2=tool_5, Data3=tool_6, Data4=tool_7, Data5=tool, Data6=tool_2, Data7=tool_3, Data8=tool_8)
mcp_tool_list = ClusterOutput(merge_6)
panel_12 = Panel(merge_6)

# ==== cluster Team01ResultCluster

# ----
# Team 01 Result Cluster
# SPHERE TEAM
# Edit Tool Names to
# Match Definition Cluster
tool_names = Panel("""compute_volume_of_sphere
compute_area_of_sphere
delete_room_01
add_window_01
compute_volume_of_cone
compute_volume_of_box
classify_element_permanence
tag_and_audit""")

# ----
# Sorting Logic, Please Do Not Edit
tool_call_request = ClusterInput()
tool_names_2 = Text(tool_names)
decall = DeconstructToolCall(Request=tool_call_request)  # -> Request, Tool, Arguments
mindex = MemberIndex(Set=tool_names, Member=decall.Tool)  # -> Index, Count
sift = SiftPattern(List=decall.Request, SiftPattern=mindex.Index)  # -> Output0, Output1, Output2, Output3, Output4, Output5, Output6, Output7

# ---- group: Cluster Output
tool_names_3 = ClusterOutput(tool_names_2)

# ----
panel = Panel(tool_call_request)

# ----
# SPHERE
decall_2 = DeconstructToolCall(Request=sift.Output0)  # -> Request, Tool, Arguments
decall_3 = DeconstructToolCall(Request=sift.Output1)  # -> Request, Tool, Arguments
gjok = GetJSONObjectKey(JObject=decall_3.Arguments, Key="radius")
gjok_2 = GetJSONObjectKey(JObject=decall_2.Arguments, Key="radius")
rjv = ReadJSONValue(JValue=gjok)  # -> AsString, AsNumber, AsBool
rjv_2 = ReadJSONValue(JValue=gjok_2)  # -> AsString, AsNumber, AsBool
# compute_area_of_sphere
sph = Sphere(Base=PlaneXY(0, 0, 0), Radius=rjv.AsNumber)
# compute_volume_of_sphere
sph_2 = Sphere(Base=PlaneXY(0, 0, 0), Radius=rjv_2.AsNumber)
area = Area(Geometry=sph)  # -> Area, Centroid
volume = Volume(Geometry=sph_2)  # -> Volume, Centroid
geo = Geometry(sph_2)
geo_2 = Geometry(sph)
panel_2 = Panel(area.Area)
panel_3 = Panel(volume.Volume)
cjv = CreateJSONValue(Value=panel_2)
cjv_2 = CreateJSONValue(Value=panel_3)
cjo = CreateJSONObject(Keys="area", Values=cjv)
cjo_2 = CreateJSONObject(Keys="volume", Values=cjv_2)
respond = MCPToolResponse(Request=decall_3.Request, Content=cjo, IsError=False)
respond_2 = MCPToolResponse(Request=decall_2.Request, Content=cjo_2, IsError=False)

# ---- group: Get the request sent from VSC Agent
decall_4 = DeconstructToolCall(Request=sift.Output3)  # -> Request, Tool, Arguments

# ----
# CONE
# compute_volume_of_cone
decall_5 = DeconstructToolCall(Request=sift.Output4)  # -> Request, Tool, Arguments
gjok_3 = GetJSONObjectKey(JObject=decall_5.Arguments, Key="radius")
gjok_4 = GetJSONObjectKey(JObject=decall_5.Arguments, Key="height")
rjv_3 = ReadJSONValue(JValue=gjok_3)  # -> AsString, AsNumber, AsBool
rjv_4 = ReadJSONValue(JValue=gjok_4)  # -> AsString, AsNumber, AsBool
cone = Cone(Base=PlaneXY(0, 0, 0), Radius=rjv_3.AsNumber, Length=rjv_4.AsNumber)  # -> Cone, Tip
volume_2 = Volume(Geometry=cone.Cone)  # -> Volume, Centroid
geo_3 = Geometry(cone.Cone)
panel_4 = Panel(volume_2.Volume)
cjv_3 = CreateJSONValue(Value=panel_4)
cjo_3 = CreateJSONObject(Keys="volume", Values=cjv_3)
respond_3 = MCPToolResponse(Request=decall_5.Request, Content=cjo_3, IsError=False)

# ----
# PERMANENCE TEXT BASED TOOL
decall_6 = DeconstructToolCall(Request=sift.Output6)  # -> Request, Tool, Arguments
gjok_5 = GetJSONObjectKey(JObject=decall_6.Arguments, Key="element_type")
# classify_element_permanence
rjv_5 = ReadJSONValue(JValue=gjok_5)  # -> AsString, AsNumber, AsBool
json_value = Panel("""core 01
shaft
column
wall
shear wall
Column
WC""")
permantent_type = Panel("""shaft
core
column
structural_wall
load_bearing_wall
shear_wall""")
semi_permantent_type = Panel("""wall
bathroom
kitchen""")
flexible_type = Panel("""partition
door
window
room""")
python_3_script = Python3Script(
    json_value=rjv_5.AsString,
    permanent_types=permantent_type,
    semi_permanent_types=semi_permantent_type,
    flexible_types=flexible_type)  # -> out, classification, cleaned_values, matched_keyword; inputs json_value: list of String, permanent_types: list, semi_permanent_types: list, flexible_types: list
# ---------- python_3_script: Python ----------
# Inputs:
# json_value: list of element names or element types from JSON
# permanent_types: list or comma-separated text of permanent keywords
# semi_permanent_types: list or comma-separated text of semi-permanent keywords
# flexible_types: list or comma-separated text of flexible keywords

# Outputs:
# classification: permanent / semi-permanent / flexible / unknown
# cleaned_values: cleaned input values
# matched_keyword: keyword that caused the classification


def clean_text(value):
    if value is None:
        return ""
    return str(value).strip().lower().replace(" ", "_").replace("-", "_")


def force_list(value):
    if value is None:
        return []
    if isinstance(value, list):
        return value
    return [value]


def build_keyword_list(value):
    keywords = []

    for item in force_list(value):
        text = str(item)

        # Allows both:
        # one panel with "core, shaft, column"
        # OR a Grasshopper list with one item per line
        parts = text.split(",")

        for part in parts:
            cleaned = clean_text(part)
            if cleaned:
                keywords.append(cleaned)

    return keywords


def classify_element(element_type, permanent_list, semi_list, flexible_list):
    text = clean_text(element_type)

    for keyword in permanent_list:
        if keyword in text:
            return "permanent", keyword

    for keyword in semi_list:
        if keyword in text:
            return "semi-permanent", keyword

    for keyword in flexible_list:
        if keyword in text:
            return "flexible", keyword

    return "unknown", ""


permanent_list = build_keyword_list(permanent_types)
semi_list = build_keyword_list(semi_permanent_types)
flexible_list = build_keyword_list(flexible_types)

classification = []
cleaned_values = []
matched_keyword = []

for item in force_list(json_value):
    cleaned = clean_text(item)
    result, keyword = classify_element(cleaned, permanent_list, semi_list, flexible_list)

    cleaned_values.append(cleaned)
    classification.append(result)
    matched_keyword.append(keyword)
# ---------- end python_3_script ----------
panel_5 = Panel(python_3_script.classification)
panel_6 = Panel(python_3_script.cleaned_values)
panel_7 = Panel(python_3_script.matched_keyword)
cjv_4 = CreateJSONValue(Value=python_3_script.classification)
cjo_4 = CreateJSONObject(Keys="permanence classification", Values=cjv_4)
respond_4 = MCPToolResponse(Request=decall_6.Request, Content=cjo_4, IsError=False)

# ---- group: Extract the tool call parameters
gjok_6 = GetJSONObjectKey(JObject=decall_4.Arguments, Key="layout_json")
gjok_7 = GetJSONObjectKey(JObject=decall_4.Arguments, Key="room_name")
gjok_8 = GetJSONObjectKey(JObject=decall_4.Arguments, Key="width")
rjv_6 = ReadJSONValue(JValue=gjok_6)  # -> AsString, AsNumber, AsBool
rjv_7 = ReadJSONValue(JValue=gjok_8)  # -> AsString, AsNumber, AsBool

# ---- group: Get a Specific Room
py3 = Python3Script(json_str=rjv_6.AsString, room_name=gjok_7)  # -> out, a; inputs room_name: String
# ---------- py3: Python ----------
import json
import Rhino.Geometry as rg

# Inputs:
# json_str -> JSON as string
# room_name -> e.g. "Living Room"

def load_json_from_string(json_string):
    try:
        data = json.loads(json_string)
    except Exception as e:
        raise ValueError(f"Invalid JSON string: {e}")
    return data

def create_polyline(points):
    pts = [rg.Point3d(x, y, 0) for x, y in points]

    # Ensure closed
    if pts[0] != pts[-1]:
        pts.append(pts[0])

    return rg.Polyline(pts).ToPolylineCurve()

# Load JSON
data = load_json_from_string(json_str)

# Find the room
room_curve = None

for room in data.get("rooms", []):
    if room.get("name") == room_name:
        geometry = room.get("geometry")
        if geometry:
            room_curve = create_polyline(geometry)
        break

# Output ONLY the polyline
a = room_curve
# ---------- end py3 ----------

# ----
# delete_room_01
decall_7 = DeconstructToolCall(Request=sift.Output2)  # -> Request, Tool, Arguments
gjok_9 = GetJSONObjectKey(JObject=decall_7.Arguments, Key="layout_json")
gjok_10 = GetJSONObjectKey(JObject=decall_7.Arguments, Key="room_name")
rjv_8 = ReadJSONValue(JValue=gjok_9)  # -> AsString, AsNumber, AsBool

# ---- group: Delete a Space by name
py3_2 = Python3Script(json_str=rjv_8.AsString, room_name=gjok_10)  # -> out, a; inputs room_name: String
# ---------- py3_2: Python ----------
import json
import copy

# Inputs:
# json_str -> JSON as string
# room_name -> e.g. "Kitchen"

def load_json_from_string(json_string):
    try:
        data = json.loads(json_string)
    except Exception as e:
        raise ValueError(f"Invalid JSON string: {e}")
    return data

# Load JSON
data = load_json_from_string(json_str)

# Work on a copy
filtered = copy.deepcopy(data)

# ------------------------
# 1. Find room IDs to remove
# ------------------------
ids_to_remove = set()

for room in filtered.get("rooms", []):
    if room.get("name") == room_name:
        ids_to_remove.add(room.get("id"))

# ------------------------
# 2. Remove from rooms
# ------------------------
filtered["rooms"] = [
    r for r in filtered.get("rooms", [])
    if r.get("id") not in ids_to_remove
]

# ------------------------
# 3. Remove / clean DOORS
# (remove doors that connect to deleted rooms)
# ------------------------
filtered["doors"] = [
    d for d in filtered.get("doors", [])
    if not any(rid in ids_to_remove for rid in d.get("attributes", {}).get("connectsRooms", []))
]

# ------------------------
# 4. Remove WINDOWS linked to deleted rooms
# ------------------------
filtered["windows"] = [
    w for w in filtered.get("windows", [])
    if w.get("attributes", {}).get("roomId") not in ids_to_remove
]

# ------------------------
# 5. Remove FURNITURE linked to deleted rooms
# ------------------------
filtered["furniture"] = [
    f for f in filtered.get("furniture", [])
    if f.get("attributes", {}).get("roomId") not in ids_to_remove
]

# ------------------------
# 6. (Optional) MEP cleanup
# (only if tied to rooms — currently not in your schema)
# ------------------------
# Keeping all MEP elements for now

# ------------------------
# 7. STRUCTURE
# (typically global, so we keep it)
# ------------------------

# ------------------------
# Output ONLY as string
# ------------------------
a = json.dumps(filtered, indent=2)
# ---------- end py3_2 ----------

# ----
pjs = ParseJSONString(Text=py3_2.a)
respond_5 = MCPToolResponse(Request=decall_7.Request, Content=pjs, IsError=False)

# ----
# BOX
# compute_volume_of_box
decall_8 = DeconstructToolCall(Request=sift.Output5)  # -> Request, Tool, Arguments
gjok_11 = GetJSONObjectKey(JObject=decall_8.Arguments, Key="width")
gjok_12 = GetJSONObjectKey(JObject=decall_8.Arguments, Key="length")
gjok_13 = GetJSONObjectKey(JObject=decall_8.Arguments, Key="height")
rjv_9 = ReadJSONValue(JValue=gjok_11)  # -> AsString, AsNumber, AsBool
rjv_10 = ReadJSONValue(JValue=gjok_12)  # -> AsString, AsNumber, AsBool
rjv_11 = ReadJSONValue(JValue=gjok_13)  # -> AsString, AsNumber, AsBool

number = Number(rjv_9.AsNumber)
number_2 = Number(rjv_10.AsNumber)
number_3 = Number(rjv_11.AsNumber)

center_box = CenterBox(Base=PlaneXY(0, 0, 0), X=number, Y=number_2, Z=number_3)
volume_3 = Volume(Geometry=center_box)  # -> Volume, Centroid
panel_8 = Panel(volume_3.Volume)
geo_4 = Geometry(center_box)
cjv_5 = CreateJSONValue(Value=panel_8)
cjo_5 = CreateJSONObject(Keys="volume", Values=cjv_5)
respond_6 = MCPToolResponse(Request=decall_8.Request, Content=cjo_5, IsError=False)

# ----
# TOOL_01
# tag_and_audit
# structure                                   array of objects
# │
# ├── [column object]
# │   ├── id                                  string   e.g. "column-1"
# │   ├── name                                string   e.g. "Column 1"
# │   ├── geometry                            [[x,y]]  single point
# │   └── attributes
# │       ├── type                            string   "perimeter" | "internal"
# │       ├── dimensions                      string   e.g. "400x400mm"
# │       ├── height                          float
# │       ├── isWallAligned                   boolean  true | false
# │       ├── structuralRole                  string   e.g. "primary" | "secondary" | "transfer"
# │       ├── material                        string   ""  empty for now
# │       └── conflict                        string   e.g. "none" | "overlaps room-4" | "blocks door-2"
# │
# └── [beam object]
#     ├── id                                  string   e.g. "beam-1"
#     ├── name                                string   e.g. "Beam 1"
#     ├── geometry                            [[x,y], [x,y]]  two-point line segment
#     └── attributes
#         ├── type                            string   "perimeter" | "internal"
#         ├── length                          float
#         ├── depth                           string   e.g. "600mm"
#         ├── isWallAligned                   boolean  true | false
#         ├── structuralRole                  string   e.g. "primary" | "secondary" | "transfer"
#         ├── material                        string   ""  empty for now
#         └── conflict                        string   e.g. "none" | "overlaps room-4" | "blocks door-2"
# C:\Users\etmaglari\OneDrive - CRAFT Engineering Studio\Desktop\ELENI\MASTER\AIA Studio\Midterm\layout_schema_x3.json
panel_9 = Panel("D:\IAAC\AIA26\Studio_AIA\Database\AIA26_Studio\team_01\_testing_data\sample_layouts.json")
panel_10 = Panel("D:\AD Backup\IAAC\AIA_Studio\sample_complex_layouts.json")
panel_11 = Panel("D:\IAAC\AIA26\Studio_AIA\Database\AIA26_Studio\team_01\_testing_data\sample_complex_layouts.json")
panel_13 = Panel("D:\IAAC\AIA26\Studio_AIA\Database\AIA26_Studio\team_01\_testing_data\sample_layouts.json")
panel_15 = Panel("C:\Users\etmaglari\OneDrive - CRAFT Engineering Studio\Desktop\ELENI\MASTER\AIA Studio\Midterm\sample_complex_layouts.json")
# tag_and_audit
# TOOL_01
decall_9 = DeconstructToolCall(Request=sift.Output7)  # -> Request, Tool, Arguments
gjok_14 = GetJSONObjectKey(JObject=decall_9.Arguments, Key="layout_json")
number_slider = Slider(0, range=0..5)
py3_3 = Python3Script(json_path=panel_15)  # -> out, layout_ids, apartments
# ---------- py3_3: Python ----------
import json

# Read the JSON file
with open(json_path, 'r') as f:
    data = json.load(f)

# Split into individual apartments
layout_ids = []
apartments = []

for layout in data:
    layout_ids.append(layout["layoutId"])
    apartments.append(json.dumps(layout, indent=2))
# ---------- end py3_3 ----------
rjv_12 = ReadJSONValue(JValue=gjok_14)  # -> AsString, AsNumber, AsBool
panel_16 = Panel(py3_3.layout_ids)
item = ListItem(List=py3_3.apartments, Index=number_slider, Wrap=True)
item_2 = ListItem(List=py3_3.apartments, Index=number_slider, Wrap=True)
panel_17 = Panel(item)
Y = UnitY(Factor=1)
Y_2 = UnitY(Factor=1)
X = UnitX(Factor=1)
number_slider_2 = Slider(10, range=0..10)

python_3_script_2 = Python3Script(json_str=rjv_12.AsString)  # -> out, a; inputs json_str: String
# ---------- python_3_script_2: Python ----------
import json
import re

def load_json_from_string(json_string):
    if isinstance(json_string, list):
        json_string = "".join(str(item) for item in json_string)
    
    json_string = json_string.strip()
    json_string = re.sub(r'\[\"(\w+)\":', r'"\1":', json_string)
    
    match = re.search(r'\}"\s*,\s*"grid_spacing"', json_string)
    if match:
        json_string = json_string[:match.start() + 1]
    
    try:
        data = json.loads(json_string)
        return data
    except Exception as e:
        raise ValueError(f"Invalid JSON string: {e}")

data = load_json_from_string(json_str)
a = json.dumps(data, indent=2)
# ---------- end python_3_script_2 ----------

# ---- group: Design Logic to Add a Window
room_polyline = Data(py3.a)
panel_18 = Panel("2")
debrep = DeconstructBrep(Brep=room_polyline)  # -> Faces, Edges, Vertices
item_3 = ListItem(List=debrep.Edges, Index=0, Wrap=True)
midpt = CurveMiddle(Curve=item_3)

# ----
division = Division(A=rjv_7.AsNumber, B=panel_18)

# ---- group: Design Logic to Add a Window (continued)
X_2 = UnitX(Factor=division)
move = Move(Geometry=midpt, Motion=expr("-x", X_2))  # -> Geometry, Transform
move_2 = Move(Geometry=midpt, Motion=X_2)  # -> Geometry, Transform
merge = Merge(Data1=move_2.Geometry, Data2=move.Geometry)

# ---- group: Creates a Window Object
txt = Text(merge)
window_object = Python3Script(element_id="window-2", name="South Window", geometry=txt)  # -> out, window_obj; inputs element_id: String, geometry: list
# ---------- window_object: Python ----------
import json

def parse_point_string(pt_str):
    """
    Converts '{3.5, 0, 0}' -> [3.5, 0.0]
    """
    # Remove braces and spaces
    cleaned = pt_str.strip().replace("{", "").replace("}", "")
    
    # Split into components
    parts = cleaned.split(",")
    
    if len(parts) < 2:
        raise ValueError(f"Invalid point format: {pt_str}")
    
    x = float(parts[0])
    y = float(parts[1])
    
    return [x, y]

def serialize_geometry(geometry_list):
    """
    Converts list of GH strings into [[x,y], [x,y]]
    """
    return [parse_point_string(pt) for pt in geometry_list]

# ------------------------
# Convert geometry
# ------------------------
serialized_geometry = serialize_geometry(geometry)

# Build window object
window_obj = {
    "id": element_id,
    "name": name,
    "geometry": serialized_geometry
}

# Optional attributes
if attributes:
    window_obj["attributes"] = attributes

# Output ONLY as JSON string
window_obj = json.dumps(window_obj, indent=2)
# ---------- end window_object ----------

# ---- group: Merge it to the original layout json
py3_4 = Python3Script(json_str=rjv_6.AsString, new_object=window_object.window_obj)  # -> out, updated_layout
# ---------- py3_4: Python ----------
import json
import copy

def load_json_from_string(json_string):
    try:
        return json.loads(json_string)
    except Exception as e:
        raise ValueError(f"Invalid JSON string: {e}")

def detect_object_type(obj):
    """
    Infer target list from object id prefix.
    """
    obj_id = obj.get("id", "").lower()

    if obj_id.startswith("window"):
        return "windows"
    elif obj_id.startswith("door"):
        return "doors"
    elif obj_id.startswith("furn") or obj_id.startswith("furniture"):
        return "furniture"
    elif obj_id.startswith("mep"):
        return "mep"
    elif obj_id.startswith("wall") or obj_id.startswith("structure"):
        return "structure"
    else:
        # default fallback (safe choice)
        return "windows"

# ------------------------
# Load inputs
# ------------------------
layout = load_json_from_string(json_str)
new_object = json.loads(new_object)  # assuming object comes as JSON string

# Work on copy
updated = copy.deepcopy(layout)

# ------------------------
# Detect target category
# ------------------------
target_key = detect_object_type(new_object)

# ------------------------
# Ensure list exists
# ------------------------
if target_key not in updated:
    updated[target_key] = []

# ------------------------
# Insert object
# ------------------------
updated[target_key].append(new_object)

# ------------------------
# Output JSON string
# ------------------------
updated_layout = json.dumps(updated, indent=2)
# ---------- end py3_4 ----------

# ----
panel_19 = Panel(py3_4.updated_layout)
pjs_2 = ParseJSONString(Text=py3_4.updated_layout)
respond_7 = MCPToolResponse(Request=decall_4.Request, Content=pjs_2, IsError=False)
merge_2 = Merge(Data1=flatten(py3_2.a), Data2=flatten(py3_4.updated_layout))

# ---- group: Extractor Tool do map json to grasshopper data
extractor = Python3Script(json_str=merge_2)  # -> out, outline_curve, room_names, room_curves, door_names, door_curves, window_names, window_curves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
# ---------- extractor: Python ----------
import json
import Rhino.Geometry as rg

def load_json_from_string(json_string):
    try:
        data = json.loads(json_string)
    except Exception as e:
        raise ValueError(f"Invalid JSON string: {e}")
    return data

def create_polyline(points, close=True):
    """Create a Rhino PolylineCurve from 2D points"""
    pts = [rg.Point3d(x, y, 0) for x, y in points]

    if close and pts[0] != pts[-1]:
        pts.append(pts[0])

    return rg.Polyline(pts).ToPolylineCurve()

def create_line(points):
    """Create a Rhino LineCurve from 2 points"""
    if len(points) != 2:
        return None
    p1 = rg.Point3d(points[0][0], points[0][1], 0)
    p2 = rg.Point3d(points[1][0], points[1][1], 0)
    return rg.LineCurve(p1, p2)

# Load JSON
layout = load_json_from_string(json_str)

# ------------------------
# ROOMS (polygons)
# ------------------------
room_names = []
room_curves = []

for room in layout.get("rooms", []):
    name = room.get("name")
    geometry = room.get("geometry")

    if name and geometry:
        curve = create_polyline(geometry, close=True)
        room_names.append(name)
        room_curves.append(curve)

# ------------------------
# DOORS (lines)
# ------------------------
door_names = []
door_curves = []

for door in layout.get("doors", []):
    name = door.get("name")
    geometry = door.get("geometry")

    if name and geometry:
        curve = create_line(geometry)
        if curve:
            door_names.append(name)
            door_curves.append(curve)

# ------------------------
# WINDOWS (lines)
# ------------------------
window_names = []
window_curves = []

for window in layout.get("windows", []):
    name = window.get("name")
    geometry = window.get("geometry")

    if name and geometry:
        curve = create_line(geometry)
        if curve:
            window_names.append(name)
            window_curves.append(curve)

# ------------------------
# FURNITURE (polygons)
# ------------------------
furniture_names = []
furniture_curves = []

for furn in layout.get("furniture", []):
    name = furn.get("name")
    geometry = furn.get("geometry")

    if name and geometry:
        curve = create_polyline(geometry, close=True)
        furniture_names.append(name)
        furniture_curves.append(curve)

# ------------------------
# MEP (polygons)
# ------------------------
mep_names = []
mep_curves = []

for m in layout.get("mep", []):
    name = m.get("name")
    geometry = m.get("geometry")

    if name and geometry:
        curve = create_polyline(geometry, close=True)
        mep_names.append(name)
        mep_curves.append(curve)

# ------------------------
# STRUCTURE (lines)
# ------------------------
structure_names = []
structure_curves = []

for s in layout.get("structure", []):
    name = s.get("name")
    geometry = s.get("geometry")

    if name and geometry:
        curve = create_line(geometry)
        if curve:
            structure_names.append(name)
            structure_curves.append(curve)

# ------------------------
# OUTLINE (optional)
# ------------------------
outline_curve = None
if "outline" in layout:
    outline_curve = create_polyline(layout["outline"], close=True)

# ------------------------
# OUTPUTS
# ------------------------
a = room_names
b = room_curves

c = door_names
d = door_curves

e = window_names
f = window_curves

g = furniture_names
h = furniture_curves

i = mep_names
j = mep_curves

k = structure_names
l = structure_curves

m = outline_curve
# ---------- end extractor ----------

# ---- group: Polylines
srf = Surface(extractor.room_curves)
preview = CustomPreview(Geometry=srf, Material=[ColourSwatch(SwatchColor=RGB(167, 219, 44)), ColourSwatch(SwatchColor=RGB(4, 154, 184))])

# ---- group: Windows
data = Data(extractor.window_curves)
previewlw = CustomPreviewLineweights(Geometry=data, Shader=ColourSwatch(SwatchColor=RGB(56, 56, 56)), Thickness=Slider(5.4, range=0..10), Absolute=False)

# ---- group: Labels
area_2 = Area(Geometry=srf)  # -> Area, Centroid
tag = TextTag(Location=area_2.Centroid, Text=extractor.room_names)

# ----
py3_5 = Python3Script(layout_json=python_3_script_2.a)  # -> out, layout_points, layout_outline, room_names, room_points, room_curves, room_area, room_centroid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; inputs layout_json: String
# ---------- py3_5: Python ----------
import json
import Rhino.Geometry as rg


# Parse the layout JSON string
if isinstance(layout_json, str):
    layout = json.loads(layout_json)
else:
    layout = layout_json

layout_points = []
layout_outline =[]
room_names = []
room_points = []
room_curves = []
room_area = []
room_centroid = []

door_names = []
door_points = []
window_names = []
window_curves = []


# Outline points and curve
outline_pts = [rg.Point3d(pt[0], pt[1], 0) for pt in layout["outline"]]
outline_polyline = rg.Polyline(outline_pts)
outline_curve = outline_polyline.ToNurbsCurve()

layout_points.append(outline_pts)
layout_outline.append(outline_curve)

for room in layout["rooms"]:
    name = room["name"]
    geometry = room["geometry"]       
    
    # Create points from XY coordinates (Z = 0)
    pts = [rg.Point3d(pt[0], pt[1], 0) for pt in geometry]
    
    # Create polyline from points
    polyline = rg.Polyline(pts)
    curve = polyline.ToNurbsCurve()

    area = room["attributes"]["area"]

    pts_unique = pts[:-1]  # remove last duplicate point

    centroid = rg.Point3d(
    sum(p.X for p in pts_unique) / len(pts_unique),
    sum(p.Y for p in pts_unique) / len(pts_unique),
    0
    )   

    room_names.append(name)
    room_points.append(pts)
    room_curves.append(curve)
    room_area.append(area)
    room_centroid.append(centroid)
    
# Doors - single points
for door in layout["doors"]:
    pt = door["geometry"][0]
    door_names.append(door["name"])
    door_points.append(rg.Point3d(pt[0], pt[1], 0))

# Windows - lines
for window in layout["windows"]:
    pts = [rg.Point3d(pt[0], pt[1], 0) for pt in window["geometry"]]
    polyline = rg.Polyline(pts)
    window_names.append(window["name"])
    window_curves.append(polyline.ToNurbsCurve())
# ---------- end py3_5 ----------
crv = Curve(py3_5.window_curves)
pt = Point(py3_5.door_points)
crv_2 = Curve(py3_5.layout_outline)
py3_6 = Python3Script(room_names=py3_5.room_names)  # -> out, colors; inputs room_names: list of String
# ---------- py3_6: Python ----------
def classify_room(name):
    name_lower = name.lower()
    if any(x in name_lower for x in ["bed", "master", "guest bedroom", "studio"]):
        return "bedroom"
    elif any(x in name_lower for x in ["living", "lounge", "family"]):
        return "living"
    elif any(x in name_lower for x in ["kitchen", "dining"]):
        return "kitchen"
    elif any(x in name_lower for x in ["bath", "ensuite", "powder", "wc"]):
        return "bathroom"
    elif any(x in name_lower for x in ["hall", "foyer", "entry", "corridor", "gallery"]):
        return "circulation"
    elif any(x in name_lower for x in ["study", "library", "office"]):
        return "study"
    elif any(x in name_lower for x in ["storage", "laundry", "wardrobe"]):
        return "storage"
    elif any(x in name_lower for x in ["terrace", "balcony"]):
        return "outdoor"
    else:
        return "other"

color_map = {
    "bedroom":     (100, 149, 237),  # blue
    "living":      (144, 238, 144),  # green
    "kitchen":     (255, 200, 87),   # yellow
    "bathroom":    (173, 216, 230),  # cyan
    "circulation": (255, 160, 122),  # salmon
    "study":       (216, 191, 216),  # purple
    "storage":     (169, 169, 169),  # grey
    "outdoor":     (152, 251, 152),  # pale green
    "other":       (200, 200, 200)   # light grey
}

colors = [color_map[classify_room(name)] for name in room_names]
# ---------- end py3_6 ----------
offset = OffsetCurve(Curve=py3_5.room_curves, Distance=expr("-x", "0.115"), Corners=1)  # -> flatten(Curve)
explode = Explode(Curve=py3_5.room_curves, Recursive=True)  # -> simplify(Segments), Vertices
dprod = DotProduct(VectorA=explode.Segments, VectorB=Y, Unitize=invert(False))  # -> expr("Abs(x)", DotProduct)
dispatch = Dispatch(List=explode.Segments, DispatchPattern=dprod)  # -> ListA, ListB
crv_3 = Curve(crv_2)
crv_along_y = Curve(dispatch.ListA)
crv_along_x = Curve(dispatch.ListB)
boundary = BoundarySurfaces(Edges=offset)
txt_2 = Text(py3_6.colors)
preview_2 = CustomPreview(Geometry=boundary, Material=txt_2)
end = EndPoints(Curve=crv_along_y)  # -> Start, End
end_2 = EndPoints(Curve=crv_along_x)  # -> Start, End
cullpt = CullDuplicates(Points=flatten([end.Start, end.End]), Tolerance=0.1, CullMode=3)  # -> Points, Indices, Valence
cullpt_2 = CullDuplicates(Points=flatten([end_2.Start, end_2.End]), Tolerance=0.1, CullMode=3)  # -> Points, Indices, Valence
pdecon = Deconstruct(Point=cullpt.Points)  # -> XComponent, YComponent, ZComponent
pdecon_2 = Deconstruct(Point=cullpt_2.Points)  # -> XComponent, YComponent, ZComponent
sort = SortList(Keys=pdecon.XComponent, ValuesA=cullpt.Points)  # -> Keys, ValuesA
sort_2 = SortList(Keys=pdecon_2.YComponent, ValuesA=cullpt_2.Points)  # -> Keys, ValuesA
cset = CreateSet(List=sort.Keys)  # -> Set, Map
cset_2 = CreateSet(List=sort_2.Keys)  # -> Set, Map
mindex_2 = MemberIndex(Set=sort.Keys, Member=cset.Set)  # -> Index, Count
mindex_3 = MemberIndex(Set=sort_2.Keys, Member=cset_2.Set)  # -> Index, Count
item_4 = ListItem(List=sort.ValuesA, Index=mindex_2.Index, Wrap=True)
item_5 = ListItem(List=sort_2.ValuesA, Index=mindex_3.Index, Wrap=True)
pdecon_3 = Deconstruct(Point=item_4)  # -> XComponent, YComponent, ZComponent
pdecon_4 = Deconstruct(Point=item_5)  # -> XComponent, YComponent, ZComponent
sort_3 = SortList(Keys=pdecon_3.YComponent, ValuesA=item_4)  # -> Keys, ValuesA
sort_4 = SortList(Keys=pdecon_4.XComponent, ValuesA=item_5)  # -> Keys, ValuesA
item_6 = ListItem(List=sort_3.ValuesA, Index=[0, -1], Wrap=True)
item_7 = ListItem(List=sort_4.ValuesA, Index=[0, -1], Wrap=True)
item_8 = ListItem(List=item_6, Index=0, Wrap=True)  # -> Item, Item1
item_9 = ListItem(List=item_7, Index=0, Wrap=True)  # -> Item, Item1
ln = Line(StartPoint=item_8.Item, EndPoint=item_8.Item1)  # -> simplify(Line)
ln_2 = Line(StartPoint=item_9.Item, EndPoint=item_9.Item1)  # -> simplify(Line)
crv_4 = Curve(crv_3)
crv_5 = Curve(crv_3)
midpt_2 = CurveMiddle(Curve=ln)
midpt_3 = CurveMiddle(Curve=ln_2)
disc = Discontinuity(Curve=crv_5, Level=1)  # -> Points, Parameters
disc_2 = Discontinuity(Curve=crv_4, Level=1)  # -> Points, Parameters
pdecon_5 = Deconstruct(Point=midpt_2)  # -> flatten(XComponent), YComponent, ZComponent
pdecon_6 = Deconstruct(Point=disc.Points)  # -> flatten(XComponent), YComponent, ZComponent
pdecon_7 = Deconstruct(Point=midpt_3)  # -> XComponent, flatten(YComponent), ZComponent
pdecon_8 = Deconstruct(Point=disc_2.Points)  # -> XComponent, flatten(YComponent), ZComponent
len = Length(Curve=ln)  # -> flatten(Length)
len_2 = Length(Curve=ln_2)  # -> flatten(Length)
merge_3 = Merge(Data1=ln, Data2=ln_2)  # -> flatten(Result)
sort_5 = SortList(Keys=pdecon_8.YComponent)  # -> Keys, ValuesA
sort_6 = SortList(Keys=pdecon_6.XComponent)  # -> Keys, ValuesA
cset_3 = CreateSet(List=sort_6.Keys)  # -> Set, Map
cset_4 = CreateSet(List=sort_5.Keys)  # -> Set, Map
py3_7 = Python3Script(values=pdecon_5.XComponent, lengths=len, min_span="3", max_span="7", outline_nodes=cset_3.Set)  # -> out, cull_grid; inputs values: list of Double, lengths: list of Double, min_span: Double, max_span: Double, outline_nodes: list of Double
# ---------- py3_7: Python ----------
cull_grid = [1] * len(values)
protected = set(outline_nodes)

for i in range(1, len(values) - 1):  # never cull first or last
    if cull_grid[i] == 0:
        continue

    # find previous and next kept values
    prev_idx = None
    next_idx = None
    for j in range(i - 1, -1, -1):
        if cull_grid[j] == 1:
            prev_idx = j
            break
    for j in range(i + 1, len(values)):
        if cull_grid[j] == 1:
            next_idx = j
            break

    if prev_idx is None or next_idx is None:
        continue

    gap_before = values[i] - values[prev_idx]
    gap_after  = values[next_idx] - values[i]

    if gap_before < min_span:
        if values[i] in protected:
            cull_grid[prev_idx] = 0      # i is protected, cull prev
        elif values[prev_idx] in protected:
            cull_grid[i] = 0             # prev is protected, cull i
        elif lengths[i] >= lengths[prev_idx]:
            cull_grid[prev_idx] = 0
        else:
            cull_grid[i] = 0

    elif gap_after < min_span:
        if values[i] in protected:
            cull_grid[next_idx] = 0      # i is protected, cull next
        elif values[next_idx] in protected:
            cull_grid[i] = 0             # next is protected, cull i
        elif lengths[i] >= lengths[next_idx]:
            cull_grid[next_idx] = 0
        else:
            cull_grid[i] = 0
# ---------- end py3_7 ----------
py3_8 = Python3Script(values=pdecon_7.YComponent, lengths=len_2, min_span="3", max_span="7", outline_nodes=cset_4.Set)  # -> out, cull_grid; inputs values: list of Double, lengths: list of Double, min_span: Double, max_span: Double, outline_nodes: list of Double; same code as py3_7
cull = CullPattern(List=len, CullPattern=py3_7.cull_grid)
cull_2 = CullPattern(List=pdecon_5.XComponent, CullPattern=py3_7.cull_grid)
cull_3 = CullPattern(List=len_2, CullPattern=py3_8.cull_grid)
cull_4 = CullPattern(List=pdecon_7.YComponent, CullPattern=py3_8.cull_grid)
larger = LargerThan(FirstNumber=cull, SecondNumber="4")  # -> LargerThan, OrEqualTo
larger_2 = LargerThan(FirstNumber=cull_3, SecondNumber="4")  # -> LargerThan, OrEqualTo
cull_5 = CullPattern(List=cull_2, CullPattern=larger.LargerThan)
cull_6 = CullPattern(List=cull_4, CullPattern=larger_2.LargerThan)
sort_7 = SortList(Keys=len)  # -> reverse(Keys), ValuesA
sort_8 = SortList(Keys=len_2)  # -> reverse(Keys), ValuesA
pt_2 = ConstructPoint(XCoordinate=cull_5, YCoordinate=0, ZCoordinate=0)
pt_3 = ConstructPoint(XCoordinate=0, YCoordinate=cull_6, ZCoordinate=0)
item_10 = ListItem(List=sort_7.Keys, Index=0, Wrap=True)
item_11 = ListItem(List=sort_8.Keys, Index=0, Wrap=True)
line = LineSDL(Start=pt_2, Direction=Y_2, Length=item_10)
line_2 = LineSDL(Start=pt_3, Direction=X, Length=item_11)
ext = ExtendCurve(Curve=line, Type=0, Start="2", End="2")
ext_2 = ExtendCurve(Curve=line_2, Type=0, Start="2", End="2")
merge_4 = Merge(Data1=flatten(ext), Data2=flatten(ext_2))
txt_3 = Text(py3_5.door_names)
crv_6 = Curve(crv_2)
crv_7 = Curve(offset)
crv_8 = Curve(crv)
txt_4 = Text(py3_5.window_names)
crv_9 = Curve(offset)
txt_5 = Text(py3_5.room_names)

end_3 = EndPoints(Curve=ext)  # -> Start, End
lng = ListLength(List=end_3.Start)
charseq = CharSequence(Count=lng, CharPool="ABCDEFGHIJKLMNOPQRSTUVWXYZ", Format="{0}")
annotation_dot = AnnotationDot(Location=end_3.Start, PrimaryText=charseq)  # -> AnnotationDot, Location, PrimaryText, TextHeight

end_4 = EndPoints(Curve=ext_2)  # -> Start, End
lng_2 = ListLength(List=end_4.Start)
series = Series(Start=1, Step=1, Count=lng_2)
annotation_dot_2 = AnnotationDot(Location=end_4.Start, PrimaryText=series)  # -> AnnotationDot, Location, PrimaryText, TextHeight

ccx = CurveCurve(CurveA=graft(ext), CurveB=ext_2)  # -> simplify(Points), ParamsA, ParamsB
incurve = PointInCurve(Point=ccx.Points, Curve=crv_3)  # -> simplify(Relationship), Point
dispatch_2 = Dispatch(List=ccx.Points, DispatchPattern=incurve.Relationship)  # -> simplify(ListA), ListB

crv_10 = Curve(merge_3)
pt_4 = Point(pt)
pull = PullPoint(Point=pt_4, Geometry=crv_10, ClosestOnly=True)  # -> ClosestPoint, Distance, Index
panel_20 = Panel("""-0.5
0.5""")
item_12 = ListItem(List=crv_10, Index=pull.Index, Wrap=True)
line_3 = LineSDL(Start=graft(pt_4), Direction=graft(item_12), Length=panel_20)
join = JoinCurves(Curves=line_3, Preserve=False)  # -> simplify(Curves)

annotation_dot_3 = AnnotationDot(annotation_dot_2.AnnotationDot)
annotation_dot_4 = AnnotationDot(annotation_dot.AnnotationDot)
merge_5 = Merge(Data1=flatten(annotation_dot_4), Data2=flatten(annotation_dot_3))
trim = TrimTree(Tree=dispatch_2.ListA, Depth=1)
tstat = TreeStatistics(Tree=trim)  # -> Paths, Length, Count
pt_5 = Point(trim)
crv_11 = Curve(flatten(join))
series_2 = Series(Start=1, Step=1, Count=tstat.Length)
lng_3 = ListLength(List=tstat.Paths)
charseq_2 = CharSequence(Count=lng_3, CharPool="ABCDEFGHIJKLMNOPQRSTUVWXYZ", Format="{0}")  # -> graft(Sequence)
pull_2 = PullPoint(Point=pt_5, Geometry=crv_11, ClosestOnly=True)  # -> ClosestPoint, Distance, Index
pull_3 = PullPoint(Point=pt_5, Geometry=crv_6, ClosestOnly=True)  # -> ClosestPoint, simplify(Distance), Index
pull_4 = PullPoint(Point=pt_5, Geometry=crv_8, ClosestOnly=True)  # -> ClosestPoint, Distance, Index
incurves = PointInCurves(Point=pt_5, Curves=crv_7)  # -> Relationship, Index, Point
pt_6 = Point(trim)
item_13 = ListItem(List=txt_3, Index=pull_2.Index, Wrap=True)
item_14 = ListItem(List=txt_4, Index=pull_4.Index, Wrap=True)
concat = Concatenate(FragmentB=charseq_2, FragmentC="_", FragmentD=series_2)  # -> simplify(Result)
py3_9 = Python3Script(col_dist=pull_4.Distance, window_name=item_14)  # -> out, window_conflict; inputs col_dist: list of Int32, window_name: list of String
# ---------- py3_9: Python ----------
window_conflict = []

for dist, name in zip(col_dist, window_name):
    if dist < 0.15:
        window_conflict.append("blocks " + name)
    else:
        window_conflict.append("None")
# ---------- end py3_9 ----------
flip = FlipMatrix(Data=pt_6)
py3_10 = Python3Script(col_dist=pull_2.Distance, door_name=item_13)  # -> out, door_conflict; inputs col_dist: list of Int32, door_name: list of String
# ---------- py3_10: Python ----------
door_conflict = []

for dist, name in zip(col_dist, door_name):
    if dist < 0.15:
        door_conflict.append("blocks " + name)
    else:
        door_conflict.append("None")
# ---------- end py3_10 ----------
py3_11 = Python3Script(col_location=incurves.Relationship)  # -> out, wall_aligned; inputs col_location: Int32
# ---------- py3_11: Python ----------
wall_aligned = "true" if col_location == 0 else "false"
# ---------- end py3_11 ----------
py3_12 = Python3Script(input_dist=pull_3.Distance)  # -> out, col_type; inputs input_dist: Double
# ---------- py3_12: Python ----------
col_type = "internal" if input_dist > 0.01 else "exterior"
# ---------- end py3_12 ----------
py3_13 = Python3Script(input_dist=pull_3.Distance)  # -> out, col_dim; inputs input_dist: Double
# ---------- py3_13: Python ----------
col_dim = "300x450" if input_dist > 0.01 else "300x600"
# ---------- end py3_13 ----------
concat_2 = Concatenate(FragmentA="Column_", FragmentB=concat)
pline = PolyLine(Vertices=flip, Closed=False)
pline_2 = PolyLine(Vertices=pt_6, Closed=False)
explode_2 = Explode(Curve=pline, Recursive=True)  # -> simplify(Segments), Vertices
explode_3 = Explode(Curve=pline_2, Recursive=True)  # -> simplify(Segments), Vertices
annotation_dot_5 = AnnotationDot(Location=trim, PrimaryText=concat, TextHeight=Slider(8, range=0..10))  # -> AnnotationDot, Location, PrimaryText, TextHeight
lng_4 = ListLength(List=explode_2.Segments)
lng_5 = ListLength(List=explode_3.Segments)
py3_14 = Python3Script(w_c=py3_9.window_conflict, d_c=py3_10.door_conflict)  # -> out, conflict; inputs w_c: list, d_c: list
# ---------- py3_14: Python ----------
conflict = [a if a else b for a, b in zip(w_c, d_c)]
# ---------- end py3_14 ----------
charseq_3 = CharSequence(Count=expr("x+1", lng_4), CharPool="ABCDEFGHIJKLMNOPQRSTUVWXYZ", Format="{0}")  # -> simplify(Sequence)
series_3 = Series(Start=1, Step=1, Count=expr("x+1", lng_5))
tstat_2 = TreeStatistics(Tree=lng_4)  # -> Paths, Length, Count
tstat_3 = TreeStatistics(Tree=lng_5)  # -> Paths, Length, Count
shift = ShiftList(List=charseq_3, Shift=expr("-x", "1"), Wrap=invert(True))
shift_2 = ShiftList(List=charseq_3, Shift="1", Wrap=invert(True))
shift_3 = ShiftList(List=series_3, Shift=expr("-x", "1"), Wrap=invert(True))
shift_4 = ShiftList(List=series_3, Shift="1", Wrap=invert(True))
lng_6 = ListLength(List=tstat_2.Paths)
lng_7 = ListLength(List=tstat_3.Paths)
crv_12 = Curve(explode_2.Segments)
crv_13 = Curve(explode_3.Segments)
charseq_4 = CharSequence(Count=lng_7, CharPool="ABCDEFGHIJKLMNOPQRSTUVWXYZ", Format="{0}")  # -> graft(Sequence)
series_4 = Series(Start=1, Step=1, Count=lng_6)  # -> graft(Series)
concat_3 = Concatenate(FragmentA=shift, FragmentB=shift_2)  # -> simplify(Result)
concat_4 = Concatenate(FragmentA=shift_3, FragmentB=shift_4)  # -> simplify(Result)
midpt_4 = CurveMiddle(Curve=crv_12)
midpt_5 = CurveMiddle(Curve=crv_13)
len_3 = Length(Curve=crv_12)
len_4 = Length(Curve=crv_13)
pdecon_9 = Deconstruct(Point=pt_5)  # -> XComponent, YComponent, ZComponent
concat_5 = Concatenate(FragmentA=concat_3, FragmentB=series_4, JoinSeparator="_")
concat_6 = Concatenate(FragmentA=charseq_4, FragmentB=concat_4, JoinSeparator="_")
merge_6 = Merge(Data1=crv_12, Data2=crv_13)
concat_7 = Concatenate(
    FragmentF="[",
    FragmentC="[",
    FragmentA=pdecon_9.XComponent,
    FragmentE=",",
    FragmentB=pdecon_9.YComponent,
    FragmentD="]",
    FragmentG="]")
end_5 = EndPoints(Curve=crv_12)  # -> Start, End
annotation_dot_6 = AnnotationDot(Location=midpt_4, PrimaryText=concat_5, TextHeight=number_slider_2)  # -> AnnotationDot, Location, PrimaryText, TextHeight
annotation_dot_7 = AnnotationDot(Location=midpt_5, PrimaryText=concat_6, TextHeight=number_slider_2)  # -> AnnotationDot, Location, PrimaryText, TextHeight
end_6 = EndPoints(Curve=crv_13)  # -> Start, End
concat_8 = Concatenate(FragmentA="Beam_", FragmentB=concat_5)
concat_9 = Concatenate(FragmentA="Beam_", FragmentB=concat_6)
pdecon_10 = Deconstruct(Point=end_5.End)  # -> XComponent, YComponent, ZComponent
pdecon_11 = Deconstruct(Point=end_5.Start)  # -> XComponent, YComponent, ZComponent
pdecon_12 = Deconstruct(Point=end_6.End)  # -> XComponent, YComponent, ZComponent
pdecon_13 = Deconstruct(Point=end_6.Start)  # -> XComponent, YComponent, ZComponent
column_geometry = Data(concat_7)
column_tag_display = AnnotationDot(annotation_dot_5.AnnotationDot)
column_dimensions = Data(py3_13.col_dim)
column_name = Text(concat_2)
is_wall_aligned = Data(py3_11.wall_aligned)
column_type = Data(py3_12.col_type)
col_conflicts = Data(py3_14.conflict)
column_id = Text(concat)
panel_21 = Panel(column_name)
panel_22 = Panel(column_dimensions)
panel_23 = Panel(col_conflicts)
panel_24 = Panel(column_id)
panel_25 = Panel(column_geometry)
panel_26 = Panel(column_type)
panel_27 = Panel(is_wall_aligned)
concat_10 = Concatenate(FragmentC="[", FragmentA=pdecon_10.XComponent, FragmentE=",", FragmentB=pdecon_10.YComponent, FragmentD="]")
concat_11 = Concatenate(FragmentC="[", FragmentA=pdecon_11.XComponent, FragmentE=",", FragmentB=pdecon_11.YComponent, FragmentD="]")
concat_12 = Concatenate(FragmentC="[", FragmentA=pdecon_12.XComponent, FragmentE=",", FragmentB=pdecon_12.YComponent, FragmentD="]")
concat_13 = Concatenate(FragmentC="[", FragmentA=pdecon_13.XComponent, FragmentE=",", FragmentB=pdecon_13.YComponent, FragmentD="]")
midpt_6 = CurveMiddle(Curve=merge_6)
concat_14 = Concatenate(FragmentD="[", FragmentA=concat_11, FragmentC=",", FragmentB=concat_10, FragmentE="]")
concat_15 = Concatenate(FragmentD="[", FragmentA=concat_13, FragmentC=",", FragmentB=concat_12, FragmentE="]")
incurves_2 = PointInCurves(Point=midpt_6, Curves=crv_9)  # -> Relationship, Index, Point
incurve_2 = PointInCurve(Point=midpt_6, Curve=crv_4)  # -> Relationship, Point
beam_geometry_array = Data(simplify(concat_14))
beam_geometry_array_2 = Data(simplify(concat_15))
beam_tag_display = AnnotationDot(annotation_dot_6.AnnotationDot)
beam_tag_display_2 = AnnotationDot(annotation_dot_7.AnnotationDot)
beam_length = Text(simplify(len_3))
py3_15 = Python3Script(x=incurves_2.Index)  # -> out, a; inputs x: Int32
# ---------- py3_15: Python ----------
if(x ==-1):
    x = None

a = x
# ---------- end py3_15 ----------
beam_name = Text(simplify(concat_8))
beam_name_2 = Text(simplify(concat_9))
beam_length_2 = Text(len_4)
crv_14 = Curve(merge_6)
beam_id = Text(simplify(concat_5))
beam_id_2 = Text(simplify(concat_6))
int = Integer(expr("x-1", incurve_2.Relationship))
item_15 = ListItem(List=txt_5, Index=py3_15.a, Wrap=True)
py3_16 = Python3Script(room_conflicts=item_15)  # -> out, beam_conflicts; inputs room_conflicts: String
# ---------- py3_16: Python ----------
beam_conflicts = "None" if room_conflicts is None else "Floating beam in " + str(room_conflicts)
# ---------- end py3_16 ----------
py3_17 = Python3Script(beam_loc=incurves_2.Relationship)  # -> out, beam_alignment; inputs beam_loc: Double
# ---------- py3_17: Python ----------
beam_alignment = "False" if beam_loc > 0 else "True"
# ---------- end py3_17 ----------
py3_18 = Python3Script(beam_loc=int)  # -> out, beam_type; inputs beam_loc: Double
# ---------- py3_18: Python ----------
beam_type = "interior" if beam_loc > 0 else "perimeter"
# ---------- end py3_18 ----------
merge_7 = Merge(Data1=beam_length, Data2=beam_length_2)
merge_8 = Merge(Data1=beam_id, Data2=beam_id_2)
merge_9 = Merge(Data1=beam_name, Data2=beam_name_2)
merge_10 = Merge(Data1=beam_geometry_array, Data2=beam_geometry_array_2)
beam_geometry_array_3 = Data(simplify(merge_10))
beam_alignment = Data(simplify(py3_17.beam_alignment))
beam_conflicts = Data(simplify(py3_16.beam_conflicts))
beam_length_3 = Text(simplify(merge_7))
beam_name_3 = Text(simplify(merge_9))
beam_type = Data(simplify(py3_18.beam_type))
beam_id_3 = Text(simplify(merge_8))
panel_28 = Panel(beam_name_3)
panel_29 = Panel(beam_alignment)
panel_30 = Panel(beam_id_3)
panel_31 = Panel(beam_geometry_array_3)
panel_32 = Panel(beam_length_3)
panel_33 = Panel(beam_type)
panel_34 = Panel(beam_conflicts)
annotation_dot_8 = AnnotationDot(column_tag_display)

lng_8 = ListLength(List=py3_13.col_dim)
repeat = RepeatData(Data="3.5", Length=lng_8)
column_height = Data(repeat)

repeat_2 = RepeatData(Data="primary", Length=lng_8)
col_structural_role = Data(repeat_2)

repeat_3 = RepeatData(Data="RCC", Length=lng_8)
material = Data(repeat_3)

lng_9 = ListLength(List=merge_7)
repeat_4 = RepeatData(Data="600", Length=lng_9)
beam_depth = Data(simplify(repeat_4))

lng_10 = ListLength(List=merge_7)
repeat_5 = RepeatData(Data="RCC", Length=lng_10)
beam_material = Data(simplify(repeat_5))

lng_11 = ListLength(List=merge_7)
repeat_6 = RepeatData(Data="primary", Length=lng_11)
beam_structural_role = Data(simplify(repeat_6))

panel_35 = Panel(col_structural_role)
panel_36 = Panel(column_height)
panel_37 = Panel(material)
panel_38 = Panel(beam_material)
panel_39 = Panel(beam_structural_role)
panel_40 = Panel(beam_depth)
py3_19 = Python3Script(
    layout_json=item,
    col_ids=flatten(panel_24),
    col_names=flatten(panel_21),
    col_geometry=flatten(panel_25),
    col_types=flatten(panel_26),
    col_dimensions=flatten(panel_22),
    col_heights=flatten(panel_36),
    col_isWallAligned=flatten(panel_27),
    col_structuralRole=flatten(panel_35),
    col_material=flatten(panel_37),
    col_conflict=flatten(panel_23),
    beam_ids=flatten(panel_30),
    beam_names=flatten(panel_28),
    beam_geometry=flatten(panel_31),
    beam_types=flatten(panel_33),
    beam_lengths=flatten(panel_32),
    beam_depths=flatten(panel_40),
    beam_isWallAligned=flatten(panel_29),
    beam_structuralRole=flatten(panel_39),
    beam_material=flatten(panel_38),
    beam_conflict=flatten(panel_34))  # -> out, layout_output_json, log; inputs layout_json: String, col_ids: list of String, col_names: list of String, col_geometry: list of String, col_types: list of String, col_dimensions: list of String, col_heights: list of String, col_isWallAligned: list of String, col_structuralRole: list of String, col_material: list of String, col_conflict: list of String, beam_ids: list of String, beam_names: list of String, beam_geometry: list of String, beam_types: list of String, beam_lengths: list of String, beam_depths: list of String, beam_isWallAligned: list of String, beam_structuralRole: list of String, beam_material: list of String, beam_conflict: list of String
# ---------- py3_19: Python ----------
import json

if not layout_json or (isinstance(layout_json, str) and not layout_json.strip()):
    data = {}
elif isinstance(layout_json, str):
    data = json.loads(layout_json)
else:
    data = layout_json

def parse_geom(raw):
    if not raw:
        return []
    if isinstance(raw, list):
        return [raw] if raw and not isinstance(raw[0], list) else raw
    s = str(raw).strip()
    if not s.startswith("["):
        return []
    try:
        parsed = json.loads(s)
    except json.JSONDecodeError:
        return []
    return [parsed] if parsed and not isinstance(parsed[0], list) else parsed

def build_columns():
    columns = []
    for i in range(len(col_ids)):
        columns.append({
            "id":       col_ids[i],
            "name":     col_names[i],
            "geometry": parse_geom(col_geometry[i]),
            "attributes": {
                "type":           col_types[i],
                "dimensions":     col_dimensions[i],
                "height":         col_heights[i],
                "isWallAligned":  col_isWallAligned[i],
                "structuralRole": col_structuralRole[i],
                "material":       col_material[i],
                "conflict":       col_conflict[i]
            }
        })
    return columns

def build_beams():
    beams = []
    for i in range(len(beam_ids)):
        beams.append({
            "id":       beam_ids[i],
            "name":     beam_names[i],
            "geometry": parse_geom(beam_geometry[i]),
            "attributes": {
                "type":           beam_types[i],
                "length":         beam_lengths[i],
                "depth":          beam_depths[i],
                "isWallAligned":  beam_isWallAligned[i],
                "structuralRole": beam_structuralRole[i],
                "material":       beam_material[i],
                "conflict":       beam_conflict[i]
            }
        })
    return beams

data["structure"] = data.get("structure", [])
columns = build_columns()
beams = build_beams()
data["structure"].extend(columns)
data["structure"].extend(beams)

layout_output_json = json.dumps(data, indent=2)

log = (
    f"Layout: {data.get('layoutId', '?')} | "
    f"Columns: {len(columns)} | "
    f"Beams: {len(beams)} | "
    f"beam_ids: {len(beam_ids)} | "
    f"beam_lengths: {len(beam_lengths)} | "
    f"beam_lengths[0]: {repr(beam_lengths[0]) if beam_lengths else 'empty'}"
)
# ---------- end py3_19 ----------
panel_41 = Panel(py3_19.log)
panel_42 = Panel(py3_19.layout_output_json)
parse_json_string = ParseJSONString(Text=py3_19.layout_output_json)
respond_8 = MCPToolResponse(Request=decall_9.Request, Content=parse_json_string, IsError=False)

or = GateOr(A=respond_2, B=respond, C=respond_5, D=respond_7, E=respond_3, F=respond_6, G=respond_4, H=respond_8)
tool_call_success = ClusterOutput(or)

# ---- group: Centerline Display
crv_15 = Curve(merge_4)
annotation_dot_9 = AnnotationDot(merge_5)
