# Grasshopper definition WK2_team_02_working.gh (Grasshopper 1.0.8)
# Copyright: María Sánchez Domínguez
# plug-ins: Human, Swiftlet

team_02_definition_cluster = Team02DefinitionCluster()  # disabled

# ----
# Connect MCP Tools to Decall and Update All Clusters
button = Button()
# IF SOMETHING IS NOT
# WORKING PRESS THIS
# BUTTON FIRST
toggle = BooleanToggle(True)
connect_mcp_tools_to_decall = CSharpScript(nickname_From="Central MCP Server", nickname_To="Central DeCall", connect=button)  # -> out; inputs nickname_From: String, nickname_To: String, connect: Boolean
# ---------- connect_mcp_tools_to_decall: C# ----------
using System;
using System.Linq;
using Grasshopper;
using Grasshopper.Kernel;

public class Script_Instance : GH_ScriptInstance
{
    private void RunScript(string nickname_From, string nickname_To, bool connect)
    {
        if (!connect) return;
        Console.Write($"Attempting to connect outputs from '{nickname_From}' to '{nickname_To}'...");

        var ghDoc = Instances.ActiveCanvas?.Document;
        if (ghDoc == null) return;

        var compFrom = ghDoc.Objects
            .OfType<IGH_Component>()
            .FirstOrDefault(o => o.NickName == nickname_From);

        var compTo = ghDoc.Objects
            .OfType<IGH_Param>()
            .FirstOrDefault(o => o.NickName == nickname_To);

        if (compFrom != null && compTo != null)
        {
            ghDoc.ScheduleSolution(5, doc => Connect(doc, compFrom, compTo));
        }
    }

    // <Custom additional code> 
    private void Connect(GH_Document doc, IGH_Component compFrom, IGH_Param compTo)
    {
        if (compFrom == null || compTo == null) return;

        foreach (IGH_Param param in compFrom.Params.Output)
        {
            compTo.AddSource(param);
        }
    }
}
# ---------- end connect_mcp_tools_to_decall ----------
update_all_clusters = CSharpScript(update=button, recursive=toggle)  # -> out, A; inputs update: Boolean, recursive: Boolean, passwords: list of String, localPath: String
# ---------- update_all_clusters: C# ----------
using System;
using System.Collections;
using System.Collections.Generic;

using Rhino;
using Rhino.Geometry;

using Grasshopper;
using Grasshopper.Kernel;
using Grasshopper.Kernel.Data;
using Grasshopper.Kernel.Types;
using System.Windows.Forms;
using System.Linq;
/// <summary>
/// This class will be instantiated on demand by the Script component.
/// </summary>
public class Script_Instance : GH_ScriptInstance
{
  /// <summary>Print a String to the [Out] Parameter of the Script component.</summary>
  /// <param name="text">String to print.</param>
  private void Print(string text) { /* Implementation hidden. */ }
  /// <summary>Print a formatted String to the [Out] Parameter of the Script component.</summary>
  /// <param name="format">String format.</param>
  /// <param name="args">Formatting parameters.</param>
  private void Print(string format, params object[] args) { /* Implementation hidden. */ }
  /// <summary>Print useful information about an object instance to the [Out] Parameter of the Script component. </summary>
  /// <param name="obj">Object instance to parse.</param>
  private void Reflect(object obj) { /* Implementation hidden. */ }
  /// <summary>Print the signatures of all the overloads of a specific method to the [Out] Parameter of the Script component. </summary>
  /// <param name="obj">Object instance to parse.</param>
  private void Reflect(object obj, string method_name) { /* Implementation hidden. */ }

  /// <summary>Gets the current Rhino document.</summary>
  private readonly RhinoDoc RhinoDocument;
  /// <summary>Gets the Grasshopper document that owns this script.</summary>
  private readonly GH_Document GrasshopperDocument;
  /// <summary>Gets the Grasshopper script component that owns this script.</summary>
  private readonly IGH_Component Component;
  /// <summary>
  /// Gets the current iteration count. The first call to RunScript() is associated with Iteration==0.
  /// Any subsequent call within the same solution will increment the Iteration count.
  /// </summary>
  private readonly int Iteration;

  /// <summary>
  /// This procedure contains the user code. Input parameters are provided as regular arguments,
  /// Output parameters as ref arguments. You don't have to assign output parameters,
  /// they will have a default value.
  /// </summary>
  private void RunScript(
		bool update,
		bool recursive,
		List<string> passwords,
		string localPath,
		ref object A)
  {

    A = updateLog;
    if (update)
    {
      updateLog = new List<string>();
      _passwords = passwords;
      UpdateClusters(GrasshopperDocument, recursive, localPath);
    }

  }

  // <Custom additional code> 
  List<string> updateLog;
  List<String> _passwords;

  void UpdateClusters (GH_Document ghDoc, bool recursive, string localPath)
  {
    foreach (var obj in ghDoc.Objects)
    {
      var cluster = obj as Grasshopper.Kernel.Special.GH_Cluster;
      if (cluster != null)
      {
        var clusterPath = cluster.FilePath;
        if (!string.IsNullOrEmpty(clusterPath))
        {
          if (cluster.Synchronisation == Grasshopper.Kernel.Special.GH_Synchronisation.OutOfDate)
          {
            cluster.CreateFromFilePath(clusterPath);
            updateLog.Add("Updated: " + clusterPath);
          }
          else if (cluster.Synchronisation == Grasshopper.Kernel.Special.GH_Synchronisation.MissingReference)
          {
            string newPath = ReplacePath(localPath, clusterPath);
            if (!string.IsNullOrEmpty(newPath))
            {
              cluster.CreateFromFilePath(newPath);
              updateLog.Add("Replaced and updated: " + newPath);
            }
            else
            {
              updateLog.Add("Missing reference: " + clusterPath);
            }

          }
        }

        //Update recursively
        if (recursive)
        {
          GH_Document clusterDoc = GetClusterDoc(cluster);
          if (clusterDoc != null)
            UpdateClusters(clusterDoc, recursive, localPath);
        }
      }
    }
  }

  GH_Document GetClusterDoc(Grasshopper.Kernel.Special.GH_Cluster cluster)
  {
    //no pass needed
    var doc = cluster.Document(string.Empty);
    if (doc != null)
      return doc;

    //try passwords
    if (_passwords != null && _passwords.Any())
    {
      foreach (var pass in _passwords)
      {
        doc = cluster.Document(pass);
        if (doc != null)
          return doc;
      }
    }

    return null;
  }

  string ReplacePath(string localPath, string missingPath)
  {
    if (String.IsNullOrEmpty(missingPath) || string.IsNullOrEmpty(localPath))
      return null;
    else
    {
      string lastLocalPart = localPath.Split('\\').Last();
      string[] parts = missingPath.Split('\\');
      if (parts.Contains(lastLocalPart))
      {
        int i = Array.IndexOf(parts, lastLocalPart);
        string clusterPath = String.Join("\\", parts.Skip(i + 1));
        string result = String.Join("\\", localPath, clusterPath);
        return result;
      }
      else
        return null;
    }
  }
  // </Custom additional code> 
}
# ---------- end update_all_clusters ----------
panel = Panel(connect_mcp_tools_to_decall)

definitioncluster = DefinitionCluster()
c_script = CSharpScript()  # -> out, availablePort; disabled
# ---------- c_script: C# ----------
// Grasshopper Script Instance
// This script finds an available port on the local machine.
#region Usings
using System;
using System.Linq;
using System.Collections;
using System.Collections.Generic;
using System.Drawing;
using System.Net;
using System.Net.Sockets;

using Rhino;
using Rhino.Geometry;

using Grasshopper;
using Grasshopper.Kernel;
using Grasshopper.Kernel.Data;
using Grasshopper.Kernel.Types;
#endregion

public class Script_Instance : GH_ScriptInstance
{
    #region Notes
    /* 
      Members:
        RhinoDoc RhinoDocument
        GH_Document GrasshopperDocument
        IGH_Component Component
        int Iteration

      Methods (Virtual & overridable):
        Print(string text)
        Print(string format, params object[] args)
        Reflect(object obj)
        Reflect(object obj, string method_name)
    */
    #endregion

    private void RunScript(object start, object end, ref object availablePort)
    {
        // Use default values if parameters are not provided
        int startPort = (start != null && int.TryParse(start.ToString(), out int s)) ? s : 3001;
        int endPort = (end != null && int.TryParse(end.ToString(), out int e)) ? e : 3100;

        // Find an available port in the specified range
        try
        {
            availablePort = FindAvailablePortInRange(startPort, endPort);
            Print($"Available port found: {availablePort}");
        }
        catch (Exception ex)
        {
            Print($"Error: {ex.Message}");
            availablePort = null;
        }
    }

    /// <summary>
    /// Checks if a local TCP port is available for binding (i.e., not in use).
    /// Returns True if available, False otherwise.
    /// </summary>
    private bool IsPortAvailableForBind(int port)
    {
        try
        {
            // Create a new TCP socket
            using (Socket socket = new Socket(AddressFamily.InterNetwork, SocketType.Stream, ProtocolType.Tcp))
            {
                // Try to bind to the port on all interfaces (0.0.0.0)
                socket.Bind(new IPEndPoint(IPAddress.Any, port));
                // If successful, the socket is closed by the using statement and return True
                return true;
            }
        }
        catch (SocketException)
        {
            // If binding fails, it means the port is already in use
            return false;
        }
    }

    /// <summary>
    /// Finds an available port by letting the OS assign one.
    /// </summary>
    private int FindAvailablePort()
    {
        Socket socket = new Socket(AddressFamily.InterNetwork, SocketType.Stream, ProtocolType.Tcp);
        socket.Bind(new IPEndPoint(IPAddress.Any, 0)); // Bind to an available port assigned by the OS
        int availablePort = ((IPEndPoint)socket.LocalEndPoint).Port; // Get the assigned port number
        socket.Close(); // Close the socket
        return availablePort;
    }

    /// <summary>
    /// Finds the first available port in a given range.
    /// </summary>
    private int FindAvailablePortInRange(int start = 3001, int end = 3100)
    {
        for (int port = start; port <= end; port++)
        {
            if (IsPortAvailableForBind(port))
                return port;
        }
        throw new Exception($"No available ports found in the range {start}-{end}.");
    }
}
# ---------- end c_script ----------
c_script_2 = CSharpScript()  # -> out, availablePort; same code as c_script
central_mcp_server = MCPServer(Port=c_script.availablePort, Tools=team_02_definition_cluster, ServerName="Swiftlet")  # -> Compute_volume_of_cone, Compute_area_of_cone, Delete_room_02, Add_window_02; disabled
panel_2 = Panel(c_script.availablePort)  # disabled
get_tool_names = CSharpScript(x=team_02_definition_cluster)  # -> flatten(out); disabled
# ---------- get_tool_names: C# ----------
// Grasshopper Script Instance
#region Usings
using System;
using System.Linq;
using System.Collections;
using System.Collections.Generic;
using System.Drawing;

using Rhino;
using Rhino.Geometry;

using Grasshopper;
using Grasshopper.Kernel;
using Grasshopper.Kernel.Data;
using Grasshopper.Kernel.Types;
#endregion

public class Script_Instance : GH_ScriptInstance
{
    #region Notes
    /* 
      Members:
        RhinoDoc RhinoDocument
        GH_Document GrasshopperDocument
        IGH_Component Component
        int Iteration

      Methods (Virtual & overridable):
        Print(string text)
        Print(string format, params object[] args)
        Reflect(object obj)
        Reflect(object obj, string method_name)
    */
    #endregion

    private void RunScript(object x)
    {
        dynamic dynamicX = x;
        Console.Write(dynamicX.Name);
    }
}
# ---------- end get_tool_names ----------
central_mcp_server_2 = MCPServer(Port=c_script_2.availablePort, Tools=definitioncluster, ServerName="Swiftlet")  # -> Compute_total_area, Compute_room_area, Compute_free_space, Remove_furniture_piece, Add_window_01
get_tool_names_2 = CSharpScript(x=definitioncluster)  # -> flatten(out); same code as get_tool_names
panel_3 = Panel(c_script_2.availablePort)
central_decall = Data([central_mcp_server.Compute_volume_of_cone, central_mcp_server.Compute_area_of_cone, central_mcp_server.Delete_room_02, central_mcp_server.Add_window_02])  # disabled

# ---- group: 0 = 201, 1 = 202, 2 = 203
number_slider = Slider(0, range=0..2)

# ----
json_file_path = FilePath("E:\Documents\GitHub\AIA26_Studio\team_02\randomized_layouts\layout_202.json")
json_file_path_2 = FilePath("E:\Documents\GitHub\AIA26_Studio\team_02\randomized_layouts\layout_203.json")

# ---- group: Input Layout
json_file_path_3 = FilePath("E:\Documents\GitHub\AIA26_Studio\layout_input\layout_schema.json")
json2string = Python3Script(path=json_file_path_3)  # -> out, json_string
# ---------- json2string: Python ----------
import sys
import json
from pathlib import Path


def read_json_as_string(path):
    path = Path(path)

    if not path.exists():
        raise FileNotFoundError(f"File not found: {file_path}")

    with open(path, "r", encoding="utf-8") as f:
        data = json.load(f)

    # Convert JSON object back to string
    json_string = json.dumps(data)

    return json_string

json_string = read_json_as_string(path)
# ---------- end json2string ----------

# ----
central_decall_2 = Data([central_mcp_server_2.Compute_total_area, central_mcp_server_2.Compute_room_area, central_mcp_server_2.Compute_free_space, central_mcp_server_2.Remove_furniture_piece, central_mcp_server_2.Add_window_01])
clean = CleanTree(RemoveNulls=True, RemoveInvalid=True, RemoveEmpty=False, Tree=central_decall)  # disabled
panel_4 = Panel(json_file_path_3)
json_file_path_4 = FilePath("E:\Documents\GitHub\AIA26_Studio\team_02\resulting_layout\Layout-201_modified.json")
json_file_path_5 = FilePath("E:\Documents\GitHub\AIA26_Studio\team_02\resulting_layout\Layout-202_modified.json")
json_file_path_6 = FilePath("E:\Documents\GitHub\AIA26_Studio\team_02\resulting_layout\Layout-203_modified.json")
clean_2 = CleanTree(RemoveNulls=True, RemoveInvalid=True, RemoveEmpty=False, Tree=central_decall_2)

# ---- group: Output Layout
json_file_path_7 = FilePath("C:\Users\jomig\repos\AIA26_Studio\team_01\team_01_edited_layout.json")
json2string_2 = Python3Script(path=json_file_path_7)  # -> out, json_string; same code as json2string

# ----
team_02_result_cluster = Team02ResultCluster(tool_call_request=clean)  # -> tool_names_3, tool_call_success; disabled

# ----
# Tool Names from the Results Clusters
# Tool Names from the Definition Clusters
# These Two Clusters should be EXACTLY THE SAME
panel_5 = Panel(get_tool_names)  # disabled
panel_6 = Panel(team_02_result_cluster.tool_names_3)  # disabled

filter = StreamFilter(Gate=number_slider, Stream0=json_file_path_4, Stream1=json_file_path_5, Stream2=json_file_path_6)

# ---- group: Output Layout
json_file_path_8 = FilePath("E:\Documents\GitHub\AIA26_Studio\team_02\resulting_layout\resulting_layout")
json2string_3 = Python3Script(path=filter)  # -> out, json_string; same code as json2string

# ----
panel_7 = Panel(json_file_path_7)  # disabled

# ---- group: 0 = Before, 1= After
number_slider_2 = Slider(1, range=0..1)

# Visualize Layout from JSON: Before and After
number_slider_3 = Slider(0, range=0..1)

# ----
rec = DataRecorder(team_02_result_cluster.tool_call_success, DataLimit=-10, RecordData=True)  # disabled
rec_2 = DataRecorder(clean, DataLimit=-10, RecordData=True)  # disabled

# ---- group: Request Parameters
decall = DeconstructToolCall(Request=clean)  # -> Request, Tool, Arguments; disabled
rjo = ReadJSONObject(JObject=decall.Arguments)  # -> Keys, JTokens; disabled
# Debug: Check request input data
panel_8 = Panel("room_name")  # disabled
panel_9 = Panel("layout_json")  # disabled
tmatch = MatchText(Text=rjo.Keys, Pattern=panel_8, Case=True)  # disabled
tmatch_2 = MatchText(Text=rjo.Keys, Pattern=panel_9, Case=True)  # disabled
dispatch = Dispatch(List=rjo.JTokens, DispatchPattern=tmatch)  # -> ListA, ListB; disabled
dispatch_2 = Dispatch(List=rjo.JTokens, DispatchPattern=tmatch_2)  # -> ListA, ListB; disabled
panel_10 = Panel(dispatch.ListA)  # disabled
panel_11 = Panel(dispatch_2.ListA)  # disabled

# ----
response_ok = Panel(rec)  # disabled
called_tool_name = Panel(rec_2)  # disabled
filter_2 = StreamFilter(Gate=number_slider_3, Stream0=json2string.json_string, Stream1=json2string_2.json_string)
panel_12 = Panel(filter_2)  # disabled

# ---- group: Extractor Tool do map json to grasshopper data
extractor = Python3Script(json_str=filter_2)  # -> out, outline_curve, room_names, room_curves, door_names, door_curves, window_names, window_curves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; same code as extractor

# ----
number_slider_4 = Slider(0, range=0..12)

# ---- group: Polylines
srf = Surface(extractor.room_curves)
preview = CustomPreview(Geometry=srf, Material=[ColourSwatch(SwatchColor=RGB(167, 219, 44)), ColourSwatch(SwatchColor=RGB(4, 154, 184))])

# ---- group: Windows
data = Data(extractor.window_curves)
previewlw = CustomPreviewLineweights(Geometry=data, Shader=ColourSwatch(SwatchColor=RGB(56, 56, 56)), Thickness=Slider(5.4, range=0..10), Absolute=False)

# ---- group: Labels
area = Area(Geometry=srf)  # -> Area, Centroid
tag = TextTag(Location=area.Centroid, Text=extractor.room_names)

# ----
rec_3 = DataRecorder(clean_2, DataLimit=-10, RecordData=True)

# ---- group: Request Parameters
decall_2 = DeconstructToolCall(Request=clean_2)  # -> Request, Tool, Arguments
rjo_2 = ReadJSONObject(JObject=decall_2.Arguments)  # -> Keys, JTokens
# Debug: Check request input data
panel_13 = Panel("room_name")
tmatch_3 = MatchText(Text=rjo_2.Keys, Pattern=panel_13, Case=True)
tmatch_4 = MatchText(Text=rjo_2.Keys, Pattern="layout_json", Case=True)
dispatch_3 = Dispatch(List=rjo_2.JTokens, DispatchPattern=tmatch_3)  # -> ListA, ListB
dispatch_4 = Dispatch(List=rjo_2.JTokens, DispatchPattern=tmatch_4)  # -> ListA, ListB
panel_14 = Panel(dispatch_3.ListA)
panel_15 = Panel(dispatch_4.ListA)

# ----
called_tool_name_2 = Panel(rec_3)

# ----
# TEAM 02
# COMFORT RESULT CLUSTER
# Edit Tool Names to
# Match Definition Cluster
tool_names = Panel("""compute_total_area
compute_room_area
compute_free_space
remove_furniture_piece
add_window_01""")

text = Text(tool_names)

# ----
# Tool Names from the Results Clusters
# Tool Names from the Definition Clusters
# These Two Clusters should be EXACTLY THE SAME
panel_16 = Panel(get_tool_names_2)
panel_17 = Panel(text)

# ----
# Sorting Logic, Please Do Not Edit
decall_3 = DeconstructToolCall(Request=clean_2)  # -> Request, Tool, Arguments
mindex = MemberIndex(Set=tool_names, Member=decall_3.Tool)  # -> Index, Count
sift = SiftPattern(List=decall_3.Request, SiftPattern=mindex.Index)  # -> Output0, Output1, Output2, Output3, Output4

# ---- group: Get the request sent from VSC Agent
decall_4 = DeconstructToolCall(Request=sift.Output4)  # -> Request, Tool, Arguments

# ---- group: Extract the tool call parameters
gjok = GetJSONObjectKey(JObject=decall_4.Arguments, Key="layout_json")
gjok_2 = GetJSONObjectKey(JObject=decall_4.Arguments, Key="room_name")
gjok_3 = GetJSONObjectKey(JObject=decall_4.Arguments, Key="width")
rjv = ReadJSONValue(JValue=gjok)  # -> AsString, AsNumber, AsBool

# ---- group: Get a Specific Room
py3 = Python3Script(json_str=rjv.AsString, room_name=gjok_2)  # -> out, a; inputs room_name: String; same code as py3_2

# ---- group: Input Layout
json_file_path_9 = FilePath("E:\Documents\GitHub\AIA26_Studio\team_02\randomized_layouts\layout_201.json")

# ----
filter_3 = StreamFilter(Gate=number_slider, Stream0=json_file_path_9, Stream1=json_file_path, Stream2=json_file_path_2)

# ---- group: Input Layout (continued)
json2string_4 = Python3Script(path=filter_3)  # -> out, json_string; same code as json2string

# ----
parse_json_string = ParseJSONString(Text=json2string_4.json_string)
parse_json_string_2 = ParseJSONString(Text=json2string_4.json_string)
get_json_object_key = GetJSONObjectKey(JObject=parse_json_string, Key="layoutId")
read_json_value = ReadJSONValue(JValue=get_json_object_key)  # -> AsString, AsNumber, AsBool
filter_4 = StreamFilter(Gate=number_slider_2, Stream0=json2string_4.json_string, Stream1=json2string_3.json_string)
format_json_string = FormatJsonString(JSONString=filter_4)
panel_18 = Panel(format_json_string)

# ---- group: Extractor Tool do map json to grasshopper data
extractor_2 = Python3Script(json_str=filter_4)  # -> out, outline_curve, room_names, room_curves, door_names, door_curves, window_names, window_curves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; same code as extractor

# ----
area_2 = Area(Geometry=extractor_2.room_curves)  # -> Area, Centroid
area_3 = Area(Geometry=extractor_2.furniture_curves)  # -> Area, Centroid
mass_addition = MassAddition(Input=area_2.Area)  # -> Result, PartialResults
list_item = ListItem(List=extractor_2.room_names, Index=number_slider_4, Wrap=True)
list_item_2 = ListItem(List=extractor_2.room_curves, Index=number_slider_4, Wrap=True)

# ---- group: Windows
data_2 = Data(extractor_2.window_curves)
previewlw_2 = CustomPreviewLineweights(Geometry=data_2, Shader=ColourSwatch(SwatchColor=RGB(56, 56, 56)), Thickness=Slider(5.4, range=0..10), Absolute=False)

# ----
panel_19 = Panel(list_item)
curve = Curve(list_item_2)
match_text = MatchText(Text=extractor_2.room_names, Pattern="*Bed*", Case=True)
tag_2 = TextTag(Location=area_3.Centroid, Text=extractor_2.furniture_names)
area_4 = Area(Geometry=curve)  # -> Area, Centroid
panel_20 = Panel(area_4.Area)
cluster = Cluster(R=clean_2, hardcodedlayout=parse_json_string_2)  # -> text_2, R_2, text_3; disabled
boolean = Boolean(cluster.R_2)

hardcodedlayout = JToken(parse_json_string_2)
decall_5 = DeconstructToolCall(Request=sift.Output0)  # -> Request, Tool, Arguments
gjok_4 = GetJSONObjectKey(JObject=hardcodedlayout, Key="layout_json")
gjok_5 = GetJSONObjectKey(JObject=hardcodedlayout, Key="rooms")
read_json_array = ReadJSONArray(Array=gjok_5)
gjok_6 = GetJSONObjectKey(JObject=read_json_array, Key="geometry")
read_json_array_2 = ReadJSONArray(Array=gjok_6)
read_json_array_3 = ReadJSONArray(Array=read_json_array_2)
read_json_value_2 = ReadJSONValue(JValue=read_json_array_3)  # -> AsString, AsNumber, AsBool
list_item_3 = ListItem(List=read_json_value_2.AsNumber, Index=0, Wrap=True)  # -> Item, Item1
construct_point = ConstructPoint(XCoordinate=list_item_3.Item, YCoordinate=list_item_3.Item1, ZCoordinate=0)
shift_paths = ShiftPaths(Data=construct_point, Offset=-1)
polyline = PolyLine(Vertices=shift_paths, Closed=False)
area_5 = Area(Geometry=polyline)  # -> Area, Centroid
mass_addition_2 = MassAddition(Input=flatten(area_5.Area))  # -> Result, PartialResults
cjv = CreateJSONValue(Value=mass_addition_2.Result)
cjo = CreateJSONObject(Keys="area", Values=cjv)
respond = MCPToolResponse(Request=decall_5.Request, Content=cjo, IsError=False)

decall_6 = DeconstructToolCall(Request=sift.Output1)  # -> Request, Tool, Arguments
gjok_7 = GetJSONObjectKey(JObject=hardcodedlayout, Key="layout_json")
gjok_8 = GetJSONObjectKey(JObject=hardcodedlayout, Key="rooms")
gjok_9 = GetJSONObjectKey(JObject=decall_6.Arguments, Key="room_name")
read_json_array_4 = ReadJSONArray(Array=gjok_8)
gjok_10 = GetJSONObjectKey(JObject=read_json_array_4, Key="name")
read_json_value_3 = ReadJSONValue(JValue=gjok_9)  # -> AsString, AsNumber, AsBool
read_json_value_4 = ReadJSONValue(JValue=gjok_10)  # -> AsString, AsNumber, AsBool
match_text_2 = MatchText(Text=read_json_value_4.AsString, Pattern=read_json_value_3.AsString, Case="False")
panel_21 = Panel(match_text_2)
computeroomarea = ComputeRoomArea(jo=read_json_array_4, cull_pattern=match_text_2)
number = Number(computeroomarea)
cjv_2 = CreateJSONValue(Value=number)
cjo_2 = CreateJSONObject(Keys="area", Values=cjv_2)
panel_22 = Panel(cjo_2)
respond_2 = MCPToolResponse(Request=decall_6.Request, Content=cjo_2, IsError=False)

layoutname = Text(read_json_value.AsString)

# ---- group: Polylines
swatch = ColourSwatch(SwatchColor=RGB(167, 219, 44))
swatch_2 = ColourSwatch(SwatchColor=RGB(4, 154, 184))
srf_2 = Surface(extractor_2.room_curves)

# ---- group: Labels
area_6 = Area(Geometry=srf_2)  # -> Area, Centroid
tag_3 = TextTag(Location=area_6.Centroid, Text=extractor_2.room_names)

# ----
python_3_script = Python3Script(indices=match_text, x=swatch, y=swatch_2)  # -> out, a; inputs indices: list, x: Color, y: Color
# ---------- python_3_script: Python ----------
L = []

for i in indices:
    if i == 0:
        L.append(x)
    else:
        L.append(y)

a = L
# ---------- end python_3_script ----------
panel_23 = Panel(swatch)

# ---- group: Polylines (continued)
preview_2 = CustomPreview(Geometry=srf_2, Material=python_3_script.a)

# ----
# Debug Tool Names
# This Panel should always be TRUE
tool_names_from_the_results_clusters = Data(panel_6)  # disabled
tool_names_from_the_definition_clusters = Data(panel_5)  # disabled
join = TextJoin(Text=flatten(tool_names_from_the_definition_clusters))  # disabled
join_2 = TextJoin(Text=flatten(tool_names_from_the_results_clusters))  # disabled
tstat = TreeStatistics(Tree=tool_names_from_the_definition_clusters)  # -> Paths, Length, Count; disabled
tstat_2 = TreeStatistics(Tree=tool_names_from_the_results_clusters)  # -> Paths, Length, Count; disabled
dpath = DeconstructPath(Branch=tstat.Paths)  # disabled
dpath_2 = DeconstructPath(Branch=tstat_2.Paths)  # disabled
equals = Equality(FirstNumber=tstat.Length, SecondNumber=tstat_2.Length)  # -> Equality, Inequality; disabled
equals_2 = Equality(FirstNumber=tstat.Count, SecondNumber=tstat_2.Count)  # -> Equality, Inequality; disabled
ma = MassAddition(Input=flatten(equals.Equality))  # -> Result, PartialResults; disabled
equals_3 = Equality(FirstNumber=dpath, SecondNumber=dpath_2)  # -> Equality, Inequality; disabled
lng = ListLength(List=equals.Equality)  # disabled
ma_2 = MassAddition(Input=flatten(equals_3.Inequality))  # -> Result, PartialResults; disabled
equals_4 = Equality(FirstNumber=ma.Result, SecondNumber=lng)  # -> Equality, Inequality; disabled
does_quantity_of_tools_match = Panel(equals_2.Equality)  # disabled
panel_24 = Panel("0")  # disabled
equals_5 = Equality(FirstNumber=ma_2.Result, SecondNumber=panel_24)  # -> Equality, Inequality; disabled
does_quantity_of_tools_match_per_team = Panel(equals_4.Equality)  # disabled
are_all_teams_included = Panel(equals_5.Equality)  # disabled

tmatch_5 = MatchText(Text=join, Pattern=join_2, Case=True)  # disabled

do_all_names_match = Panel(tmatch_5)  # disabled
and = GateAnd(A=equals_5.Equality, B=equals_4.Equality, C=equals_2.Equality, D=tmatch_5)  # -> flatten(Result); disabled
do_trees_match = Panel(and)  # disabled

# ----
# Debug Tool Names
# This Panel should always be TRUE
tool_names_from_the_results_clusters_2 = Data(panel_17)
tool_names_from_the_definition_clusters_2 = Data(panel_16)
join_3 = TextJoin(Text=flatten(tool_names_from_the_definition_clusters_2))
join_4 = TextJoin(Text=flatten(tool_names_from_the_results_clusters_2))
tstat_3 = TreeStatistics(Tree=tool_names_from_the_definition_clusters_2)  # -> Paths, Length, Count
tstat_4 = TreeStatistics(Tree=tool_names_from_the_results_clusters_2)  # -> Paths, Length, Count
dpath_3 = DeconstructPath(Branch=tstat_3.Paths)
dpath_4 = DeconstructPath(Branch=tstat_4.Paths)
equals_6 = Equality(FirstNumber=tstat_3.Length, SecondNumber=tstat_4.Length)  # -> Equality, Inequality
equals_7 = Equality(FirstNumber=tstat_3.Count, SecondNumber=tstat_4.Count)  # -> Equality, Inequality
ma_3 = MassAddition(Input=flatten(equals_6.Equality))  # -> Result, PartialResults
equals_8 = Equality(FirstNumber=dpath_3, SecondNumber=dpath_4)  # -> Equality, Inequality
lng_2 = ListLength(List=equals_6.Equality)
ma_4 = MassAddition(Input=flatten(equals_8.Inequality))  # -> Result, PartialResults
equals_9 = Equality(FirstNumber=ma_3.Result, SecondNumber=lng_2)  # -> Equality, Inequality
does_quantity_of_tools_match_2 = Panel(equals_7.Equality)
equals_10 = Equality(FirstNumber=ma_4.Result, SecondNumber="0")  # -> Equality, Inequality
does_quantity_of_tools_match_per_team_2 = Panel(equals_9.Equality)
are_all_teams_included_2 = Panel(equals_10.Equality)

tmatch_6 = MatchText(Text=join_3, Pattern=join_4, Case=True)

do_all_names_match_2 = Panel(tmatch_6)
and_2 = GateAnd(A=equals_10.Equality, B=equals_9.Equality, C=equals_7.Equality, D=tmatch_6)  # -> flatten(Result)
do_trees_match_2 = Panel(and_2)

decall_7 = DeconstructToolCall(Request=sift.Output2)  # -> Request, Tool, Arguments
gjok_11 = GetJSONObjectKey(JObject=hardcodedlayout, Key="layout_json")
gjok_12 = GetJSONObjectKey(JObject=hardcodedlayout, Key="rooms")
rjv_2 = ReadJSONValue(JValue=gjok_11)  # -> AsString, AsNumber, AsBool
read_json_array_5 = ReadJSONArray(Array=gjok_12)
gjok_13 = GetJSONObjectKey(JObject=hardcodedlayout, Key="furniture")
read_json_array_6 = ReadJSONArray(Array=gjok_13)
separate_json_tokens = SeparateJSONTokens(JTokens=read_json_array_6)  # -> JObjects, JArrays, JValues
read_json_object = ReadJSONObject(JObject=separate_json_tokens.JObjects)  # -> Keys, JTokens
gjok_14 = GetJSONObjectKey(JObject=separate_json_tokens.JObjects, Key="geometry")
read_json_array_7 = ReadJSONArray(Array=gjok_14)
read_json_array_8 = ReadJSONArray(Array=read_json_array_7)
read_json_value_5 = ReadJSONValue(JValue=read_json_array_8)  # -> AsString, AsNumber, AsBool
list_item_4 = ListItem(List=read_json_value_5.AsNumber, Index=0, Wrap=True)  # -> Item, Item1
construct_point_2 = ConstructPoint(XCoordinate=list_item_4.Item, YCoordinate=list_item_4.Item1, ZCoordinate=0)
panel_25 = Panel(read_json_array_8)
shift_paths_2 = ShiftPaths(Data=construct_point_2, Offset=-1)
polyline_2 = PolyLine(Vertices=shift_paths_2, Closed=False)
area_7 = Area(Geometry=polyline_2)  # -> Area, Centroid
mass_addition_3 = MassAddition(Input=flatten(area_7.Area))  # -> Result, PartialResults

gjok_15 = GetJSONObjectKey(JObject=decall_7.Arguments, Key="room_name")
null_item = NullItem(Item=gjok_15)  # -> NullFlags, InvalidFlags, Description
read_json_value_6 = ReadJSONValue(JValue=gjok_15)  # -> AsString, AsNumber, AsBool
gjok_16 = GetJSONObjectKey(JObject=read_json_array_5, Key="name")
read_json_value_7 = ReadJSONValue(JValue=gjok_16)  # -> AsString, AsNumber, AsBool
match_text_3 = MatchText(Text=read_json_value_7.AsString, Pattern=read_json_value_6.AsString, Case="False")
stream_filter = StreamFilter(Gate=null_item.NullFlags, Stream0=match_text_3, Stream1="True")
cull_pattern = CullPattern(List=flatten(area_7.Area), CullPattern=match_text_3)
stream_filter_2 = StreamFilter(Gate=null_item.NullFlags, Stream0=cull_pattern, Stream1=mass_addition_3.Result)

computeroomarea_2 = ComputeRoomArea(jo=read_json_array_5, cull_pattern=stream_filter)
mass_addition_4 = MassAddition(Input=flatten(computeroomarea_2))  # -> Result, PartialResults
subtraction = Subtraction(A=mass_addition_4.Result, B=stream_filter_2)
cjv_3 = CreateJSONValue(Value=subtraction)
cjo_3 = CreateJSONObject(Keys="free_area", Values=cjv_3)
respond_3 = MCPToolResponse(Request=decall_7.Request, Content=cjo_3, IsError=False)

decall_8 = DeconstructToolCall(Request=sift.Output3)  # -> Request, Tool, Arguments
gjok_17 = GetJSONObjectKey(JObject=hardcodedlayout, Key="furniture")
read_json_array_9 = ReadJSONArray(Array=gjok_17)
separate_json_tokens_2 = SeparateJSONTokens(JTokens=read_json_array_9)  # -> JObjects, JArrays, JValues
read_json_object_2 = ReadJSONObject(JObject=separate_json_tokens_2.JObjects)  # -> Keys, JTokens
rjv_3 = ReadJSONValue(JValue=hardcodedlayout)  # -> AsString, AsNumber, AsBool
gjok_18 = GetJSONObjectKey(JObject=separate_json_tokens_2.JObjects, Key="name")

gjok_19 = GetJSONObjectKey(JObject=decall_8.Arguments, Key="furniture_name")
panel_26 = Panel(gjok_19)

# ---- group: Delete Furniture by name
py3_2 = Python3Script(json_str=rjv_3.AsString, furniture_name=gjok_19)  # -> out, a; inputs furniture_name: String
# ---------- py3_2: Python ----------
import json
import copy

# Inputs:
# json_str -> JSON as string
# furniture_name -> e.g. "Master Bed"

def load_json_from_string(json_string):
    try:
        data = json.loads(json_string)
    except Exception as e:
        raise ValueError(f"Invalid JSON string: {e}")
    return data

# Load JSON
data = load_json_from_string(json_str)

# Work on a copy
filtered = copy.deepcopy(data)

# ------------------------
# 1. Find furniture IDs to remove
# ------------------------
ids_to_remove = set()

for furniture in filtered.get("furniture", []):
    if furniture.get("name") == furniture_name:
        ids_to_remove.add(furniture.get("id"))

# ------------------------
# 2. Remove from furniture
# ------------------------
filtered["furniture"] = [
    f for f in filtered.get("furniture", [])
    if f.get("id") not in ids_to_remove
]

# ------------------------
# Output ONLY as string
# ------------------------
a = json.dumps(filtered, indent=2)
# ---------- end py3_2 ----------

# ----
panel_27 = Panel(py3_2.a)

pjs = ParseJSONString(Text=py3_2.a)
respond_4 = MCPToolResponse(Request=decall_8.Request, Content=pjs, IsError=False)

stringify_json_token = StringifyJSONToken(JToken=pjs)
python_3_script_2 = Python3Script(
    json_input=stringify_json_token,
    folder_path="E:\Documents\GitHub\AIA26_Studio\team_02\resulting_layout",
    layout_name=layoutname)  # -> out, a; inputs folder_path: String, layout_name: String
# ---------- python_3_script_2: Python ----------
import json

# JSON string from Grasshopper
json_string = json_input  

filename = str(layout_name) + "_modified.json"

# Combine with folder path
import os
full_path = os.path.join(folder_path, filename)

# Write the file
with open(full_path, 'w') as f:
    f.write(json_string)

out = print("Saved to: " + full_path)
# ---------- end python_3_script_2 ----------

rjv_4 = ReadJSONValue(JValue=gjok_3)  # -> AsString, AsNumber, AsBool
division = Division(A=rjv_4.AsNumber, B="2")

# ---- group: Design Logic to Add a Window
room_polyline = Data(py3.a)
debrep = DeconstructBrep(Brep=room_polyline)  # -> Faces, Edges, Vertices
item = ListItem(List=debrep.Edges, Index=0, Wrap=True)
midpt = CurveMiddle(Curve=item)
X = UnitX(Factor=division)
move = Move(Geometry=midpt, Motion=expr("-x", X))  # -> Geometry, Transform
move_2 = Move(Geometry=midpt, Motion=X)  # -> Geometry, Transform
merge = Merge(Data1=move_2.Geometry, Data2=move.Geometry)

# ---- group: Creates a Window Object
txt = Text(merge)
window_object = Python3Script(element_id="window-1", name="South Window", geometry=txt)  # -> out, window_obj; inputs element_id: String, geometry: list; same code as window_object

# ---- group: Merge it to the original layout json
py3_3 = Python3Script(json_str=rjv.AsString, new_object=window_object.window_obj)  # -> out, updated_layout; same code as py3_3

# ----
pjs_2 = ParseJSONString(Text=py3_3.updated_layout)
respond_5 = MCPToolResponse(Request=decall_4.Request, Content=pjs_2, IsError=False)

or = GateOr(A=respond, B=respond_2, C=respond_3, E=respond_4, D=respond_5)
rec_4 = DataRecorder(or, DataLimit=-10, RecordData=True)
response_ok_2 = Panel(rec_4)

# ==== cluster Team02DefinitionCluster
# Team 02 Definition Cluster
# CONE TEAM
panel = Panel("This tool computes the volume of a cone by giving it a radius and height.  The output unit is the input unit cubed.")
panel_2 = Panel("This tool computes the area of a cone by giving it a radius and height.  The output unit is the input unit squared.")
panel_3 = Panel("This tool deletes a room by giving it a room name and the layout json")
panel_4 = Panel("This tool deletes a room by giving it a room name and the layout json")
param = DefineToolParameter(Name="room_name", Type="string", Description="the name of the room", Required=Toggle(True))
param_2 = DefineToolParameter(Name="height", Type="number", Description="The Height of a Cone", Required=Toggle(True))
param_3 = DefineToolParameter(Name="radius", Type="number", Description="The Radius of a Cone", Required=Toggle(True))
param_4 = DefineToolParameter(Name="layout_json", Type="string", Description="the layout data structure", Required=Toggle(True))
param_5 = DefineToolParameter(Name="room_name", Type="string", Description="the name of the room", Required=Toggle(True))
param_6 = DefineToolParameter(Name="height", Type="number", Description="The Height of a Cone", Required=Toggle(True))
param_7 = DefineToolParameter(Name="radius", Type="number", Description="The Radius of a Cone", Required=Toggle(True))
param_8 = DefineToolParameter(Name="width", Type="number", Description="The width of the window", Required=Toggle(True))
param_9 = DefineToolParameter(Name="layout_json", Type="string", Description="the layout data structure", Required=Toggle(True))
merge = Merge(Data1=param_3, Data2=param_2)
merge_2 = Merge(Data1=param_7, Data2=param_6)
merge_3 = Merge(Data1=param, Data2=param_4)
merge_4 = Merge(Data1=param_5, Data2=param_8, Data3=param_9)
tool = DefineTool(Name="delete_room_02", Description=panel_3, Parameters=merge_3)
tool_2 = DefineTool(Name="add_window_02", Description=panel_4, Parameters=merge_4)
tool_3 = DefineTool(Name="compute_volume_of_cone", Description=panel, Parameters=merge)
tool_4 = DefineTool(Name="compute_area_of_cone", Description=panel_2, Parameters=merge_2)
merge_5 = Merge(Data1=tool_3, Data2=tool_4, Data3=tool, Data4=tool_2)
R = ClusterOutput(merge_5)

# ==== cluster Team02ResultCluster

# ----
# Team 02 Result Cluster
# CONE TEAM
# Edit Tool Names to
# Match Definition Cluster
tool_names = Panel("""compute_volume_of_cone
compute_area_of_cone
delete_room_02
add_window_02""")

# ----
# Sorting Logic, Please Do Not Edit
tool_call_request = ClusterInput()
tool_names_2 = Text(tool_names)
decall = DeconstructToolCall(Request=tool_call_request)  # -> Request, Tool, Arguments
mindex = MemberIndex(Set=tool_names, Member=decall.Tool)  # -> Index, Count
sift = SiftPattern(List=decall.Request, SiftPattern=mindex.Index)  # -> Output0, Output1, Output2, Output3

# ---- group: Cluster Output
tool_names_3 = ClusterOutput(tool_names_2)

# ---- group: Get the request sent from VSC Agent
decall_2 = DeconstructToolCall(Request=sift.Output3)  # -> Request, Tool, Arguments

# ----
decall_3 = DeconstructToolCall(Request=sift.Output0)  # -> Request, Tool, Arguments
decall_4 = DeconstructToolCall(Request=sift.Output1)  # -> Request, Tool, Arguments
decall_5 = DeconstructToolCall(Request=sift.Output2)  # -> Request, Tool, Arguments
gjok = GetJSONObjectKey(JObject=decall_3.Arguments, Key="height")
gjok_2 = GetJSONObjectKey(JObject=decall_4.Arguments, Key="height")
gjok_3 = GetJSONObjectKey(JObject=decall_3.Arguments, Key="radius")
gjok_4 = GetJSONObjectKey(JObject=decall_4.Arguments, Key="radius")

# ---- group: Extract the tool call parameters
gjok_5 = GetJSONObjectKey(JObject=decall_2.Arguments, Key="layout_json")
gjok_6 = GetJSONObjectKey(JObject=decall_2.Arguments, Key="room_name")
gjok_7 = GetJSONObjectKey(JObject=decall_2.Arguments, Key="width")
rjv = ReadJSONValue(JValue=gjok_5)  # -> AsString, AsNumber, AsBool

# ----
rjv_2 = ReadJSONValue(JValue=gjok)  # -> AsString, AsNumber, AsBool
rjv_3 = ReadJSONValue(JValue=gjok_2)  # -> AsString, AsNumber, AsBool
rjv_4 = ReadJSONValue(JValue=gjok_3)  # -> AsString, AsNumber, AsBool
rjv_5 = ReadJSONValue(JValue=gjok_4)  # -> AsString, AsNumber, AsBool
gjok_8 = GetJSONObjectKey(JObject=decall_5.Arguments, Key="layout_json")
gjok_9 = GetJSONObjectKey(JObject=decall_5.Arguments, Key="room_name")
cone = Cone(Base=PlaneXY(0, 0, 0), Radius=rjv_4.AsNumber, Length=rjv_2.AsNumber)  # -> Cone, Tip
cone_2 = Cone(Base=PlaneXY(0, 0, 0), Radius=rjv_5.AsNumber, Length=rjv_3.AsNumber)  # -> Cone, Tip
rjv_6 = ReadJSONValue(JValue=gjok_8)  # -> AsString, AsNumber, AsBool
rjv_7 = ReadJSONValue(JValue=gjok_7)  # -> AsString, AsNumber, AsBool
cap = CapHoles(Brep=cone.Cone)
cap_2 = CapHoles(Brep=cone_2.Cone)

# ---- group: Delete a Space by name
py3 = Python3Script(json_str=rjv_6.AsString, room_name=gjok_9)  # -> out, a; inputs room_name: String
# ---------- py3: Python ----------
import json
import copy

# Inputs:
# json_str -> JSON as string
# room_name -> e.g. "Kitchen"

def load_json_from_string(json_string):
    try:
        data = json.loads(json_string)
    except Exception as e:
        raise ValueError(f"Invalid JSON string: {e}")
    return data

# Load JSON
data = load_json_from_string(json_str)

# Work on a copy
filtered = copy.deepcopy(data)

# ------------------------
# 1. Find room IDs to remove
# ------------------------
ids_to_remove = set()

for room in filtered.get("rooms", []):
    if room.get("name") == room_name:
        ids_to_remove.add(room.get("id"))

# ------------------------
# 2. Remove from rooms
# ------------------------
filtered["rooms"] = [
    r for r in filtered.get("rooms", [])
    if r.get("id") not in ids_to_remove
]

# ------------------------
# 3. Remove / clean DOORS
# (remove doors that connect to deleted rooms)
# ------------------------
filtered["doors"] = [
    d for d in filtered.get("doors", [])
    if not any(rid in ids_to_remove for rid in d.get("attributes", {}).get("connectsRooms", []))
]

# ------------------------
# 4. Remove WINDOWS linked to deleted rooms
# ------------------------
filtered["windows"] = [
    w for w in filtered.get("windows", [])
    if w.get("attributes", {}).get("roomId") not in ids_to_remove
]

# ------------------------
# 5. Remove FURNITURE linked to deleted rooms
# ------------------------
filtered["furniture"] = [
    f for f in filtered.get("furniture", [])
    if f.get("attributes", {}).get("roomId") not in ids_to_remove
]

# ------------------------
# 6. (Optional) MEP cleanup
# (only if tied to rooms — currently not in your schema)
# ------------------------
# Keeping all MEP elements for now

# ------------------------
# 7. STRUCTURE
# (typically global, so we keep it)
# ------------------------

# ------------------------
# Output ONLY as string
# ------------------------
a = json.dumps(filtered, indent=2)
# ---------- end py3 ----------

# ---- group: Get a Specific Room
py3_2 = Python3Script(json_str=rjv.AsString, room_name=gjok_6)  # -> out, a; inputs room_name: String
# ---------- py3_2: Python ----------
import json
import Rhino.Geometry as rg

# Inputs:
# json_str -> JSON as string
# room_name -> e.g. "Living Room"

def load_json_from_string(json_string):
    try:
        data = json.loads(json_string)
    except Exception as e:
        raise ValueError(f"Invalid JSON string: {e}")
    return data

def create_polyline(points):
    pts = [rg.Point3d(x, y, 0) for x, y in points]

    # Ensure closed
    if pts[0] != pts[-1]:
        pts.append(pts[0])

    return rg.Polyline(pts).ToPolylineCurve()

# Load JSON
data = load_json_from_string(json_str)

# Find the room
room_curve = None

for room in data.get("rooms", []):
    if room.get("name") == room_name:
        geometry = room.get("geometry")
        if geometry:
            room_curve = create_polyline(geometry)
        break

# Output ONLY the polyline
a = room_curve
# ---------- end py3_2 ----------

# ----
volume = Volume(Geometry=cap)  # -> Volume, Centroid
area = Area(Geometry=cap_2)  # -> Area, Centroid
pjs = ParseJSONString(Text=py3.a)
panel = Panel(volume.Volume)
panel_2 = Panel(area.Area)
division = Division(A=rjv_7.AsNumber, B="2")

# ---- group: Design Logic to Add a Window
room_polyline = Data(py3_2.a)
debrep = DeconstructBrep(Brep=room_polyline)  # -> Faces, Edges, Vertices
item = ListItem(List=debrep.Edges, Index=0, Wrap=True)
midpt = CurveMiddle(Curve=item)
X = UnitX(Factor=division)
move = Move(Geometry=midpt, Motion=expr("-x", X))  # -> Geometry, Transform
move_2 = Move(Geometry=midpt, Motion=X)  # -> Geometry, Transform
merge = Merge(Data1=move_2.Geometry, Data2=move.Geometry)

# ----
cjv = CreateJSONValue(Value=panel)
cjv_2 = CreateJSONValue(Value=panel_2)
respond = MCPToolResponse(Request=decall_5.Request, Content=pjs, IsError=False)
cjo = CreateJSONObject(Keys="volume", Values=cjv)
cjo_2 = CreateJSONObject(Keys="area", Values=cjv_2)
respond_2 = MCPToolResponse(Request=decall_3.Request, Content=cjo, IsError=False)
respond_3 = MCPToolResponse(Request=decall_4.Request, Content=cjo_2, IsError=False)

# ---- group: Creates a Window Object
txt = Text(merge)
window_object = Python3Script(element_id="window-2", name="South Window", geometry=txt)  # -> out, window_obj; inputs element_id: String, geometry: list
# ---------- window_object: Python ----------
import json

def parse_point_string(pt_str):
    """
    Converts '{3.5, 0, 0}' -> [3.5, 0.0]
    """
    # Remove braces and spaces
    cleaned = pt_str.strip().replace("{", "").replace("}", "")
    
    # Split into components
    parts = cleaned.split(",")
    
    if len(parts) < 2:
        raise ValueError(f"Invalid point format: {pt_str}")
    
    x = float(parts[0])
    y = float(parts[1])
    
    return [x, y]

def serialize_geometry(geometry_list):
    """
    Converts list of GH strings into [[x,y], [x,y]]
    """
    return [parse_point_string(pt) for pt in geometry_list]

# ------------------------
# Convert geometry
# ------------------------
serialized_geometry = serialize_geometry(geometry)

# Build window object
window_obj = {
    "id": element_id,
    "name": name,
    "geometry": serialized_geometry
}

# Optional attributes
if attributes:
    window_obj["attributes"] = attributes

# Output ONLY as JSON string
window_obj = json.dumps(window_obj, indent=2)
# ---------- end window_object ----------

# ---- group: Merge it to the original layout json
py3_3 = Python3Script(json_str=rjv.AsString, new_object=window_object.window_obj)  # -> out, updated_layout
# ---------- py3_3: Python ----------
import json
import copy

def load_json_from_string(json_string):
    try:
        return json.loads(json_string)
    except Exception as e:
        raise ValueError(f"Invalid JSON string: {e}")

def detect_object_type(obj):
    """
    Infer target list from object id prefix.
    """
    obj_id = obj.get("id", "").lower()

    if obj_id.startswith("window"):
        return "windows"
    elif obj_id.startswith("door"):
        return "doors"
    elif obj_id.startswith("furn") or obj_id.startswith("furniture"):
        return "furniture"
    elif obj_id.startswith("mep"):
        return "mep"
    elif obj_id.startswith("wall") or obj_id.startswith("structure"):
        return "structure"
    else:
        # default fallback (safe choice)
        return "windows"

# ------------------------
# Load inputs
# ------------------------
layout = load_json_from_string(json_str)
new_object = json.loads(new_object)  # assuming object comes as JSON string

# Work on copy
updated = copy.deepcopy(layout)

# ------------------------
# Detect target category
# ------------------------
target_key = detect_object_type(new_object)

# ------------------------
# Ensure list exists
# ------------------------
if target_key not in updated:
    updated[target_key] = []

# ------------------------
# Insert object
# ------------------------
updated[target_key].append(new_object)

# ------------------------
# Output JSON string
# ------------------------
updated_layout = json.dumps(updated, indent=2)
# ---------- end py3_3 ----------

# ----
pjs_2 = ParseJSONString(Text=py3_3.updated_layout)
merge_2 = Merge(Data1=flatten(py3.a), Data2=flatten(py3_3.updated_layout))
respond_4 = MCPToolResponse(Request=decall_2.Request, Content=pjs_2, IsError=False)
or = GateOr(A=respond_2, B=respond_3, C=respond, D=respond_4)
tool_call_success = ClusterOutput(or)

# ---- group: Extractor Tool do map json to grasshopper data
extractor = Python3Script(json_str=merge_2)  # -> out, outline_curve, room_names, room_curves, door_names, door_curves, window_names, window_curves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
# ---------- extractor: Python ----------
import json
import Rhino.Geometry as rg

def load_json_from_string(json_string):
    try:
        data = json.loads(json_string)
    except Exception as e:
        raise ValueError(f"Invalid JSON string: {e}")
    return data

def create_polyline(points, close=True):
    """Create a Rhino PolylineCurve from 2D points"""
    pts = [rg.Point3d(x, y, 0) for x, y in points]

    if close and pts[0] != pts[-1]:
        pts.append(pts[0])

    return rg.Polyline(pts).ToPolylineCurve()

def create_line(points):
    """Create a Rhino LineCurve from 2 points"""
    if len(points) != 2:
        return None
    p1 = rg.Point3d(points[0][0], points[0][1], 0)
    p2 = rg.Point3d(points[1][0], points[1][1], 0)
    return rg.LineCurve(p1, p2)

# Load JSON
layout = load_json_from_string(json_str)

# ------------------------
# ROOMS (polygons)
# ------------------------
room_names = []
room_curves = []

for room in layout.get("rooms", []):
    name = room.get("name")
    geometry = room.get("geometry")

    if name and geometry:
        curve = create_polyline(geometry, close=True)
        room_names.append(name)
        room_curves.append(curve)

# ------------------------
# DOORS (lines)
# ------------------------
door_names = []
door_curves = []

for door in layout.get("doors", []):
    name = door.get("name")
    geometry = door.get("geometry")

    if name and geometry:
        curve = create_line(geometry)
        if curve:
            door_names.append(name)
            door_curves.append(curve)

# ------------------------
# WINDOWS (lines)
# ------------------------
window_names = []
window_curves = []

for window in layout.get("windows", []):
    name = window.get("name")
    geometry = window.get("geometry")

    if name and geometry:
        curve = create_line(geometry)
        if curve:
            window_names.append(name)
            window_curves.append(curve)

# ------------------------
# FURNITURE (polygons)
# ------------------------
furniture_names = []
furniture_curves = []

for furn in layout.get("furniture", []):
    name = furn.get("name")
    geometry = furn.get("geometry")

    if name and geometry:
        curve = create_polyline(geometry, close=True)
        furniture_names.append(name)
        furniture_curves.append(curve)

# ------------------------
# MEP (polygons)
# ------------------------
mep_names = []
mep_curves = []

for m in layout.get("mep", []):
    name = m.get("name")
    geometry = m.get("geometry")

    if name and geometry:
        curve = create_polyline(geometry, close=True)
        mep_names.append(name)
        mep_curves.append(curve)

# ------------------------
# STRUCTURE (lines)
# ------------------------
structure_names = []
structure_curves = []

for s in layout.get("structure", []):
    name = s.get("name")
    geometry = s.get("geometry")

    if name and geometry:
        curve = create_line(geometry)
        if curve:
            structure_names.append(name)
            structure_curves.append(curve)

# ------------------------
# OUTLINE (optional)
# ------------------------
outline_curve = None
if "outline" in layout:
    outline_curve = create_polyline(layout["outline"], close=True)

# ------------------------
# OUTPUTS
# ------------------------
a = room_names
b = room_curves

c = door_names
d = door_curves

e = window_names
f = window_curves

g = furniture_names
h = furniture_curves

i = mep_names
j = mep_curves

k = structure_names
l = structure_curves

m = outline_curve
# ---------- end extractor ----------

# ---- group: Polylines
srf = Surface(extractor.room_curves)
preview = CustomPreview(Geometry=srf, Material=[ColourSwatch(SwatchColor=RGB(167, 219, 44)), ColourSwatch(SwatchColor=RGB(4, 154, 184))])

# ---- group: Windows
data = Data(extractor.window_curves)
previewlw = CustomPreviewLineweights(Geometry=data, Shader=ColourSwatch(SwatchColor=RGB(56, 56, 56)), Thickness=Slider(5.4, range=0..10), Absolute=False)

# ---- group: Labels
area_2 = Area(Geometry=srf)  # -> Area, Centroid
tag = TextTag(Location=area_2.Centroid, Text=extractor.room_names)

# ==== cluster DefinitionCluster
panel = Panel("Given room name, layout and furniture name, removes the element from the layout.")
panel_2 = Panel("This tool adds a window by giving it a room name and the layout json")
panel_3 = Panel("Computes the area of the a room given layout and room name.")
panel_4 = Panel("To check if space is overcrowded with furniture, checks the % of free space on it based on room name and given layout.")
param = DefineToolParameter(Name="layout_json", Type="string", Description="the layout data structure", Required=Toggle(False))
param_2 = DefineToolParameter(Name="furniture_name", Type="string", Description="the name of the furniture piece", Required=Toggle(True))
param_3 = DefineToolParameter(Name="room_name", Type="string", Description="the name of the room", Required=Toggle(False))
param_4 = DefineToolParameter(Name="room_name", Type="string", Description="the name of the room", Required=Toggle(True))
param_5 = DefineToolParameter(Name="width", Type="number", Description="The width of the window", Required=Toggle(True))
param_6 = DefineToolParameter(Name="layout_json", Type="string", Description="the layout data structure", Required=Toggle(False))
param_7 = DefineToolParameter(Name="layout_json", Type="string", Description="the layout data structure", Required=Toggle(False))
param_8 = DefineToolParameter(Name="room_name", Type="string", Description="the name of the room", Required=Toggle(True))
param_9 = DefineToolParameter(Name="layout_json", Type="string", Description="the layout data structure", Required=Toggle(False))
param_10 = DefineToolParameter(Name="layout_json", Type="string", Description="the layout data structure", Required=Toggle(False))
param_11 = DefineToolParameter(Name="room_name", Type="string", Description="the name of the room", Required=Toggle(True))
merge = Merge(Data1=param_4, Data2=param_5, Data3=param_6)
merge_2 = Merge(Data1=param_3, Data2=param, Data3=param_2)
merge_3 = Merge(Data1=param_8, Data2=param_7)
merge_4 = Merge(Data1=param_10, Data2=param_11)
tool = DefineTool(Name="remove_furniture_piece", Description=panel, Parameters=param_2)
tool_2 = DefineTool(Name="compute_free_space", Description=panel_4, Parameters=merge_3)
tool_3 = DefineTool(Name="add_window_01", Description=panel_2, Parameters=merge)
tool_4 = DefineTool(Name="compute_total_area", Description="Computes the area of the full given layout.", Parameters=param_9)
tool_5 = DefineTool(Name="compute_room_area", Description=panel_3, Parameters=merge_4)
merge_5 = Merge(Data1=tool_4, Data2=tool_5, Data3=tool_2, Data4=tool, Data5=tool_3)
R = ClusterOutput(merge_5)

# ==== cluster Cluster

# ----
# TEAM 02
# COMFORT RESULT CLUSTER
# Edit Tool Names to
# Match Definition Cluster
tool_names = Panel("""compute_total_area
compute_room_area
compute_free_space
remove_furniture_piece
add_window_01""")

R = ClusterInput()
text = Text(tool_names)

# ----
# Sorting Logic, Please Do Not Edit
decall = DeconstructToolCall(Request=R)  # -> Request, Tool, Arguments
mindex = MemberIndex(Set=tool_names, Member=decall.Tool)  # -> Index, Count
sift = SiftPattern(List=decall.Request, SiftPattern=mindex.Index)  # -> Output0, Output1, Output2, Output3, Output4

text_2 = ClusterOutput(text)
hardcodedlayout = ClusterInput()

hardcodedlayout_2 = JToken(hardcodedlayout)
decall_2 = DeconstructToolCall(Request=sift.Output0)  # -> Request, Tool, Arguments
gjok = GetJSONObjectKey(JObject=hardcodedlayout_2, Key="layout_json")
gjok_2 = GetJSONObjectKey(JObject=hardcodedlayout_2, Key="rooms")
read_json_array = ReadJSONArray(Array=gjok_2)
gjok_3 = GetJSONObjectKey(JObject=read_json_array, Key="geometry")
read_json_array_2 = ReadJSONArray(Array=gjok_3)
read_json_array_3 = ReadJSONArray(Array=read_json_array_2)
read_json_value = ReadJSONValue(JValue=read_json_array_3)  # -> AsString, AsNumber, AsBool
list_item = ListItem(List=read_json_value.AsNumber, Index=0, Wrap=True)  # -> Item, Item1
construct_point = ConstructPoint(XCoordinate=list_item.Item, YCoordinate=list_item.Item1, ZCoordinate=0)
shift_paths = ShiftPaths(Data=construct_point, Offset=-1)
polyline = PolyLine(Vertices=shift_paths, Closed=False)
area = Area(Geometry=polyline)  # -> Area, Centroid
mass_addition = MassAddition(Input=flatten(area.Area))  # -> Result, PartialResults
cjv = CreateJSONValue(Value=mass_addition.Result)
cjo = CreateJSONObject(Keys="area", Values=cjv)
respond = MCPToolResponse(Request=decall_2.Request, Content=cjo, IsError=False)

decall_3 = DeconstructToolCall(Request=sift.Output1)  # -> Request, Tool, Arguments
gjok_4 = GetJSONObjectKey(JObject=hardcodedlayout_2, Key="layout_json")
gjok_5 = GetJSONObjectKey(JObject=hardcodedlayout_2, Key="rooms")
gjok_6 = GetJSONObjectKey(JObject=decall_3.Arguments, Key="room_name")
read_json_array_4 = ReadJSONArray(Array=gjok_5)
gjok_7 = GetJSONObjectKey(JObject=read_json_array_4, Key="name")
read_json_value_2 = ReadJSONValue(JValue=gjok_6)  # -> AsString, AsNumber, AsBool
read_json_value_3 = ReadJSONValue(JValue=gjok_7)  # -> AsString, AsNumber, AsBool
match_text = MatchText(Text=read_json_value_3.AsString, Pattern=read_json_value_2.AsString, Case="False")
panel = Panel(match_text)
computeroomarea = ComputeRoomArea(jo=read_json_array_4, cull_pattern=match_text)
number = Number(computeroomarea)
cjv_2 = CreateJSONValue(Value=number)
cjo_2 = CreateJSONObject(Keys="area", Values=cjv_2)
panel_2 = Panel(cjo_2)
respond_2 = MCPToolResponse(Request=decall_3.Request, Content=cjo_2, IsError=False)

# ---- group: Get the request sent from VSC Agent
decall_4 = DeconstructToolCall(Request=sift.Output4)  # -> Request, Tool, Arguments

# ---- group: Extract the tool call parameters
gjok_8 = GetJSONObjectKey(JObject=decall_4.Arguments, Key="layout_json")
gjok_9 = GetJSONObjectKey(JObject=decall_4.Arguments, Key="room_name")
gjok_10 = GetJSONObjectKey(JObject=decall_4.Arguments, Key="width")
rjv = ReadJSONValue(JValue=gjok_8)  # -> AsString, AsNumber, AsBool

# ---- group: Get a Specific Room
py3 = Python3Script(json_str=rjv.AsString, room_name=gjok_9)  # -> out, a; inputs room_name: String; same code as py3_2

# ----
decall_5 = DeconstructToolCall(Request=sift.Output2)  # -> Request, Tool, Arguments
gjok_11 = GetJSONObjectKey(JObject=hardcodedlayout_2, Key="layout_json")
gjok_12 = GetJSONObjectKey(JObject=hardcodedlayout_2, Key="rooms")
rjv_2 = ReadJSONValue(JValue=gjok_11)  # -> AsString, AsNumber, AsBool
read_json_array_5 = ReadJSONArray(Array=gjok_12)
gjok_13 = GetJSONObjectKey(JObject=hardcodedlayout_2, Key="furniture")
read_json_array_6 = ReadJSONArray(Array=gjok_13)
separate_json_tokens = SeparateJSONTokens(JTokens=read_json_array_6)  # -> JObjects, JArrays, JValues
read_json_object = ReadJSONObject(JObject=separate_json_tokens.JObjects)  # -> Keys, JTokens
gjok_14 = GetJSONObjectKey(JObject=separate_json_tokens.JObjects, Key="geometry")
read_json_array_7 = ReadJSONArray(Array=gjok_14)
read_json_array_8 = ReadJSONArray(Array=read_json_array_7)
read_json_value_4 = ReadJSONValue(JValue=read_json_array_8)  # -> AsString, AsNumber, AsBool
list_item_2 = ListItem(List=read_json_value_4.AsNumber, Index=0, Wrap=True)  # -> Item, Item1
construct_point_2 = ConstructPoint(XCoordinate=list_item_2.Item, YCoordinate=list_item_2.Item1, ZCoordinate=0)
panel_3 = Panel(read_json_array_8)
shift_paths_2 = ShiftPaths(Data=construct_point_2, Offset=-1)
polyline_2 = PolyLine(Vertices=shift_paths_2, Closed=False)
area_2 = Area(Geometry=polyline_2)  # -> Area, Centroid
mass_addition_2 = MassAddition(Input=flatten(area_2.Area))  # -> Result, PartialResults

gjok_15 = GetJSONObjectKey(JObject=decall_5.Arguments, Key="room_name")
null_item = NullItem(Item=gjok_15)  # -> NullFlags, InvalidFlags, Description
read_json_value_5 = ReadJSONValue(JValue=gjok_15)  # -> AsString, AsNumber, AsBool
gjok_16 = GetJSONObjectKey(JObject=read_json_array_5, Key="name")
read_json_value_6 = ReadJSONValue(JValue=gjok_16)  # -> AsString, AsNumber, AsBool
match_text_2 = MatchText(Text=read_json_value_6.AsString, Pattern=read_json_value_5.AsString, Case="False")
stream_filter = StreamFilter(Gate=null_item.NullFlags, Stream0=match_text_2, Stream1="True")
cull_pattern = CullPattern(List=flatten(area_2.Area), CullPattern=match_text_2)
stream_filter_2 = StreamFilter(Gate=null_item.NullFlags, Stream0=cull_pattern, Stream1=mass_addition_2.Result)

computeroomarea_2 = ComputeRoomArea(jo=read_json_array_5, cull_pattern=stream_filter)
mass_addition_3 = MassAddition(Input=flatten(computeroomarea_2))  # -> Result, PartialResults
subtraction = Subtraction(A=mass_addition_3.Result, B=stream_filter_2)
cjv_3 = CreateJSONValue(Value=subtraction)
cjo_3 = CreateJSONObject(Keys="free_area", Values=cjv_3)
respond_3 = MCPToolResponse(Request=decall_5.Request, Content=cjo_3, IsError=False)

decall_6 = DeconstructToolCall(Request=sift.Output3)  # -> Request, Tool, Arguments
gjok_17 = GetJSONObjectKey(JObject=hardcodedlayout_2, Key="furniture")
read_json_array_9 = ReadJSONArray(Array=gjok_17)
separate_json_tokens_2 = SeparateJSONTokens(JTokens=read_json_array_9)  # -> JObjects, JArrays, JValues
read_json_object_2 = ReadJSONObject(JObject=separate_json_tokens_2.JObjects)  # -> Keys, JTokens
rjv_3 = ReadJSONValue(JValue=hardcodedlayout_2)  # -> AsString, AsNumber, AsBool
gjok_18 = GetJSONObjectKey(JObject=separate_json_tokens_2.JObjects, Key="name")

gjok_19 = GetJSONObjectKey(JObject=decall_6.Arguments, Key="room_name")
gjok_20 = GetJSONObjectKey(JObject=decall_6.Arguments, Key="furniture_name")
panel_4 = Panel(gjok_20)

# ---- group: Delete Furniture by name
py3_2 = Python3Script(json_str=rjv_3.AsString, furniture_name=gjok_20)  # -> out, a; inputs furniture_name: String
# ---------- py3_2: Python ----------
import json

# Inputs in Grasshopper:
# - json_string: your JSON data as a string
# - furniture_name: name of furniture to remove (e.g., "Master Bed")

try:
    # Parse the JSON string
    data = json.loads(json_str)
    
    # Find and remove furniture with matching name
    original_count = len(data["furniture"])
    data["furniture"] = [f for f in data["furniture"] if f["name"] != furniture_name]
    removed_count = original_count - len(data["furniture"])
    
    # Convert back to JSON string
    output_json = json.dumps(data, indent=2)
    a = output_json
    
    # Print confirmation
    if removed_count > 0:
        print(f"Removed {removed_count} furniture item(s) named '{furniture_name}'")
        print(f"Remaining furniture: {len(data['furniture'])} items")
    else:
        print(f"No furniture found with name '{furniture_name}'")
    
except Exception as e:
    print(f"Error: {str(e)}")
    output_json = None
# ---------- end py3_2 ----------

# ----
panel_5 = Panel(py3_2.out)

pjs = ParseJSONString(Text=py3_2.a)
respond_4 = MCPToolResponse(Request=decall_6.Request, Content=pjs, IsError=False)

stringify_json_token = StringifyJSONToken(JToken=pjs)
text_3 = ClusterOutput(stringify_json_token)

rjv_4 = ReadJSONValue(JValue=gjok_10)  # -> AsString, AsNumber, AsBool
division = Division(A=rjv_4.AsNumber, B="2")

# ---- group: Design Logic to Add a Window
room_polyline = Data(py3.a)
debrep = DeconstructBrep(Brep=room_polyline)  # -> Faces, Edges, Vertices
item = ListItem(List=debrep.Edges, Index=0, Wrap=True)
midpt = CurveMiddle(Curve=item)
X = UnitX(Factor=division)
move = Move(Geometry=midpt, Motion=expr("-x", X))  # -> Geometry, Transform
move_2 = Move(Geometry=midpt, Motion=X)  # -> Geometry, Transform
merge = Merge(Data1=move_2.Geometry, Data2=move.Geometry)

# ---- group: Creates a Window Object
txt = Text(merge)
window_object = Python3Script(element_id="window-1", name="South Window", geometry=txt)  # -> out, window_obj; inputs element_id: String, geometry: list; same code as window_object

# ---- group: Merge it to the original layout json
py3_3 = Python3Script(json_str=rjv.AsString, new_object=window_object.window_obj)  # -> out, updated_layout; same code as py3_3

# ----
pjs_2 = ParseJSONString(Text=py3_3.updated_layout)
respond_5 = MCPToolResponse(Request=decall_4.Request, Content=pjs_2, IsError=False)

or = GateOr(A=respond, B=respond_2, C=respond_3, E=respond_4, D=respond_5)
R_2 = ClusterOutput(or)

# ==== cluster ComputeRoomArea
jo = ClusterInput()
cull_pattern = ClusterInput()
gjok = GetJSONObjectKey(JObject=jo, Key="geometry")
cull_pattern_2 = CullPattern(List=gjok, CullPattern=cull_pattern)
read_json_array = ReadJSONArray(Array=cull_pattern_2)
read_json_array_2 = ReadJSONArray(Array=read_json_array)
read_json_value = ReadJSONValue(JValue=read_json_array_2)  # -> AsString, AsNumber, AsBool
list_item = ListItem(List=read_json_value.AsNumber, Index=0, Wrap=True)  # -> Item, Item1
construct_point = ConstructPoint(XCoordinate=list_item.Item, YCoordinate=list_item.Item1, ZCoordinate=0)
shift_paths = ShiftPaths(Data=construct_point, Offset=-1)
polyline = PolyLine(Vertices=shift_paths, Closed=False)
area = Area(Geometry=polyline)  # -> Area, Centroid
area_2 = ClusterOutput(area.Area)
