# Grasshopper definition team_01_working.gh (Grasshopper 1.0.8)
# plug-ins: Swiftlet

# ----
# Connect MCP Tools to Decall and Update All Clusters
button = Button()
connect_mcp_tools_to_decall = CSharpScript(nickname_From="Central MCP Server", nickname_To="Central DeCall", connect=button)  # -> out; inputs nickname_From: String, nickname_To: String, connect: Boolean
# ---------- connect_mcp_tools_to_decall: C# ----------
using System;
using System.Linq;
using Grasshopper;
using Grasshopper.Kernel;

public class Script_Instance : GH_ScriptInstance
{
    private void RunScript(string nickname_From, string nickname_To, bool connect)
    {
        if (!connect) return;
        Console.Write($"Attempting to connect outputs from '{nickname_From}' to '{nickname_To}'...");

        var ghDoc = Instances.ActiveCanvas?.Document;
        if (ghDoc == null) return;

        var compFrom = ghDoc.Objects
            .OfType<IGH_Component>()
            .FirstOrDefault(o => o.NickName == nickname_From);

        var compTo = ghDoc.Objects
            .OfType<IGH_Param>()
            .FirstOrDefault(o => o.NickName == nickname_To);

        if (compFrom != null && compTo != null)
        {
            ghDoc.ScheduleSolution(5, doc => Connect(doc, compFrom, compTo));
        }
    }

    // <Custom additional code> 
    private void Connect(GH_Document doc, IGH_Component compFrom, IGH_Param compTo)
    {
        if (compFrom == null || compTo == null) return;

        foreach (IGH_Param param in compFrom.Params.Output)
        {
            compTo.AddSource(param);
        }
    }
}
# ---------- end connect_mcp_tools_to_decall ----------
update_all_clusters = CSharpScript(update=button, recursive=Toggle(True))  # -> out, A; inputs update: Boolean, recursive: Boolean, passwords: list of String, localPath: String
# ---------- update_all_clusters: C# ----------
using System;
using System.Collections;
using System.Collections.Generic;

using Rhino;
using Rhino.Geometry;

using Grasshopper;
using Grasshopper.Kernel;
using Grasshopper.Kernel.Data;
using Grasshopper.Kernel.Types;
using System.Windows.Forms;
using System.Linq;
/// <summary>
/// This class will be instantiated on demand by the Script component.
/// </summary>
public class Script_Instance : GH_ScriptInstance
{
  /// <summary>Print a String to the [Out] Parameter of the Script component.</summary>
  /// <param name="text">String to print.</param>
  private void Print(string text) { /* Implementation hidden. */ }
  /// <summary>Print a formatted String to the [Out] Parameter of the Script component.</summary>
  /// <param name="format">String format.</param>
  /// <param name="args">Formatting parameters.</param>
  private void Print(string format, params object[] args) { /* Implementation hidden. */ }
  /// <summary>Print useful information about an object instance to the [Out] Parameter of the Script component. </summary>
  /// <param name="obj">Object instance to parse.</param>
  private void Reflect(object obj) { /* Implementation hidden. */ }
  /// <summary>Print the signatures of all the overloads of a specific method to the [Out] Parameter of the Script component. </summary>
  /// <param name="obj">Object instance to parse.</param>
  private void Reflect(object obj, string method_name) { /* Implementation hidden. */ }

  /// <summary>Gets the current Rhino document.</summary>
  private readonly RhinoDoc RhinoDocument;
  /// <summary>Gets the Grasshopper document that owns this script.</summary>
  private readonly GH_Document GrasshopperDocument;
  /// <summary>Gets the Grasshopper script component that owns this script.</summary>
  private readonly IGH_Component Component;
  /// <summary>
  /// Gets the current iteration count. The first call to RunScript() is associated with Iteration==0.
  /// Any subsequent call within the same solution will increment the Iteration count.
  /// </summary>
  private readonly int Iteration;

  /// <summary>
  /// This procedure contains the user code. Input parameters are provided as regular arguments,
  /// Output parameters as ref arguments. You don't have to assign output parameters,
  /// they will have a default value.
  /// </summary>
  private void RunScript(
		bool update,
		bool recursive,
		List<string> passwords,
		string localPath,
		ref object A)
  {

    A = updateLog;
    if (update)
    {
      updateLog = new List<string>();
      _passwords = passwords;
      UpdateClusters(GrasshopperDocument, recursive, localPath);
    }

  }

  // <Custom additional code> 
  List<string> updateLog;
  List<String> _passwords;

  void UpdateClusters (GH_Document ghDoc, bool recursive, string localPath)
  {
    foreach (var obj in ghDoc.Objects)
    {
      var cluster = obj as Grasshopper.Kernel.Special.GH_Cluster;
      if (cluster != null)
      {
        var clusterPath = cluster.FilePath;
        if (!string.IsNullOrEmpty(clusterPath))
        {
          if (cluster.Synchronisation == Grasshopper.Kernel.Special.GH_Synchronisation.OutOfDate)
          {
            cluster.CreateFromFilePath(clusterPath);
            updateLog.Add("Updated: " + clusterPath);
          }
          else if (cluster.Synchronisation == Grasshopper.Kernel.Special.GH_Synchronisation.MissingReference)
          {
            string newPath = ReplacePath(localPath, clusterPath);
            if (!string.IsNullOrEmpty(newPath))
            {
              cluster.CreateFromFilePath(newPath);
              updateLog.Add("Replaced and updated: " + newPath);
            }
            else
            {
              updateLog.Add("Missing reference: " + clusterPath);
            }

          }
        }

        //Update recursively
        if (recursive)
        {
          GH_Document clusterDoc = GetClusterDoc(cluster);
          if (clusterDoc != null)
            UpdateClusters(clusterDoc, recursive, localPath);
        }
      }
    }
  }

  GH_Document GetClusterDoc(Grasshopper.Kernel.Special.GH_Cluster cluster)
  {
    //no pass needed
    var doc = cluster.Document(string.Empty);
    if (doc != null)
      return doc;

    //try passwords
    if (_passwords != null && _passwords.Any())
    {
      foreach (var pass in _passwords)
      {
        doc = cluster.Document(pass);
        if (doc != null)
          return doc;
      }
    }

    return null;
  }

  string ReplacePath(string localPath, string missingPath)
  {
    if (String.IsNullOrEmpty(missingPath) || string.IsNullOrEmpty(localPath))
      return null;
    else
    {
      string lastLocalPart = localPath.Split('\\').Last();
      string[] parts = missingPath.Split('\\');
      if (parts.Contains(lastLocalPart))
      {
        int i = Array.IndexOf(parts, lastLocalPart);
        string clusterPath = String.Join("\\", parts.Skip(i + 1));
        string result = String.Join("\\", localPath, clusterPath);
        return result;
      }
      else
        return null;
    }
  }
  // </Custom additional code> 
}
# ---------- end update_all_clusters ----------
panel = Panel(connect_mcp_tools_to_decall)

c_script = CSharpScript()  # -> out, availablePort
# ---------- c_script: C# ----------
// Grasshopper Script Instance
// This script finds an available port on the local machine.
#region Usings
using System;
using System.Linq;
using System.Collections;
using System.Collections.Generic;
using System.Drawing;
using System.Net;
using System.Net.Sockets;

using Rhino;
using Rhino.Geometry;

using Grasshopper;
using Grasshopper.Kernel;
using Grasshopper.Kernel.Data;
using Grasshopper.Kernel.Types;
#endregion

public class Script_Instance : GH_ScriptInstance
{
    #region Notes
    /* 
      Members:
        RhinoDoc RhinoDocument
        GH_Document GrasshopperDocument
        IGH_Component Component
        int Iteration

      Methods (Virtual & overridable):
        Print(string text)
        Print(string format, params object[] args)
        Reflect(object obj)
        Reflect(object obj, string method_name)
    */
    #endregion

    private void RunScript(object start, object end, ref object availablePort)
    {
        // Use default values if parameters are not provided
        int startPort = (start != null && int.TryParse(start.ToString(), out int s)) ? s : 3001;
        int endPort = (end != null && int.TryParse(end.ToString(), out int e)) ? e : 3100;

        // Find an available port in the specified range
        try
        {
            availablePort = FindAvailablePortInRange(startPort, endPort);
            Print($"Available port found: {availablePort}");
        }
        catch (Exception ex)
        {
            Print($"Error: {ex.Message}");
            availablePort = null;
        }
    }

    /// <summary>
    /// Checks if a local TCP port is available for binding (i.e., not in use).
    /// Returns True if available, False otherwise.
    /// </summary>
    private bool IsPortAvailableForBind(int port)
    {
        try
        {
            // Create a new TCP socket
            using (Socket socket = new Socket(AddressFamily.InterNetwork, SocketType.Stream, ProtocolType.Tcp))
            {
                // Try to bind to the port on all interfaces (0.0.0.0)
                socket.Bind(new IPEndPoint(IPAddress.Any, port));
                // If successful, the socket is closed by the using statement and return True
                return true;
            }
        }
        catch (SocketException)
        {
            // If binding fails, it means the port is already in use
            return false;
        }
    }

    /// <summary>
    /// Finds an available port by letting the OS assign one.
    /// </summary>
    private int FindAvailablePort()
    {
        Socket socket = new Socket(AddressFamily.InterNetwork, SocketType.Stream, ProtocolType.Tcp);
        socket.Bind(new IPEndPoint(IPAddress.Any, 0)); // Bind to an available port assigned by the OS
        int availablePort = ((IPEndPoint)socket.LocalEndPoint).Port; // Get the assigned port number
        socket.Close(); // Close the socket
        return availablePort;
    }

    /// <summary>
    /// Finds the first available port in a given range.
    /// </summary>
    private int FindAvailablePortInRange(int start = 3001, int end = 3100)
    {
        for (int port = start; port <= end; port++)
        {
            if (IsPortAvailableForBind(port))
                return port;
        }
        throw new Exception($"No available ports found in the range {start}-{end}.");
    }
}
# ---------- end c_script ----------
team_01_definition_cluster = Team01DefinitionCluster()
central_mcp_server = MCPServer(Port=c_script.availablePort, Tools=team_01_definition_cluster, ServerName="Swiftlet")  # -> Compute_volume_of_sphere, Compute_area_of_sphere, Delete_room
get_tool_names = CSharpScript(x=team_01_definition_cluster)  # -> flatten(out)
# ---------- get_tool_names: C# ----------
// Grasshopper Script Instance
#region Usings
using System;
using System.Linq;
using System.Collections;
using System.Collections.Generic;
using System.Drawing;

using Rhino;
using Rhino.Geometry;

using Grasshopper;
using Grasshopper.Kernel;
using Grasshopper.Kernel.Data;
using Grasshopper.Kernel.Types;
#endregion

public class Script_Instance : GH_ScriptInstance
{
    #region Notes
    /* 
      Members:
        RhinoDoc RhinoDocument
        GH_Document GrasshopperDocument
        IGH_Component Component
        int Iteration

      Methods (Virtual & overridable):
        Print(string text)
        Print(string format, params object[] args)
        Reflect(object obj)
        Reflect(object obj, string method_name)
    */
    #endregion

    private void RunScript(object x)
    {
        dynamic dynamicX = x;
        Console.Write(dynamicX.Name);
    }
}
# ---------- end get_tool_names ----------
panel_2 = Panel(c_script.availablePort)
central_decall = Data([central_mcp_server.Compute_volume_of_sphere, central_mcp_server.Compute_area_of_sphere, central_mcp_server.Delete_room])
clean = CleanTree(RemoveNulls=True, RemoveInvalid=True, RemoveEmpty=False, Tree=central_decall)
decall = DeconstructToolCall(Request=clean)  # -> Request, Tool, Arguments
rjo = ReadJSONObject(JObject=decall.Arguments)  # -> Keys, JTokens

# ---- group: Request Parameters
# Materialize Layout from JSON
panel_3 = Panel("room_name")
tmatch = MatchText(Text=rjo.Keys, Pattern=panel_3, Case=True)
tmatch_2 = MatchText(Text=rjo.Keys, Pattern="layout_json", Case=True)
dispatch = Dispatch(List=rjo.JTokens, DispatchPattern=tmatch)  # -> ListA, ListB
dispatch_2 = Dispatch(List=rjo.JTokens, DispatchPattern=tmatch_2)  # -> ListA, ListB
panel_4 = Panel(dispatch.ListA)
panel_5 = Panel(dispatch_2.ListA)

# ---- group: Tool Logic
team_01_result_cluster = Team01ResultCluster(tool_call_request=clean)  # -> tool_call_success, tool_names_3

# ----
rec = DataRecorder(clean, DataLimit=-10, RecordData=True)
rec_2 = DataRecorder(team_01_result_cluster.tool_call_success, DataLimit=-10, RecordData=True)
called_tool_name = Panel(rec)
response_ok = Panel(rec_2)

# ----
# Tool Names from the Results Clusters
# Tool Names from the Definition Clusters
# These Two Clusters should be EXACTLY THE SAME
panel_6 = Panel(get_tool_names)
panel_7 = Panel(team_01_result_cluster.tool_names_3)

# ---- group: Output Layout
json_file_path = FilePath("C:\Users\jomig\repos\AIA26_Studio\team_joao\edited_layout.json")
json2string = Python3Script(path=json_file_path)  # -> out, json_string
# ---------- json2string: Python ----------
import sys
import json
from pathlib import Path


def read_json_as_string(path):
    path = Path(path)

    if not path.exists():
        raise FileNotFoundError(f"File not found: {file_path}")

    with open(path, "r", encoding="utf-8") as f:
        data = json.load(f)

    # Convert JSON object back to string
    json_string = json.dumps(data)

    return json_string

json_string = read_json_as_string(path)
# ---------- end json2string ----------

# ---- group: 0 = Before, 1= After
number_slider = Slider(0, range=0..1)

# ----
rjv = ReadJSONValue(JValue=dispatch_2.ListA)  # -> AsString, AsNumber, AsBool
filter = StreamFilter(Gate=number_slider, Stream0=rjv.AsString, Stream1=json2string.json_string)

# ---- group: Columns
py3 = Python3Script(x=json2string.json_string)  # -> out, a, b
# ---------- py3: Python ----------
import json
import Rhino.Geometry as rg


def columns_to_polylines(json_string, size=0.2):
    """
    Converts column positions from JSON string into square polylines.

    Args:
        json_string (str): JSON input
        size (float): half-size of square around each column

    Returns:
        list: Rhino PolylineCurves
    """

    data = json.loads(json_string)

    polylines = []
    column_ids = []

    columns = data.get("structure", {}).get("columns", [])

    for i, col in enumerate(columns):
        pos = col.get("position")

        if not pos:
            continue

        x, y = pos

        # Create square around column point
        pts = [
            rg.Point3d(x - size, y - size, 0),
            rg.Point3d(x + size, y - size, 0),
            rg.Point3d(x + size, y + size, 0),
            rg.Point3d(x - size, y + size, 0),
            rg.Point3d(x - size, y - size, 0),  # close
        ]

        polyline = rg.Polyline(pts).ToPolylineCurve()

        column_ids.append(f"column_{i}")
        polylines.append(polyline)

    return column_ids, polylines


json_input = x  # Grasshopper input

ids, polys = columns_to_polylines(json_input)

a = ids
b = polys
# ---------- end py3 ----------
srf = Surface(py3.b)
preview = CustomPreview(Geometry=srf, Material=ColourSwatch(SwatchColor=RGB(74, 74, 74)))

# ---- group: Spaces
py3_2 = Python3Script(json_str=filter)  # -> out, a, b
# ---------- py3_2: Python ----------
import json
import Rhino.Geometry as rg

# Input:
# json_str -> string containing the JSON

def load_json_from_string(json_string):
    try:
        data = json.loads(json_string)
    except Exception as e:
        raise ValueError(f"Invalid JSON string: {e}")
    return data

# Load JSON from string
loaded_layout = load_json_from_string(json_str)

space_names = []
polylines = []

for space in loaded_layout.get("spaces", []):
    name = space.get("name")
    polygon = space.get("geometry", {}).get("polygon")

    if name and polygon:
        # Convert to Rhino points (Z = 0)
        pts = [rg.Point3d(x, y, 0) for x, y in polygon]

        # Close polygon if needed
        if pts[0] != pts[-1]:
            pts.append(pts[0])

        # Create polyline curve
        polyline = rg.Polyline(pts).ToPolylineCurve()

        space_names.append(name)
        polylines.append(polyline)

# Outputs
a = space_names
b = polylines
# ---------- end py3_2 ----------
panel_8 = Panel(py3_2.a)
panel_9 = Panel(py3_2.b)

# ---- group: Polylines
py3_3 = Python3Script(room_names=py3_2.a)  # -> out, a; inputs room_names: list
# ---------- py3_3: Python ----------
import matplotlib.pyplot as plt
import matplotlib.cm as cm
import matplotlib.colors as mcolors

def assign_pastel_colors(room_names):
    n = len(room_names)
    
    # Get the Pastel1 colormap
    cmap = cm.get_cmap('Pastel1', n)
    
    color_map = []
    for i, s in enumerate(room_names):
        # Get RGBA color
        rgba = cmap(i)
        # Convert to HEX for readability
        hex_color = mcolors.to_hex(rgba)

        # Remove #
        
        color_map.append(hex_color)
    
    return color_map


a = assign_pastel_colors(room_names)
# ---------- end py3_3 ----------
srf_2 = Surface(py3_2.b)
htc = HexToColor(Hex=py3_3.a)
preview_2 = CustomPreview(Geometry=srf_2, Material=htc)

# ---- group: Labels
area = Area(Geometry=srf_2)  # -> Area, Centroid
tag = TextTag(Location=area.Centroid, Text=py3_2.a)

# ==== cluster Team01DefinitionCluster
# Team 01 Definition Cluster
# SPHERE TEAM
panel = Panel("This tool computes the volume of a sphere by giving it a radius.  The output unit is the input unit cubed.")
panel_2 = Panel("This tool deletes a room by giving it a room name and the layout json")
panel_3 = Panel("This tool computes the area of a sphere by giving it a radius.  The output unit is the input unit squared.")
param = DefineToolParameter(Name="room_name", Type="string", Description="the name of the room", Required=Toggle(True))
param_2 = DefineToolParameter(Name="layout_json", Type="string", Description="the layout data structure", Required=Toggle(True))
param_3 = DefineToolParameter(Name="radius", Type="number", Description="The Radius of a Sphere", Required=Toggle(True))
param_4 = DefineToolParameter(Name="radius", Type="number", Description="The Radius of a Sphere", Required=Toggle(True))
merge = Merge(Data1=param, Data2=param_2)
tool = DefineTool(Name="delete_room", Description=panel_2, Parameters=merge)
tool_2 = DefineTool(Name="compute_volume_of_sphere", Description=panel, Parameters=param_3)
tool_3 = DefineTool(Name="compute_area_of_sphere", Description=panel_3, Parameters=param_4)
merge_2 = Merge(Data1=tool_2, Data2=tool_3, Data3=tool)
mcp_tool_list = ClusterOutput(merge_2)

# ==== cluster Team01ResultCluster

# ----
# Team 01 Result Cluster
# SPHERE TEAM
# Edit Tool Names to
# Match Definition Cluster
tool_names = Panel("""compute_volume_of_sphere
compute_area_of_sphere
delete_room""")

# ----
# Sorting Logic, Please Do Not Edit
tool_call_request = ClusterInput()
tool_names_2 = Text(tool_names)
decall = DeconstructToolCall(Request=tool_call_request)  # -> Request, Tool, Arguments
mindex = MemberIndex(Set=tool_names, Member=decall.Tool)  # -> Index, Count
sift = SiftPattern(List=decall.Request, SiftPattern=mindex.Index)  # -> Output0, Output1, Output2, Output3

# ---- group: Cluster Output
tool_names_3 = ClusterOutput(tool_names_2)

# ----
decall_2 = DeconstructToolCall(Request=sift.Output2)  # -> Request, Tool, Arguments
decall_3 = DeconstructToolCall(Request=sift.Output1)  # -> Request, Tool, Arguments
decall_4 = DeconstructToolCall(Request=sift.Output0)  # -> Request, Tool, Arguments
gjok = GetJSONObjectKey(JObject=decall_3.Arguments, Key="radius")
gjok_2 = GetJSONObjectKey(JObject=decall_4.Arguments, Key="radius")
rjv = ReadJSONValue(JValue=gjok)  # -> AsString, AsNumber, AsBool
rjv_2 = ReadJSONValue(JValue=gjok_2)  # -> AsString, AsNumber, AsBool
sph = Sphere(Base=PlaneXY(0, 0, 0), Radius=rjv.AsNumber)
sph_2 = Sphere(Base=PlaneXY(0, 0, 0), Radius=rjv_2.AsNumber)
gjok_3 = GetJSONObjectKey(JObject=decall_2.Arguments, Key="room_name")
gjok_4 = GetJSONObjectKey(JObject=decall_2.Arguments, Key="layout_json")
area = Area(Geometry=sph)  # -> Area, Centroid
volume = Volume(Geometry=sph_2)  # -> Volume, Centroid
panel = Panel(area.Area)
rjv_3 = ReadJSONValue(JValue=gjok_4)  # -> AsString, AsNumber, AsBool
panel_2 = Panel(volume.Volume)

# ---- group: Delete a Space by name
py3 = Python3Script(json_str=rjv_3.AsString, room_name=gjok_3)  # -> out, a; inputs room_name: String
# ---------- py3: Python ----------
import json
import copy

# Inputs:
# json_str -> JSON as string
# room_name -> e.g. "kitchen"

def load_json_from_string(json_string):
    try:
        data = json.loads(json_string)
    except Exception as e:
        raise ValueError(f"Invalid JSON string: {e}")
    return data

# Load JSON
data = load_json_from_string(json_str)

# Work on a copy
filtered = copy.deepcopy(data)

# 1. Find IDs of spaces to remove
ids_to_remove = set()
for space in filtered.get("spaces", []):
    if space.get("name") == room_name:
        ids_to_remove.add(space.get("id"))

# 2. Remove from spaces
filtered["spaces"] = [
    s for s in filtered.get("spaces", [])
    if s.get("id") not in ids_to_remove
]

# 3. Remove from adjacencies
filtered["adjacencies"] = [
    adj for adj in filtered.get("adjacencies", [])
    if adj.get("space_1") not in ids_to_remove
    and adj.get("space_2") not in ids_to_remove
]

# 4. Remove from circulation
filtered["circulation"] = [
    c for c in filtered.get("circulation", [])
    if c.get("from") not in ids_to_remove
    and c.get("to") not in ids_to_remove
]

# Output ONLY as string
a = json.dumps(filtered, indent=2)
# ---------- end py3 ----------

# ----
cjv = CreateJSONValue(Value=panel)
cjv_2 = CreateJSONValue(Value=panel_2)
pjs = ParseJSONString(Text=py3.a)
cjo = CreateJSONObject(Keys="area", Values=cjv)
cjo_2 = CreateJSONObject(Keys="volume", Values=cjv_2)
respond = MCPToolResponse(Request=decall_2.Request, Content=pjs, IsError=False)
respond_2 = MCPToolResponse(Request=decall_3.Request, Content=cjo, IsError=False)
respond_3 = MCPToolResponse(Request=decall_4.Request, Content=cjo_2, IsError=False)
or = GateOr(A=respond_3, B=respond_2)
tool_call_success = ClusterOutput(or)
