# Grasshopper definition team_04_working .gh (Grasshopper 1.0.8)
# plug-ins: Human, Swiftlet

# ----
# Connect MCP Tools to Decall and Update All Clusters
button = Button()
# IF SOMETHING IS NOT
# WORKING PRESS THIS
# BUTTON FIRST
toggle = BooleanToggle(True)
connect_mcp_tools_to_decall = CSharpScript(nickname_From="Central MCP Server", nickname_To="Central DeCall", connect=button)  # -> out; inputs nickname_From: String, nickname_To: String, connect: Boolean
# ---------- connect_mcp_tools_to_decall: C# ----------
using System;
using System.Linq;
using Grasshopper;
using Grasshopper.Kernel;

public class Script_Instance : GH_ScriptInstance
{
    private void RunScript(string nickname_From, string nickname_To, bool connect)
    {
        if (!connect) return;
        Console.Write($"Attempting to connect outputs from '{nickname_From}' to '{nickname_To}'...");

        var ghDoc = Instances.ActiveCanvas?.Document;
        if (ghDoc == null) return;

        var compFrom = ghDoc.Objects
            .OfType<IGH_Component>()
            .FirstOrDefault(o => o.NickName == nickname_From);

        var compTo = ghDoc.Objects
            .OfType<IGH_Param>()
            .FirstOrDefault(o => o.NickName == nickname_To);

        if (compFrom != null && compTo != null)
        {
            ghDoc.ScheduleSolution(5, doc => Connect(doc, compFrom, compTo));
        }
    }

    // <Custom additional code> 
    private void Connect(GH_Document doc, IGH_Component compFrom, IGH_Param compTo)
    {
        if (compFrom == null || compTo == null) return;

        foreach (IGH_Param param in compFrom.Params.Output)
        {
            compTo.AddSource(param);
        }
    }
}
# ---------- end connect_mcp_tools_to_decall ----------
update_all_clusters = CSharpScript(update=button, recursive=toggle)  # -> out, A; inputs update: Boolean, recursive: Boolean, passwords: list of String, localPath: String
# ---------- update_all_clusters: C# ----------
using System;
using System.Collections;
using System.Collections.Generic;

using Rhino;
using Rhino.Geometry;

using Grasshopper;
using Grasshopper.Kernel;
using Grasshopper.Kernel.Data;
using Grasshopper.Kernel.Types;
using System.Windows.Forms;
using System.Linq;
/// <summary>
/// This class will be instantiated on demand by the Script component.
/// </summary>
public class Script_Instance : GH_ScriptInstance
{
  /// <summary>Print a String to the [Out] Parameter of the Script component.</summary>
  /// <param name="text">String to print.</param>
  private void Print(string text) { /* Implementation hidden. */ }
  /// <summary>Print a formatted String to the [Out] Parameter of the Script component.</summary>
  /// <param name="format">String format.</param>
  /// <param name="args">Formatting parameters.</param>
  private void Print(string format, params object[] args) { /* Implementation hidden. */ }
  /// <summary>Print useful information about an object instance to the [Out] Parameter of the Script component. </summary>
  /// <param name="obj">Object instance to parse.</param>
  private void Reflect(object obj) { /* Implementation hidden. */ }
  /// <summary>Print the signatures of all the overloads of a specific method to the [Out] Parameter of the Script component. </summary>
  /// <param name="obj">Object instance to parse.</param>
  private void Reflect(object obj, string method_name) { /* Implementation hidden. */ }

  /// <summary>Gets the current Rhino document.</summary>
  private readonly RhinoDoc RhinoDocument;
  /// <summary>Gets the Grasshopper document that owns this script.</summary>
  private readonly GH_Document GrasshopperDocument;
  /// <summary>Gets the Grasshopper script component that owns this script.</summary>
  private readonly IGH_Component Component;
  /// <summary>
  /// Gets the current iteration count. The first call to RunScript() is associated with Iteration==0.
  /// Any subsequent call within the same solution will increment the Iteration count.
  /// </summary>
  private readonly int Iteration;

  /// <summary>
  /// This procedure contains the user code. Input parameters are provided as regular arguments,
  /// Output parameters as ref arguments. You don't have to assign output parameters,
  /// they will have a default value.
  /// </summary>
  private void RunScript(
		bool update,
		bool recursive,
		List<string> passwords,
		string localPath,
		ref object A)
  {

    A = updateLog;
    if (update)
    {
      updateLog = new List<string>();
      _passwords = passwords;
      UpdateClusters(GrasshopperDocument, recursive, localPath);
    }

  }

  // <Custom additional code> 
  List<string> updateLog;
  List<String> _passwords;

  void UpdateClusters (GH_Document ghDoc, bool recursive, string localPath)
  {
    foreach (var obj in ghDoc.Objects)
    {
      var cluster = obj as Grasshopper.Kernel.Special.GH_Cluster;
      if (cluster != null)
      {
        var clusterPath = cluster.FilePath;
        if (!string.IsNullOrEmpty(clusterPath))
        {
          if (cluster.Synchronisation == Grasshopper.Kernel.Special.GH_Synchronisation.OutOfDate)
          {
            cluster.CreateFromFilePath(clusterPath);
            updateLog.Add("Updated: " + clusterPath);
          }
          else if (cluster.Synchronisation == Grasshopper.Kernel.Special.GH_Synchronisation.MissingReference)
          {
            string newPath = ReplacePath(localPath, clusterPath);
            if (!string.IsNullOrEmpty(newPath))
            {
              cluster.CreateFromFilePath(newPath);
              updateLog.Add("Replaced and updated: " + newPath);
            }
            else
            {
              updateLog.Add("Missing reference: " + clusterPath);
            }

          }
        }

        //Update recursively
        if (recursive)
        {
          GH_Document clusterDoc = GetClusterDoc(cluster);
          if (clusterDoc != null)
            UpdateClusters(clusterDoc, recursive, localPath);
        }
      }
    }
  }

  GH_Document GetClusterDoc(Grasshopper.Kernel.Special.GH_Cluster cluster)
  {
    //no pass needed
    var doc = cluster.Document(string.Empty);
    if (doc != null)
      return doc;

    //try passwords
    if (_passwords != null && _passwords.Any())
    {
      foreach (var pass in _passwords)
      {
        doc = cluster.Document(pass);
        if (doc != null)
          return doc;
      }
    }

    return null;
  }

  string ReplacePath(string localPath, string missingPath)
  {
    if (String.IsNullOrEmpty(missingPath) || string.IsNullOrEmpty(localPath))
      return null;
    else
    {
      string lastLocalPart = localPath.Split('\\').Last();
      string[] parts = missingPath.Split('\\');
      if (parts.Contains(lastLocalPart))
      {
        int i = Array.IndexOf(parts, lastLocalPart);
        string clusterPath = String.Join("\\", parts.Skip(i + 1));
        string result = String.Join("\\", localPath, clusterPath);
        return result;
      }
      else
        return null;
    }
  }
  // </Custom additional code> 
}
# ---------- end update_all_clusters ----------
panel = Panel(connect_mcp_tools_to_decall)

c_script = CSharpScript()  # -> out, availablePort
# ---------- c_script: C# ----------
// Grasshopper Script Instance
// This script finds an available port on the local machine.
#region Usings
using System;
using System.Linq;
using System.Collections;
using System.Collections.Generic;
using System.Drawing;
using System.Net;
using System.Net.Sockets;

using Rhino;
using Rhino.Geometry;

using Grasshopper;
using Grasshopper.Kernel;
using Grasshopper.Kernel.Data;
using Grasshopper.Kernel.Types;
#endregion

public class Script_Instance : GH_ScriptInstance
{
    #region Notes
    /* 
      Members:
        RhinoDoc RhinoDocument
        GH_Document GrasshopperDocument
        IGH_Component Component
        int Iteration

      Methods (Virtual & overridable):
        Print(string text)
        Print(string format, params object[] args)
        Reflect(object obj)
        Reflect(object obj, string method_name)
    */
    #endregion

    private void RunScript(object start, object end, ref object availablePort)
    {
        // Use default values if parameters are not provided
        int startPort = (start != null && int.TryParse(start.ToString(), out int s)) ? s : 3001;
        int endPort = (end != null && int.TryParse(end.ToString(), out int e)) ? e : 3100;

        // Find an available port in the specified range
        try
        {
            availablePort = FindAvailablePortInRange(startPort, endPort);
            Print($"Available port found: {availablePort}");
        }
        catch (Exception ex)
        {
            Print($"Error: {ex.Message}");
            availablePort = null;
        }
    }

    /// <summary>
    /// Checks if a local TCP port is available for binding (i.e., not in use).
    /// Returns True if available, False otherwise.
    /// </summary>
    private bool IsPortAvailableForBind(int port)
    {
        try
        {
            // Create a new TCP socket
            using (Socket socket = new Socket(AddressFamily.InterNetwork, SocketType.Stream, ProtocolType.Tcp))
            {
                // Try to bind to the port on all interfaces (0.0.0.0)
                socket.Bind(new IPEndPoint(IPAddress.Any, port));
                // If successful, the socket is closed by the using statement and return True
                return true;
            }
        }
        catch (SocketException)
        {
            // If binding fails, it means the port is already in use
            return false;
        }
    }

    /// <summary>
    /// Finds an available port by letting the OS assign one.
    /// </summary>
    private int FindAvailablePort()
    {
        Socket socket = new Socket(AddressFamily.InterNetwork, SocketType.Stream, ProtocolType.Tcp);
        socket.Bind(new IPEndPoint(IPAddress.Any, 0)); // Bind to an available port assigned by the OS
        int availablePort = ((IPEndPoint)socket.LocalEndPoint).Port; // Get the assigned port number
        socket.Close(); // Close the socket
        return availablePort;
    }

    /// <summary>
    /// Finds the first available port in a given range.
    /// </summary>
    private int FindAvailablePortInRange(int start = 3001, int end = 3100)
    {
        for (int port = start; port <= end; port++)
        {
            if (IsPortAvailableForBind(port))
                return port;
        }
        throw new Exception($"No available ports found in the range {start}-{end}.");
    }
}
# ---------- end c_script ----------
team_04_definition_cluster = Team04DefinitionCluster()
panel_2 = Panel(c_script.availablePort)
central_mcp_server = MCPServer(Port=c_script.availablePort, Tools=team_04_definition_cluster, ServerName="Swiftlet")  # -> Site_boundary_generation, Usable_site_area, Parametric_shape_generator
get_tool_names = CSharpScript(x=team_04_definition_cluster)  # -> flatten(out)
# ---------- get_tool_names: C# ----------
// Grasshopper Script Instance
#region Usings
using System;
using System.Linq;
using System.Collections;
using System.Collections.Generic;
using System.Drawing;

using Rhino;
using Rhino.Geometry;

using Grasshopper;
using Grasshopper.Kernel;
using Grasshopper.Kernel.Data;
using Grasshopper.Kernel.Types;
#endregion

public class Script_Instance : GH_ScriptInstance
{
    #region Notes
    /* 
      Members:
        RhinoDoc RhinoDocument
        GH_Document GrasshopperDocument
        IGH_Component Component
        int Iteration

      Methods (Virtual & overridable):
        Print(string text)
        Print(string format, params object[] args)
        Reflect(object obj)
        Reflect(object obj, string method_name)
    */
    #endregion

    private void RunScript(object x)
    {
        dynamic dynamicX = x;
        Console.Write(dynamicX.Name);
    }
}
# ---------- end get_tool_names ----------
central_decall = Data([central_mcp_server.Site_boundary_generation, central_mcp_server.Usable_site_area, central_mcp_server.Parametric_shape_generator])
clean = CleanTree(RemoveNulls=True, RemoveInvalid=True, RemoveEmpty=False, Tree=central_decall)

# ---- group: Input Layout
json_file_path = FilePath("C:\Users\danie\Documents\GitHub\term 3\AIAStudio\AIA26_Studio\layout_input\layout_schema.json")
json2string = Python3Script(path=json_file_path)  # -> out, json_string
# ---------- json2string: Python ----------
import sys
import json
from pathlib import Path


def read_json_as_string(path):
    path = Path(path)

    if not path.exists():
        raise FileNotFoundError(f"File not found: {file_path}")

    with open(path, "r", encoding="utf-8") as f:
        data = json.load(f)

    # Convert JSON object back to string
    json_string = json.dumps(data)

    return json_string

json_string = read_json_as_string(path)
# ---------- end json2string ----------

# ----
panel_3 = Panel(json_file_path)
team_04_result_cluster = Team04ResultCluster(tool_call_request=clean)  # -> tool_call_success, tool_call_success_2, tool_names_3

# ----
# Tool Names from the Results Clusters
# Tool Names from the Definition Clusters
# These Two Clusters should be EXACTLY THE SAME
panel_4 = Panel(get_tool_names)
panel_5 = Panel(team_04_result_cluster.tool_names_3)

# ---- group: Output Layout
json_file_path_2 = FilePath("C:\Users\danie\Documents\GitHub\term 3\AIAStudio\AIA26_Studio\team_01\team_01_edited_layout.json")
json2string_2 = Python3Script(path=json_file_path_2)  # -> out, json_string; same code as json2string

# ----
curve = Curve(team_04_result_cluster.tool_call_success_2)
rec = DataRecorder(team_04_result_cluster.tool_call_success, DataLimit=-10, RecordData=True)
rec_2 = DataRecorder(clean, DataLimit=-10, RecordData=True)

# ---- group: Request Parameters
decall = DeconstructToolCall(Request=clean)  # -> Request, Tool, Arguments
rjo = ReadJSONObject(JObject=decall.Arguments)  # -> Keys, JTokens
# Debug: Check request input data
panel_6 = Panel("room_name")
tmatch = MatchText(Text=rjo.Keys, Pattern=panel_6, Case=True)
tmatch_2 = MatchText(Text=rjo.Keys, Pattern="layout_json", Case=True)
dispatch = Dispatch(List=rjo.JTokens, DispatchPattern=tmatch)  # -> ListA, ListB
dispatch_2 = Dispatch(List=rjo.JTokens, DispatchPattern=tmatch_2)  # -> ListA, ListB
panel_7 = Panel(dispatch.ListA)
panel_8 = Panel(dispatch_2.ListA)

# ----
panel_9 = Panel(json_file_path_2)

# ---- group: 0 = Before, 1= After
# Visualize Layout from JSON: Before and After
number_slider = Slider(1, range=0..1)

# ----
response_ok = Panel(rec)
called_tool_name = Panel(rec_2)
filter = StreamFilter(Gate=number_slider, Stream0=json2string.json_string, Stream1=json2string_2.json_string)

# ---- group: Extractor Tool do map json to grasshopper data
extractor = Python3Script(json_str=filter)  # -> out, outline_curve, room_names, room_curves, door_names, door_curves, window_names, window_curves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
# ---------- extractor: Python ----------
import json
import Rhino.Geometry as rg

def load_json_from_string(json_string):
    try:
        data = json.loads(json_string)
    except Exception as e:
        raise ValueError(f"Invalid JSON string: {e}")
    return data

def create_polyline(points, close=True):
    """Create a Rhino PolylineCurve from 2D points"""
    pts = [rg.Point3d(x, y, 0) for x, y in points]

    if close and pts[0] != pts[-1]:
        pts.append(pts[0])

    return rg.Polyline(pts).ToPolylineCurve()

def create_line(points):
    """Create a Rhino LineCurve from 2 points"""
    if len(points) != 2:
        return None
    p1 = rg.Point3d(points[0][0], points[0][1], 0)
    p2 = rg.Point3d(points[1][0], points[1][1], 0)
    return rg.LineCurve(p1, p2)

# Load JSON
layout = load_json_from_string(json_str)

# ------------------------
# ROOMS (polygons)
# ------------------------
room_names = []
room_curves = []

for room in layout.get("rooms", []):
    name = room.get("name")
    geometry = room.get("geometry")

    if name and geometry:
        curve = create_polyline(geometry, close=True)
        room_names.append(name)
        room_curves.append(curve)

# ------------------------
# DOORS (lines)
# ------------------------
door_names = []
door_curves = []

for door in layout.get("doors", []):
    name = door.get("name")
    geometry = door.get("geometry")

    if name and geometry:
        curve = create_line(geometry)
        if curve:
            door_names.append(name)
            door_curves.append(curve)

# ------------------------
# WINDOWS (lines)
# ------------------------
window_names = []
window_curves = []

for window in layout.get("windows", []):
    name = window.get("name")
    geometry = window.get("geometry")

    if name and geometry:
        curve = create_line(geometry)
        if curve:
            window_names.append(name)
            window_curves.append(curve)

# ------------------------
# FURNITURE (polygons)
# ------------------------
furniture_names = []
furniture_curves = []

for furn in layout.get("furniture", []):
    name = furn.get("name")
    geometry = furn.get("geometry")

    if name and geometry:
        curve = create_polyline(geometry, close=True)
        furniture_names.append(name)
        furniture_curves.append(curve)

# ------------------------
# MEP (polygons)
# ------------------------
mep_names = []
mep_curves = []

for m in layout.get("mep", []):
    name = m.get("name")
    geometry = m.get("geometry")

    if name and geometry:
        curve = create_polyline(geometry, close=True)
        mep_names.append(name)
        mep_curves.append(curve)

# ------------------------
# STRUCTURE (lines)
# ------------------------
structure_names = []
structure_curves = []

for s in layout.get("structure", []):
    name = s.get("name")
    geometry = s.get("geometry")

    if name and geometry:
        curve = create_line(geometry)
        if curve:
            structure_names.append(name)
            structure_curves.append(curve)

# ------------------------
# OUTLINE (optional)
# ------------------------
outline_curve = None
if "outline" in layout:
    outline_curve = create_polyline(layout["outline"], close=True)

# ------------------------
# OUTPUTS
# ------------------------
a = room_names
b = room_curves

c = door_names
d = door_curves

e = window_names
f = window_curves

g = furniture_names
h = furniture_curves

i = mep_names
j = mep_curves

k = structure_names
l = structure_curves

m = outline_curve
# ---------- end extractor ----------

# ---- group: Polylines
srf = Surface(extractor.room_curves)
preview = CustomPreview(Geometry=srf, Material=[ColourSwatch(SwatchColor=RGB(167, 219, 44)), ColourSwatch(SwatchColor=RGB(4, 154, 184))])

# ---- group: Windows
data = Data(extractor.window_curves)
previewlw = CustomPreviewLineweights(Geometry=data, Shader=ColourSwatch(SwatchColor=RGB(56, 56, 56)), Thickness=Slider(5.4, range=0..10), Absolute=False)

# ---- group: Labels
area = Area(Geometry=srf)  # -> Area, Centroid
tag = TextTag(Location=area.Centroid, Text=extractor.room_names)

# ----
# Debug Tool Names
# This Panel should always be TRUE
tool_names_from_the_results_clusters = Data(panel_5)
tool_names_from_the_definition_clusters = Data(panel_4)
join = TextJoin(Text=flatten(tool_names_from_the_definition_clusters))
join_2 = TextJoin(Text=flatten(tool_names_from_the_results_clusters))
tstat = TreeStatistics(Tree=tool_names_from_the_definition_clusters)  # -> Paths, Length, Count
tstat_2 = TreeStatistics(Tree=tool_names_from_the_results_clusters)  # -> Paths, Length, Count
dpath = DeconstructPath(Branch=tstat.Paths)
dpath_2 = DeconstructPath(Branch=tstat_2.Paths)
equals = Equality(FirstNumber=tstat.Length, SecondNumber=tstat_2.Length)  # -> Equality, Inequality
equals_2 = Equality(FirstNumber=tstat.Count, SecondNumber=tstat_2.Count)  # -> Equality, Inequality
ma = MassAddition(Input=flatten(equals.Equality))  # -> Result, PartialResults
equals_3 = Equality(FirstNumber=dpath, SecondNumber=dpath_2)  # -> Equality, Inequality
lng = ListLength(List=equals.Equality)
ma_2 = MassAddition(Input=flatten(equals_3.Inequality))  # -> Result, PartialResults
equals_4 = Equality(FirstNumber=ma.Result, SecondNumber=lng)  # -> Equality, Inequality
does_quantity_of_tools_match = Panel(equals_2.Equality)
equals_5 = Equality(FirstNumber=ma_2.Result, SecondNumber="0")  # -> Equality, Inequality
does_quantity_of_tools_match_per_team = Panel(equals_4.Equality)
are_all_teams_included = Panel(equals_5.Equality)

tmatch_3 = MatchText(Text=join, Pattern=join_2, Case=True)

do_all_names_match = Panel(tmatch_3)
and = GateAnd(A=equals_5.Equality, B=equals_4.Equality, C=equals_2.Equality, D=tmatch_3)  # -> flatten(Result)
do_trees_match = Panel(and)

# ==== cluster Team04ResultCluster

# ----
# Team 04 Result Cluster
# CYLINDER TEAM
# Edit Tool Names to
# Match Definition Cluster
tool_names = Panel("""site_boundary_generation
Usable_site_area
parametric_shape_generator""")

# ----
# Sorting Logic, Please Do Not Edit
tool_call_request = ClusterInput()
tool_names_2 = Text(tool_names)
decall = DeconstructToolCall(Request=tool_call_request)  # -> Request, Tool, Arguments
mindex = MemberIndex(Set=tool_names, Member=decall.Tool)  # -> Index, Count
sift = SiftPattern(List=decall.Request, SiftPattern=mindex.Index)  # -> Output0, Output1, Output2

tree_count = Slider(15, range=1..50)
tree_size = Slider(4, range=1..50)

# ---- group: Cluster Output
tool_names_3 = ClusterOutput(tool_names_2)

# ----
site_area = Slider(10000, range=100..10000000)
division_count = Slider(11, range=4..100)
deconstruct_tool_call = DeconstructToolCall(Request=sift.Output0)  # -> Request, Tool, Arguments
rotation = Slider(97, range=0..360)
deconstruct_tool_call_2 = DeconstructToolCall(Request=sift.Output2)  # -> Request, Tool, Arguments
deconstruct_tool_call_3 = DeconstructToolCall(Request=sift.Output1)  # -> Request, Tool, Arguments
read_json_value = ReadJSONValue(JValue=deconstruct_tool_call_2.Arguments)  # -> AsString, AsNumber, AsBool
get_json_object_key = GetJSONObjectKey(JObject=deconstruct_tool_call_2.Arguments, Key="shape_type")
get_json_object_key_2 = GetJSONObjectKey(JObject=deconstruct_tool_call.Arguments, Key="Number of edges of sites")
get_json_object_key_3 = GetJSONObjectKey(JObject=deconstruct_tool_call.Arguments, Key="Site area")
get_json_object_key_4 = GetJSONObjectKey(JObject=deconstruct_tool_call_3.Arguments, Key="radius_of_trees")
get_json_object_key_5 = GetJSONObjectKey(JObject=deconstruct_tool_call_3.Arguments, Key="number_of_trees")
get_json_object_key_6 = GetJSONObjectKey(JObject=deconstruct_tool_call.Arguments, Key="Site angle")
aspect_ratio = Slider(0.8, range=0.2..5)
read_json_value_2 = ReadJSONValue(JValue=get_json_object_key)  # -> AsString, AsNumber, AsBool
read_json_value_3 = ReadJSONValue(JValue=get_json_object_key_2)  # -> AsString, AsNumber, AsBool
read_json_value_4 = ReadJSONValue(JValue=get_json_object_key_3)  # -> AsString, AsNumber, AsBool
read_json_value_5 = ReadJSONValue(JValue=get_json_object_key_4)  # -> AsString, AsNumber, AsBool
read_json_value_6 = ReadJSONValue(JValue=get_json_object_key_6)  # -> AsString, AsNumber, AsBool
read_json_value_7 = ReadJSONValue(JValue=get_json_object_key_5)  # -> AsString, AsNumber, AsBool
panel = Panel("""L
I""")
distortion_strength = Slider(15, range=1..50)
number = Number(read_json_value_4.AsNumber)
text = Text(read_json_value_2.AsString)
find_all_items = FindAllItems(List=panel, Item=text)
clean_tree = CleanTree(RemoveNulls=True, RemoveInvalid=True, RemoveEmpty=invert(False), Tree=flatten(find_all_items))
number_2 = Number(read_json_value_3.AsNumber)
number_3 = Number(read_json_value_5.AsNumber)
number_4 = Number(read_json_value_6.AsNumber)
number_5 = Number(read_json_value_7.AsNumber)
multiplication = Multiplication(A=number, B=aspect_ratio)
division = Division(A=number, B=aspect_ratio)
panel_2 = Panel(number)
panel_3 = Panel(number_2)
square_root = SquareRoot(Value=multiplication)
square_root_2 = SquareRoot(Value=division)
curve = Curve(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)
curve_2 = Curve(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)
width = Number(square_root)
depth = Number(square_root_2)
stream_filter = StreamFilter(Gate=clean_tree, Stream0=curve_2, Stream1=curve)
rectangle = Rectangle(Plane=PlaneXY(0, 0, 0), XSize=width, YSize=depth, Radius=0)  # -> Rectangle, Length
divide_curve = DivideCurve(Curve=rectangle.Rectangle, Count=number_2, Kinks=False)  # -> Points, Tangents, Parameters
noise_strength = Slider(10, range=0..20)
construct_point = ConstructPoint(XCoordinate=Slider(50, range=-500..500), YCoordinate=Slider(50, range=-500..500), ZCoordinate=0)
point = Point(divide_curve.Points)
distance = Distance(PointA=point, PointB=construct_point)
perlinnoise = PerlinNoise(Values=point, Time=0, Scale=Slider(2.7, range=0.1..5))
bounds = Bounds(Numbers=distance)
perlinnoise_2 = PerlinNoise(Values=point, Time=0, Scale=Slider(2.6, range=0.1..5))
vector_2pt = Vector2Pt(PointA=construct_point, PointB=point, Unitize=False)  # -> Vector, Length
vector_xyz = VectorXYZ(XComponent=perlinnoise_2, YComponent=perlinnoise, ZComponent=0)  # -> Vector, Length
remap_numbers = RemapNumbers(Value=distance, Source=Domain(0, 1), Target=bounds)  # -> Mapped, Clipped
multiplication_2 = Multiplication(A=remap_numbers.Mapped, B=distortion_strength)
amplitude = Amplitude(Vector=vector_xyz.Vector, Amplitude=noise_strength)
amplitude_2 = Amplitude(Vector=vector_2pt.Vector, Amplitude=multiplication_2)
addition = Addition(A=amplitude, B=amplitude_2)
smoothness = Slider(1, range=0..1)
move = Move(Geometry=divide_curve.Points, Motion=addition)  # -> Geometry, Transform
area = Area(Geometry=rectangle.Rectangle)  # -> Area, Centroid
interpolate = Interpolate(Vertices=move.Geometry, Degree=3, Periodic=True, KnotStyle=1)  # -> Curve, Length, Domain
rebuild_curve = RebuildCurve(Curve=interpolate.Curve, Degree=smoothness, EndTangents=False)
boundary_surfaces = BoundarySurfaces(Edges=rebuild_curve)
area_2 = Area(Geometry=boundary_surfaces)  # -> Area, Centroid
division_2 = Division(A=area.Area, B=area_2.Area)
square_root_3 = SquareRoot(Value=division_2)
construct_point_2 = ConstructPoint(XCoordinate=0, YCoordinate=0, ZCoordinate=0)
scale = Scale(Geometry=boundary_surfaces, Center=area_2.Centroid, Factor=square_root_3)  # -> Geometry, Transform
area_3 = Area(Geometry=scale.Geometry)  # -> Area, Centroid
rotate = Rotate(Geometry=scale.Geometry, Angle=degrees(number_4), Plane=area_3.Centroid)  # -> Geometry, Transform
area_4 = Area(Geometry=rotate.Geometry)  # -> Area, Centroid
vector_2pt_2 = Vector2Pt(PointA=area_4.Centroid, PointB=construct_point_2, Unitize=False)  # -> Vector, Length
move_2 = Move(Geometry=rotate.Geometry, Motion=vector_2pt_2.Vector)  # -> Geometry, Transform
python_3_script = Python3Script(G=move_2.Geometry, Store=move_2.Geometry, Reset=Toggle(False))  # -> Stored_Geometry
# ---------- python_3_script: Python ----------
"""GhPython Component

Inputs:
    G: Geometry to store
    Reset: Boolean reset
Outputs:
    Stored_Geometry: Persistent geometry
"""

import scriptcontext as sc

KEY = "LAST_SITE_GEOMETRY"

# Reset stored geometry
if Reset:
    if KEY in sc.sticky:
        del sc.sticky[KEY]

# Store incoming geometry
if G is not None:
    sc.sticky[KEY] = G

# Retrieve stored geometry
Stored_Geometry = sc.sticky.get(KEY, None)
# ---------- end python_3_script ----------
populate_geometry = PopulateGeometry(Geometry=python_3_script, Count=number_5, Seed=1)
area_5 = Area(Geometry=move_2.Geometry)  # -> Area, Centroid
circle = Circle(Plane=populate_geometry, Radius=number_3)
panel_4 = Panel(area_5.Area)
panel_5 = Panel(python_3_script)
region_difference = RegionDifference(CurvesA=python_3_script, CurvesB=circle)
boundary_surfaces_2 = BoundarySurfaces(Edges=region_difference)
create_json_value = CreateJSONValue(Value=panel_4)
area_6 = Area(Geometry=boundary_surfaces_2)  # -> Area, Centroid
create_json_object = CreateJSONObject(Keys="site_boundary_generation", Values=create_json_value)
panel_6 = Panel(area_6.Area)
create_json_value_2 = CreateJSONValue(Value=panel_6)
create_json_value_3 = CreateJSONValue(Value=text)
create_json_object_2 = CreateJSONObject(Keys="Usable_site_area", Values=create_json_value_2)
mcp_tool_response = MCPToolResponse(Request=deconstruct_tool_call.Request, Content=create_json_object, IsError=False)
mcp_tool_response_2 = MCPToolResponse(Request=deconstruct_tool_call_2.Request, Content=create_json_value_3, IsError=False)
mcp_tool_response_3 = MCPToolResponse(Request=deconstruct_tool_call_3.Request, Content=create_json_object_2, IsError=False)
or = GateOr(A=mcp_tool_response, B=mcp_tool_response_3, C=mcp_tool_response_2)
tool_call_success = ClusterOutput(or)
tool_call_success_2 = ClusterOutput(stream_filter)
panel_7 = Panel(or)

# ==== cluster Team04DefinitionCluster

# ----
# Team 04 Definition Cluster
# CYLINDER TEAM
# Tool 02
panel = Panel("Name of the project site")
# Tool 01
panel_2 = Panel("Site boundary coordinates as text list")
panel_3 = Panel("Reads a closed site boundary curve and returns the site area and boundary coordinates as JSON")
param = DefineToolParameter(Name="site_name", Type="string", Description=panel, Required=Toggle(True))
param_2 = DefineToolParameter(Name="site_curve", Type="string", Description=panel_2, Required=Toggle(True))
merge = Merge(Data1=param_2, Data2=param)
tool = DefineTool(Name="site_boundary_reader_04", Description=panel_3, Parameters=merge)

define_tool_parameter = DefineToolParameter(Name="site_area", Type="number", Description="total area of the site", Required=Toggle(True))

panel_4 = Panel("Generates a simple parametric building mass based on width, depth, height, and shape type")
# Tool 03
panel_5 = Panel("Building depth")
param_3 = DefineToolParameter(Name="depth", Type="number", Description=panel_5, Required=Toggle(True))
param_4 = DefineToolParameter(Name="width", Type="number", Description="Building width", Required=Toggle(True))
merge_2 = Merge(Data1=param_4, Data2=param_3)
tool_2 = DefineTool(Name="parametric_shape_generator_04", Description=panel_4, Parameters=merge_2)

# ----
# Tool 05
toggle = BooleanToggle(True)

# ----
# Tool 04
panel_6 = Panel("This tool deletes a room by giving it a room name and the layout json")
param_5 = DefineToolParameter(Name="site_json", Type="string", Description="JSON output from site_boundary_reader_04", Required=Toggle(True))
param_6 = DefineToolParameter(Name="shape_json", Type="string", Description="JSON output from parametric_shape_generator_04", Required=Toggle(True))
param_7 = DefineToolParameter(Name="fit_json", Type="string", Description="JSON output from site_fit_checker_04", Required=toggle)
merge_3 = Merge(Data1=param_5, Data2=param_6, Data3=param_7)
tool_3 = DefineTool(Name="basic_site_evaluator_04", Description=panel_6, Parameters=merge_3)

# ----
# Tool 06
panel_7 = Panel("number")
define_tool_parameter_2 = DefineToolParameter(Name="number_of_trees", Type="number", Description="number of trees in the site", Required=Toggle(True))
define_tool_parameter_3 = DefineToolParameter(Name="number_of_sides_of_site", Type=panel_7, Description="the number os sides of the site ", Required=Toggle(True))
define_tool_parameter_4 = DefineToolParameter(Name="radius_of_trees", Type="number", Description="The Radius of a Tree in the site", Required=Toggle(True))
merge_4 = Merge(Data1=define_tool_parameter_2, Data2=define_tool_parameter_4, Data3=define_tool_parameter_3, Data4=define_tool_parameter)

panel_8 = Panel("Total area of the building shape boundary in square meters. Controls overall building shape size.")
panel_9 = Panel("Number of edge divisions or control points used to generate the site boundary shape. Higher values create more complex geometry.")
panel_10 = Panel("Total number of trees to populate within the site boundary. Controls vegetation density.")
panel_11 = Panel("Total number of trees to populate within the site boundary. Controls vegetation density.")
panel_12 = Panel("Name of the defined shape, there are 7 shapes in overall: L, Y, T, X,H,Z,O.")

panel_13 = Panel("Checks whether the generated building footprint fits inside the site boundary")
param_8 = DefineToolParameter(Name="site_json", Type="string", Description="JSON output from site_boundary_reader_04", Required=Toggle(True))
param_9 = DefineToolParameter(Name="shape_json", Type="string", Description="JSON output from parametric_shape_generator_04", Required=Toggle(True))
merge_5 = Merge(Data1=param_8, Data2=param_9)
tool_4 = DefineTool(Name="site_fit_checker_04", Description=panel_13, Parameters=merge_5)

panel_14 = Panel("Number of edge divisions or control points used to generate the site boundary shape. Higher values create more complex geometry.")
panel_15 = Panel("Total area of the site boundary in square meters. Controls overall site size.")
panel_16 = Panel("Generates procedural site boundaries using area, proportion, distortion, subdivision, and rotation parameters.")
panel_17 = Panel("Generates building shape boundaries using area, proportion, distortion, subdivision, and rotation parameters.")
define_tool_parameter_5 = DefineToolParameter(Name="Shape_Area", Type="number", Description=panel_8, Required=Toggle(True))
define_tool_parameter_6 = DefineToolParameter(Name="number_of_trees", Type="number", Description=panel_10, Required=Toggle(True))
define_tool_parameter_7 = DefineToolParameter(Name="radius_of_trees", Type="number", Description=panel_11, Required=Toggle(True))
define_tool_parameter_8 = DefineToolParameter(Name="shape_type", Type="Text", Description=panel_12, Required=Toggle(True))
define_tool_parameter_9 = DefineToolParameter(Name="Site angle", Type="Number", Description=panel_9, Required=Toggle(True))
define_tool_parameter_10 = DefineToolParameter(Name="Number of edges of sites", Type="Number", Description=panel_14, Required=Toggle(True))
define_tool_parameter_11 = DefineToolParameter(Name="Site area", Type="Number", Description=panel_15, Required=Toggle(True))
merge_6 = Merge(Data1=define_tool_parameter_6, Data2=define_tool_parameter_7)
merge_7 = Merge(Data1=define_tool_parameter_8, Data2=define_tool_parameter_5)
merge_8 = Merge(Data1=define_tool_parameter_11, Data2=define_tool_parameter_10, Data3=define_tool_parameter_9)
define_tool = DefineTool(Name="Usable_site_area", Description="area of Usable site area", Parameters=merge_6)
define_tool_2 = DefineTool(Name="parametric_shape_generator", Description=panel_17, Parameters=merge_7)
define_tool_3 = DefineTool(Name="area_of_the_compute_site", Description="area of site after compute", Parameters=merge_4)
define_tool_4 = DefineTool(Name="site_boundary_generation", Description=panel_16, Parameters=merge_8)
merge_9 = Merge(Data1=tool, Data2=tool_2, Data3=tool_4, Data4=tool_3, Data5=define_tool_3)
merge_10 = Merge(Data1=define_tool_4, Data2=define_tool, Data3=define_tool_2)
result = ClusterOutput(merge_10)
panel_18 = Panel(merge_10)
